# Grasshopper definition WorldOfDuchameAgle001.gh (Grasshopper 1.0.7)
# Copyright: Wickerson Studios
# plug-ins: Bifocals

# Wickerson Studio
# 
# created by: Michael Wickerson
# 
# Grasshopper for Rhino 3D Algorithmic Modeling
# 
# www.wickersonstudios.com
# www.michaelwickerson.com
# https://www.youtube.com/channel/UC7J48Ppcsa6oncp6d29R0xw
# https://github.com/mwickerson
# https://www.facebook.com/michael.wickerson
# https://www.linkedin.com/in/michael-wickerson-696a80156/
# Wickerson Studio
# created by: Michael Wickerson
# Grasshopper for Rhino 3D Algorithmic Modeling
# www.wickersonstudios.com
# www.michaelwickerson.com
# https://www.youtube.com/channel/UC7J48Ppcsa6oncp6d29R0xw
# https://github.com/mwickerson
# https://www.facebook.com/michael.wickerson
# https://www.linkedin.com/in/michael-wickerson-696a80156/
image_sampler = ImageSampler(
    FilePath="C:\Users\Sculpture\Documents\2020Grasshopper\ScreenShots2019\Screenshots2020\SurfaceEditAlgorithm.PNG",
    Filter="Value",
    Interpolate=False,
    Umax=1,
    Umin=0,
    Vmax=1,
    Vmin=0,
    Wrap=1)

number_slider = Slider(74, range=0..110)
number_slider_2 = Slider(2, range=0..10)
number_slider_3 = Slider(0.7, range=0..1)
number_slider_4 = Slider(27, range=1..110)
construct_domain = ConstructDomain(DomainStart=number_slider_4, DomainEnd=number_slider)
range = Range(Domain=construct_domain, Steps=10)
construct_domain_2 = ConstructDomain(DomainStart=number_slider_4, DomainEnd=Slider(76, range=0..110))
construct_domain_3 = ConstructDomain(DomainStart=number_slider, DomainEnd=Slider(76, range=0..110))
jitter = Jitter(List=range, Jitter=1, Seed=2)  # -> Values, Indices
range_2 = Range(Domain=construct_domain_2, Steps=number_slider_2)
range_3 = Range(Domain=construct_domain_3, Steps=number_slider_2)
unit_x = UnitX(Factor=jitter.Values)
vector_xyz = VectorXYZ(XComponent=unit_x, YComponent=unit_x, ZComponent=unit_x)  # -> Vector, Length
numbers_to_points = NumbersToPoints(Numbers=[range_2, range_3], Mask=2)
numbers_to_points_2 = NumbersToPoints(Numbers=[range_2, range_3], Mask=2)
move = Move(Geometry=numbers_to_points, Motion=vector_xyz.Vector)  # -> Geometry, Transform
box_2pt = Box2Pt(PointA=numbers_to_points_2, PointB=move.Geometry, Plane=PlaneXY(0, 0, 0))
volume = Volume(Geometry=box_2pt)  # -> Volume, Centroid
pi = Pi(Factor=Slider(1.39, range=0..2))
brep_plane = BrepPlane(Brep=box_2pt, Plane=PlaneXY(0, 0, 0))  # -> flatten(Curves), Points
construct_domain_4 = ConstructDomain(DomainStart=0, DomainEnd=pi)
list_length = ListLength(List=brep_plane.Curves)
range_4 = Range(Domain=construct_domain_4, Steps=expr("x-1", list_length))
jitter_2 = Jitter(List=range_4, Jitter=1, Seed=2)  # -> Values, Indices
rotate_3d = Rotate3D(Geometry=brep_plane.Curves, Angle=jitter_2.Values, Center=volume.Centroid, Axis=Vector(0, 0, 1))  # -> Geometry, Transform
scale_nu = ScaleNU(Geometry=rotate_3d.Geometry, Plane=PlaneXY(0, 0, 0), ScaleX=1, ScaleY=number_slider_3, ScaleZ=number_slider_3)  # -> Geometry, Transform
boundary_surfaces = BoundarySurfaces(Edges=scale_nu.Geometry)
construct_domain_5 = ConstructDomain(DomainStart=expr("x/3", number_slider), DomainEnd=number_slider)
list_length_2 = ListLength(List=boundary_surfaces)
range_5 = Range(Domain=construct_domain_5, Steps=expr("x-1", list_length_2))
unit_z = UnitZ(Factor=range_5)
extrude = Extrude(Base=boundary_surfaces, Direction=unit_z)
solid_difference = SolidDifference(BrepsA=box_2pt, BrepsB=extrude)
solid_union = SolidUnion(Breps=solid_difference)

# ----
# Place: Agle
# Location 11-53
# Flag:
# Good/Ill: I
# Race/Class: Orc
# Leader: Urgec
# Class/Rank: Chief
number_slider_5 = Slider(12, range=0..100)  # disabled
B = B(2)  # disabled
division = Division(A=number_slider_5, B=B)  # disabled
construct_domain_6 = ConstructDomain(DomainStart=0, DomainEnd=expr("x/2", number_slider_5))  # disabled
construct_domain_7 = ConstructDomain(DomainStart=0, DomainEnd=number_slider_5)  # disabled
rectangle = Rectangle(Plane=PlaneXY(0, 0, 0), XSize=construct_domain_7, YSize=construct_domain_6, Radius=0)  # -> Rectangle, Length; disabled
negative = Negative(Value=division)  # disabled
area = Area(Geometry=rectangle.Rectangle)  # -> Area, Centroid; disabled
unit_x_2 = UnitX(Factor=expr("x/2", [division, negative]))  # disabled
move_2 = Move(Geometry=area.Centroid, Motion=unit_x_2)  # -> Geometry, Transform; disabled
unit_y = UnitY(Factor=[division, negative])  # disabled
line = Line(StartPoint=area.Centroid, EndPoint=move_2.Geometry)  # disabled
scale = Scale(Geometry=line, Center=area.Centroid, Factor=0.5)  # -> graft(Geometry), Transform; disabled
move_3 = Move(Geometry=scale.Geometry, Motion=expr("x/3", unit_y))  # -> Geometry, Transform; disabled
boolean_toggle = BooleanToggle(True)  # disabled
merge = Merge(Data1=rectangle.Rectangle, Data2=line, Data3=move_3.Geometry)  # disabled
pipe = Pipe(Curve=merge, Radius=expr("x/24", division), Caps=boolean_toggle)  # disabled
solid_union_2 = SolidUnion(Breps=pipe)  # disabled

number_slider_6 = Slider(1.427, range=0..2)
md_slider = MDSlider(
    SliderMode=0,
    slider_value=Point(0.3761499917, 0.5818377239, 0.5),
    x_domain=Domain(0, 1),
    y_domain=Domain(0, 1),
    z_domain=Domain(0, 1))
surface = Surface(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)  # disabled

number_slider_7 = Slider(48, range=0..100)
surface_2 = Surface(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)
dimensions = Dimensions(Surface=surface_2)  # -> UDimension, VDimension
division_2 = Division(A=dimensions.UDimension, B=dimensions.VDimension)
multiplication = Multiplication(A=division_2, B=number_slider_7)

area_2 = Area(Geometry=surface_2)  # -> Area, Centroid
integer = Integer(multiplication)
scale_2 = Scale(Geometry=surface_2, Center=area_2.Centroid, Factor=Slider(2.66, range=0..5))  # -> Geometry, Transform
expression = Expression(x=integer, Expression="x+1")
evaluate_surface = EvaluateSurface(Surface=reparameterize(scale_2.Geometry), Point=md_slider)  # -> Point, Normal, UDirection, VDirection, Frame

divide_surface = DivideSurface(Surface=surface_2, UCount=integer, VCount=number_slider_7)  # -> flatten(Points), Normals, Parameters

distance = Distance(PointA=evaluate_surface.Point, PointB=divide_surface.Points)
expression_2 = Expression(w=graft(number_slider_6), t=distance, k=Slider(4, range=-10..10), Expression="sin(w*t + k*sin(w*t))")
expression_3 = Expression(w=graft(number_slider_6), t=distance, Expression="sin(w*t)^2")
multiplication_2 = Multiplication(A=Slider(4.71, range=0..10), B=expression_2)
unit_z_2 = UnitZ(Factor=multiplication_2)
move_4 = Move(Geometry=divide_surface.Points, Motion=unit_z_2)  # -> Geometry, Transform
surface_from_points = SurfaceFromPoints(Points=move_4.Geometry, UCount=expression, Interpolate=False)
scale_3 = Scale(Geometry=surface_from_points, Center=Point(0, 0, 0), Factor=Slider(5, range=0..10))  # -> Geometry, Transform
