# Grasshopper definition WorldOfDuchameAgle003Caves.gh (Grasshopper 1.0.7)
# Copyright: Wickerson Studios
# plug-ins: HoopSnake, Bifocals

# Wickerson Studio
# 
# created by: Michael Wickerson
# 
# Grasshopper for Rhino 3D Algorithmic Modeling
# 
# www.wickersonstudios.com
# www.michaelwickerson.com
# https://www.youtube.com/channel/UC7J48Ppcsa6oncp6d29R0xw
# https://github.com/mwickerson
# https://www.facebook.com/michael.wickerson
# https://www.linkedin.com/in/michael-wickerson-696a80156/
# Wickerson Studio
# created by: Michael Wickerson
# Grasshopper for Rhino 3D Algorithmic Modeling
# www.wickersonstudios.com
# www.michaelwickerson.com
# https://www.youtube.com/channel/UC7J48Ppcsa6oncp6d29R0xw
# https://github.com/mwickerson
# https://www.facebook.com/michael.wickerson
# https://www.linkedin.com/in/michael-wickerson-696a80156/
image_sampler = ImageSampler(
    FilePath="C:\Users\Sculpture\Documents\2020Grasshopper\ScreenShots2019\Screenshots2020\SurfaceEditAlgorithm.PNG",
    Filter="Value",
    Interpolate=False,
    Umax=1,
    Umin=0,
    Vmax=1,
    Vmin=0,
    Wrap=1)

number_slider = Slider(74, range=0..110)
number_slider_2 = Slider(2, range=0..10)
number_slider_3 = Slider(0.7, range=0..1)
number_slider_4 = Slider(27, range=1..110)
construct_domain = ConstructDomain(DomainStart=number_slider_4, DomainEnd=number_slider)
range = Range(Domain=construct_domain, Steps=10)
construct_domain_2 = ConstructDomain(DomainStart=number_slider_4, DomainEnd=Slider(76, range=0..110))
construct_domain_3 = ConstructDomain(DomainStart=number_slider, DomainEnd=Slider(32, range=0..110))
jitter = Jitter(List=range, Jitter=1, Seed=2)  # -> Values, Indices
range_2 = Range(Domain=construct_domain_2, Steps=number_slider_2)
range_3 = Range(Domain=construct_domain_3, Steps=number_slider_2)
unit_x = UnitX(Factor=jitter.Values)
vector_xyz = VectorXYZ(XComponent=unit_x, YComponent=unit_x, ZComponent=unit_x)  # -> Vector, Length
numbers_to_points = NumbersToPoints(Numbers=[range_2, range_3], Mask=2)
numbers_to_points_2 = NumbersToPoints(Numbers=[range_2, range_3], Mask=2)
move = Move(Geometry=numbers_to_points, Motion=vector_xyz.Vector)  # -> Geometry, Transform
box_2pt = Box2Pt(PointA=numbers_to_points_2, PointB=move.Geometry, Plane=PlaneXY(0, 0, 0))
volume = Volume(Geometry=box_2pt)  # -> Volume, Centroid
pi = Pi(Factor=Slider(1.39, range=0..2))
brep_plane = BrepPlane(Brep=box_2pt, Plane=PlaneXY(0, 0, 0))  # -> flatten(Curves), Points
construct_domain_4 = ConstructDomain(DomainStart=0, DomainEnd=pi)
list_length = ListLength(List=brep_plane.Curves)
range_4 = Range(Domain=construct_domain_4, Steps=expr("x-1", list_length))
jitter_2 = Jitter(List=range_4, Jitter=1, Seed=2)  # -> Values, Indices
rotate_3d = Rotate3D(Geometry=brep_plane.Curves, Angle=jitter_2.Values, Center=volume.Centroid, Axis=Vector(0, 0, 1))  # -> Geometry, Transform
scale_nu = ScaleNU(Geometry=rotate_3d.Geometry, Plane=PlaneXY(0, 0, 0), ScaleX=1, ScaleY=number_slider_3, ScaleZ=number_slider_3)  # -> Geometry, Transform
boundary_surfaces = BoundarySurfaces(Edges=scale_nu.Geometry)
construct_domain_5 = ConstructDomain(DomainStart=expr("x/3", number_slider), DomainEnd=number_slider)
list_length_2 = ListLength(List=boundary_surfaces)
range_5 = Range(Domain=construct_domain_5, Steps=expr("x-1", list_length_2))
unit_z = UnitZ(Factor=range_5)
extrude = Extrude(Base=boundary_surfaces, Direction=unit_z)
solid_difference = SolidDifference(BrepsA=box_2pt, BrepsB=extrude)
solid_union = SolidUnion(Breps=solid_difference)

number_slider_5 = Slider(74, range=0..110)
number_slider_6 = Slider(4, range=0..10)
number_slider_7 = Slider(0.7, range=0..1)
number_slider_8 = Slider(17, range=1..110)
construct_domain_6 = ConstructDomain(DomainStart=number_slider_8, DomainEnd=number_slider_5)
range_6 = Range(Domain=construct_domain_6, Steps=10)
construct_domain_7 = ConstructDomain(DomainStart=number_slider_8, DomainEnd=Slider(32, range=0..110))
construct_domain_8 = ConstructDomain(DomainStart=number_slider_5, DomainEnd=Slider(22, range=0..110))
jitter_3 = Jitter(List=range_6, Jitter=1, Seed=2)  # -> Values, Indices
range_7 = Range(Domain=construct_domain_7, Steps=number_slider_6)
range_8 = Range(Domain=construct_domain_8, Steps=number_slider_6)
unit_x_2 = UnitX(Factor=jitter_3.Values)
vector_xyz_2 = VectorXYZ(XComponent=unit_x_2, YComponent=unit_x_2, ZComponent=unit_x_2)  # -> Vector, Length
numbers_to_points_3 = NumbersToPoints(Numbers=[range_7, range_8], Mask=2)
numbers_to_points_4 = NumbersToPoints(Numbers=[range_7, range_8], Mask=2)
move_2 = Move(Geometry=numbers_to_points_3, Motion=vector_xyz_2.Vector)  # -> Geometry, Transform
box_2pt_2 = Box2Pt(PointA=numbers_to_points_4, PointB=move_2.Geometry, Plane=PlaneXY(0, 0, 0))
volume_2 = Volume(Geometry=box_2pt_2)  # -> Volume, Centroid
pi_2 = Pi(Factor=Slider(1.07, range=0..2))
brep_plane_2 = BrepPlane(Brep=box_2pt_2, Plane=PlaneXY(0, 0, 0))  # -> flatten(Curves), Points
construct_domain_9 = ConstructDomain(DomainStart=0, DomainEnd=pi_2)
list_length_3 = ListLength(List=brep_plane_2.Curves)
range_9 = Range(Domain=construct_domain_9, Steps=expr("x-1", list_length_3))
jitter_4 = Jitter(List=range_9, Jitter=1, Seed=2)  # -> Values, Indices
rotate_3d_2 = Rotate3D(Geometry=brep_plane_2.Curves, Angle=jitter_4.Values, Center=volume_2.Centroid, Axis=Vector(0, 0, 1))  # -> Geometry, Transform
scale_nu_2 = ScaleNU(Geometry=rotate_3d_2.Geometry, Plane=PlaneXY(0, 0, 0), ScaleX=number_slider_7, ScaleY=1, ScaleZ=number_slider_7)  # -> Geometry, Transform
boundary_surfaces_2 = BoundarySurfaces(Edges=scale_nu_2.Geometry)
construct_domain_10 = ConstructDomain(DomainStart=expr("x/3", number_slider_5), DomainEnd=number_slider_5)
list_length_4 = ListLength(List=boundary_surfaces_2)
range_10 = Range(Domain=construct_domain_10, Steps=expr("x-1", list_length_4))
unit_z_2 = UnitZ(Factor=range_10)
extrude_2 = Extrude(Base=boundary_surfaces_2, Direction=unit_z_2)
solid_difference_2 = SolidDifference(BrepsA=box_2pt_2, BrepsB=extrude_2)
solid_union_2 = SolidUnion(Breps=solid_difference_2)

curve = Curve(brep_plane.Curves)
list_length_5 = ListLength(List=curve)
modulus = Modulus(A=list_length_5, B=Slider(10, range=0..10))

# ----
# Place: Agle
# Location 11-53
# Flag:
# Good/Ill: I
# Race/Class: Orc
# Leader: Urgec
# Class/Rank: Chief
number_slider_9 = Slider(12, range=0..100)  # disabled
B = B(2)  # disabled
division = Division(A=number_slider_9, B=B)  # disabled
construct_domain_11 = ConstructDomain(DomainStart=0, DomainEnd=expr("x/2", number_slider_9))  # disabled
construct_domain_12 = ConstructDomain(DomainStart=0, DomainEnd=number_slider_9)  # disabled
rectangle = Rectangle(Plane=PlaneXY(0, 0, 0), XSize=construct_domain_12, YSize=construct_domain_11, Radius=0)  # -> Rectangle, Length; disabled
negative = Negative(Value=division)  # disabled
area = Area(Geometry=rectangle.Rectangle)  # -> Area, Centroid; disabled
unit_x_3 = UnitX(Factor=expr("x/2", [division, negative]))  # disabled
move_3 = Move(Geometry=area.Centroid, Motion=unit_x_3)  # -> Geometry, Transform; disabled
unit_y = UnitY(Factor=[division, negative])  # disabled
line = Line(StartPoint=area.Centroid, EndPoint=move_3.Geometry)  # disabled
scale = Scale(Geometry=line, Center=area.Centroid, Factor=0.5)  # -> graft(Geometry), Transform; disabled
move_4 = Move(Geometry=scale.Geometry, Motion=expr("x/3", unit_y))  # -> Geometry, Transform; disabled
boolean_toggle = BooleanToggle(True)  # disabled
merge = Merge(Data1=rectangle.Rectangle, Data2=line, Data3=move_4.Geometry)  # disabled
pipe = Pipe(Curve=merge, Radius=expr("x/24", division), Caps=boolean_toggle)  # disabled
solid_union_3 = SolidUnion(Breps=pipe)  # disabled

construct_domain_13 = ConstructDomain(DomainStart=0, DomainEnd=modulus)

list_length_6 = ListLength()
construct_domain_14 = ConstructDomain(DomainStart=0, DomainEnd=Slider(1.62, range=0..2))
z_coordinate = ZCoordinate(-150)
range_11 = Range(Domain=construct_domain_14, Steps=10)
pi_3 = Pi(Factor=range_11)
jitter_5 = Jitter(List=pi_3, Jitter=1, Seed=2)  # -> Values, Indices

sub_list = SubList(List=curve, Domain=construct_domain_13, Wrap=True)  # -> List, Index
explode = Explode(Curve=sub_list.List, Recursive=True)  # -> Segments, Vertices
list_item = ListItem(List=explode.Segments, Index=0, Wrap=True)  # -> Item, graft(Item1), Item2, Item3
perp_frame = PerpFrame(Curve=list_item.Item1, Parameter=Slider(0.5, range=0..1))
pi_4 = Pi(Factor=Slider(1.05, range=0.6..1.4))

number_slider_10 = Slider(400, range=0..1000)
number_slider_11 = Slider(2400, range=0..6000)
number_slider_12 = Slider(101, range=0..1000)
number_slider_13 = Slider(24, range=0..100)
construct_point = ConstructPoint(XCoordinate=0, YCoordinate=0, ZCoordinate=0)
unit_z_3 = UnitZ(Factor=1)
pi_5 = Pi(Factor=Slider(2, range=0..10))
subtraction = Subtraction(A=number_slider_11, B=number_slider_12)
line_sdl = LineSDL(Start=construct_point, Direction=unit_z_3, Length=number_slider_11)
division_2 = Division(A=pi_5, B=number_slider_13)
expression = Expression(x=number_slider_13, Expression="x+1")
division_3 = Division(A=subtraction, B=number_slider_13)
range_12 = Range(Domain=pi_5, Steps=number_slider_13)
multiplication = Multiplication(A=division_2, B=Slider(1, range=0..2))
series = Series(Start=0, Step=division_3, Count=expression)
addition = Addition(A=number_slider_10, B=Slider(466, range=0..1000))
addition_2 = Addition(A=range_12, B=multiplication)
construct_domain_15 = ConstructDomain(DomainStart=range_12, DomainEnd=addition_2)
construct_point_2 = ConstructPoint(XCoordinate=0, YCoordinate=0, ZCoordinate=series)
arc = Arc(Plane=construct_point_2, Radius=graft([number_slider_10, addition]), Angle=construct_domain_15)  # -> Arc, Length
flip_matrix = FlipMatrix(Data=arc.Arc)
unit_z_4 = UnitZ(Factor=number_slider_12)
loft = Loft(Curves=flip_matrix, Options={Adjust=False, Closed=False, LoftEnds=0, LoftSimp=0, LoftType=0, Rebuild=10, Refit=0.01})
extrude_3 = Extrude(Base=loft, Direction=unit_z_4)
pipe_2 = Pipe(Curve=line_sdl, Radius=number_slider_10, Caps=1)

rotate_plane = RotatePlane(Plane=perp_frame, Angle=pi_4)
curve_2 = Curve(list_item.Item1)
number_slider_14 = Slider(100, range=0..100)
deconstruct_plane = DeconstructPlane(Plane=rotate_plane)  # -> Origin, XAxis, YAxis, ZAxis
amplitude = Amplitude(Vector=deconstruct_plane.XAxis, Amplitude=number_slider_14)
move_5 = Move(Geometry=list_item.Item1, Motion=amplitude)  # -> Geometry, Transform
line_pt = LinePt(Line=move_5.Geometry, Point=amplitude)
merge_2 = Merge(Data1=move_5.Geometry, Data2=curve_2)
flip_matrix_2 = FlipMatrix(Data=line_pt)
list_item_2 = ListItem(List=flip_matrix_2, Index=0, Wrap=True)
panel = Panel(list_item_2)
param_viewer = ParamViewer(list_item_2)
loft_2 = Loft(Curves=merge_2, Options={Adjust=False, Closed=False, LoftEnds=0, LoftSimp=0, LoftType=0, Rebuild=10, Refit=0.01})
deconstruct_brep = DeconstructBrep(Brep=loft_2)  # -> Faces, Edges, Vertices
pi_6 = Pi(Factor=Slider(0.83, range=0..2))
list_item_3 = ListItem(List=deconstruct_brep.Edges, Index=0, Wrap=True)
scale_2 = Scale(Geometry=extrude_3, Center=Point(0, 0, 0), Factor=Slider(0.0419, range=0..1))  # -> flatten(Geometry), Transform
unit_z_5 = UnitZ(Factor=number_slider_14)
negative_2 = Negative(Value=unit_z_5)
brep_join = BrepJoin(Breps=scale_2.Geometry)  # -> Breps, Closed
point_on_curve = PointOnCurve(list_item_3, parameter=0)
md_slider = MDSlider(
    SliderMode=0,
    slider_value=Point(0.3521862495, 0.3785184535, 0.5),
    x_domain=Domain(0, 1),
    y_domain=Domain(0, 1),
    z_domain=Domain(0, 1))
orient = Orient(Geometry=brep_join.Breps, Source=PlaneXY(0, 0, 0), Target=point_on_curve)  # -> Geometry, Transform

number_slider_15 = Slider(1.427, range=0..2)
md_slider_2 = MDSlider(
    SliderMode=0,
    slider_value=Point(0.3761499917, 0.5818377239, 0.5),
    x_domain=Domain(0, 1),
    y_domain=Domain(0, 1),
    z_domain=Domain(0, 1))
surface = Surface(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)  # disabled

number_slider_16 = Slider(48, range=0..100)
surface_2 = Surface(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)
dimensions = Dimensions(Surface=surface_2)  # -> UDimension, VDimension
division_4 = Division(A=dimensions.UDimension, B=dimensions.VDimension)
multiplication_2 = Multiplication(A=division_4, B=number_slider_16)

area_2 = Area(Geometry=surface_2)  # -> Area, Centroid
integer = Integer(multiplication_2)
scale_3 = Scale(Geometry=surface_2, Center=area_2.Centroid, Factor=Slider(2.66, range=0..5))  # -> Geometry, Transform
expression_2 = Expression(x=integer, Expression="x+1")
evaluate_surface = EvaluateSurface(Surface=reparameterize(scale_3.Geometry), Point=md_slider_2)  # -> Point, Normal, UDirection, VDirection, Frame

divide_surface = DivideSurface(Surface=surface_2, UCount=integer, VCount=number_slider_16)  # -> flatten(Points), Normals, Parameters

distance = Distance(PointA=evaluate_surface.Point, PointB=divide_surface.Points)
expression_3 = Expression(w=graft(number_slider_15), t=distance, k=Slider(4, range=-10..10), Expression="sin(w*t + k*sin(w*t))")
expression_4 = Expression(w=graft(number_slider_15), t=distance, Expression="sin(w*t)^2")
multiplication_3 = Multiplication(A=Slider(1.58, range=0..10), B=expression_3)
unit_z_6 = UnitZ(Factor=multiplication_3)
move_6 = Move(Geometry=divide_surface.Points, Motion=unit_z_6)  # -> Geometry, Transform
surface_from_points = SurfaceFromPoints(Points=move_6.Geometry, UCount=expression_2, Interpolate=False)
scale_4 = Scale(Geometry=surface_from_points, Center=Point(0, 0, 0), Factor=Slider(5, range=0..10))  # -> Geometry, Transform

orient_2 = Orient(Geometry=scale_4.Geometry, Source=PlaneXY(0, 0, 0), Target=list_item_2)  # -> Geometry, Transform
rotate_3d_3 = Rotate3D(Geometry=orient_2.Geometry, Angle=pi_6, Center=Point(0, 0, 0), Axis=Vector(0, 0, 1))  # -> Geometry, Transform
extrude_4 = Extrude(Base=rotate_3d_3.Geometry, Direction=negative_2)
deconstruct_brep_2 = DeconstructBrep(Brep=extrude_4)  # -> Faces, Edges, Vertices
geometry = Geometry(extrude_4)
list_item_4 = ListItem(List=deconstruct_brep_2.Faces, Index=Slider(0, range=0..5), Wrap=True)
evaluate_surface_2 = EvaluateSurface(Surface=reparameterize(list_item_4), Point=md_slider)  # -> Point, Normal, UDirection, VDirection, Frame
move_to_plane = MoveToPlane(Geometry=solid_union_2, Plane=evaluate_surface_2.Point, Above=Toggle(True), Below=True)  # -> Geometry, Transform

hoopsnake = HoopSnake(
    StartingData=Slider(8, range=0..10),
    Data=evaluate,
    TerminationCondition=Slider(52, range=0..100),
    Hoopsnake_Data_autoUpdate=False,
    Hoopsnake_Data_dataLimit=2147483647,
    Hoopsnake_Data_resetCounter=True,
    Hoopsnake_Data_updateView=True)  # -> Feedback, flatten(FeedbackHistory), LoopsCounter, IterationsCounter
evaluate = Evaluate(Expression="x+x", x=hoopsnake.Feedback)
param_viewer_2 = ParamViewer(hoopsnake.FeedbackHistory)
panel_2 = Panel(hoopsnake.Feedback)
panel_3 = Panel(hoopsnake.IterationsCounter)
panel_4 = Panel(hoopsnake.LoopsCounter)
panel_5 = Panel(hoopsnake.FeedbackHistory)
jitter_6 = Jitter(List=hoopsnake.FeedbackHistory, Jitter=Slider(1, range=0..1), Seed=Slider(45, range=0..100))  # -> Values, Indices
panel_6 = Panel(jitter_6.Values)
construct_point_3 = ConstructPoint(XCoordinate=jitter_6.Values, YCoordinate=jitter_6.Values, ZCoordinate=z_coordinate)
rotate_3d_4 = Rotate3D(Geometry=construct_point_3, Angle=jitter_5.Values, Center=Point(0, 0, 0), Axis=Vector(0, 0, 1))  # -> Geometry, Transform
interpolate = Interpolate(Vertices=rotate_3d_4.Geometry, Degree=3, Periodic=False, KnotStyle=1)  # -> Curve, Length, Domain
pipe_3 = Pipe(Curve=interpolate.Curve, Radius=Slider(27, range=0..100), Caps=Toggle(True))

solid_difference_3 = SolidDifference(BrepsA=geometry, BrepsB=pipe_3)
