# Grasshopper definition WorldOfDuchameAirport001.gh (Grasshopper 1.0.7)
# Copyright: Wickerson Studios
# plug-ins: Bifocals

number_slider = Slider(37, range=0..100)  # disabled
number_slider_2 = Slider(21, range=0..100)  # disabled
negative = Negative(Value=number_slider)  # disabled
number_slider_3 = Slider(2, range=0..10)  # disabled
number_slider_4 = Slider(1, range=0..1)  # disabled
construct_domain = ConstructDomain(DomainStart=number_slider, DomainEnd=negative)  # disabled
number_slider_5 = Slider(1.5, range=0..10)  # disabled
circle = Circle(Plane=PlaneXY(0, 0, 0), Radius=number_slider_2)  # disabled
number_slider_6 = Slider(5.7, range=0..10)  # disabled
number_slider_7 = Slider(2, range=0..10)  # disabled
number_slider_8 = Slider(0.9, range=0..1)  # disabled
divide_curve = DivideCurve(Curve=circle, Count=number_slider_3, Kinks=False)  # -> Points, Tangents, Parameters; disabled
rectangle = Rectangle(Plane=PlaneXY(0, 0, 0), XSize=construct_domain, YSize=construct_domain, Radius=0)  # -> Rectangle, Length; disabled
number_slider_9 = Slider(5, range=0..10)  # disabled
number_slider_10 = Slider(20, range=0..100)  # disabled
point_charge = PointCharge(Point=divide_curve.Points, Charge=number_slider_4, Decay=number_slider_5, Bounds=rectangle.Rectangle)  # disabled
spin_force = SpinForce(
    Plane=divide_curve.Points,
    Strength=number_slider_8,
    Radius=number_slider_6,
    Decay=number_slider_7,
    Bounds=rectangle.Rectangle)  # disabled
circle_2 = Circle(Plane=divide_curve.Points, Radius=number_slider_9)  # disabled
merge_fields = MergeFields(Fields=[point_charge, spin_force])  # disabled
divide_curve_2 = DivideCurve(Curve=circle_2, Count=number_slider_10, Kinks=False)  # -> Points, Tangents, Parameters; disabled
field_line = FieldLine(Field=merge_fields, Point=divide_curve_2.Points, Steps=1000, Accuracy=0.1, Method=3)  # disabled

# ----
# Wickerson Studio
# 
# created by: Michael Wickerson
# 
# Grasshopper for Rhino 3D Algorithmic Modeling
# 
# www.wickersonstudios.com
# www.michaelwickerson.com
# https://www.youtube.com/channel/UC7J48Ppcsa6oncp6d29R0xw
# https://github.com/mwickerson
# https://www.facebook.com/michael.wickerson
# https://www.linkedin.com/in/michael-wickerson-696a80156/
# Wickerson Studio
# created by: Michael Wickerson
# Grasshopper for Rhino 3D Algorithmic Modeling
# www.wickersonstudios.com
# www.michaelwickerson.com
# https://www.youtube.com/channel/UC7J48Ppcsa6oncp6d29R0xw
# https://github.com/mwickerson
# https://www.facebook.com/michael.wickerson
# https://www.linkedin.com/in/michael-wickerson-696a80156/
image_sampler = ImageSampler(
    FilePath="C:\Users\Sculpture\Documents\2020Grasshopper\ScreenShots2019\Screenshots2020\SurfaceEditAlgorithm.PNG",
    Filter="Value",
    Interpolate=False,
    Umax=1,
    Umin=0,
    Vmax=1,
    Vmin=0,
    Wrap=1)
point = Point([Point(108, -112, 0), Point(-76, -62, 0), Point(-117, 52, 0), Point(10, 131, 0), Point(135, 86, 0), Point(-4, 35, 0)])

uv_point_count = Slider(12, range=0..500)
optional_seed_for_jitter_node = Slider(25, range=0..100)
width = Slider(10, range=0..10)
height_map = Slider(1.18, range=0..2)
thickness_of_zinc = Slider(0.86, range=0..10)

# ----
# Optional Gene Pool
# for Dispatch Pattern
gene_pool = GenePool(
    Decimals=0,
    Maximum=1,
    Minimum=0,
    Value=[0.1016146117, 0.1933914671, 0.3456139091, 0.2262482751, 0.8090761648, 0.700994063, 0.7747656041, 0.6660769669, 0.5805381199, 0.7147953914])

count = Count(1)
number_slider_11 = Slider(5, range=3..5)  # disabled

B = B(2)  # disabled
# Place: Airport
# Location 8 - 23
# Flag:
# Good/Ill: GI
# Race/Class: Human
# Leader: Morus
# Class/Rank: Captain
integer = Integer(20)  # disabled
B_2 = B(6)  # disabled
construct_domain_2 = ConstructDomain(DomainStart=0, DomainEnd=expr("x/2", integer))  # disabled
division = Division(A=integer, B=B)  # disabled
division_2 = Division(A=integer, B=B_2)  # disabled
construct_domain_3 = ConstructDomain(DomainStart=0, DomainEnd=integer)  # disabled
unit_y = UnitY(Factor=division_2)  # disabled
rectangle_2 = Rectangle(Plane=PlaneXY(0, 0, 0), XSize=construct_domain_3, YSize=construct_domain_2, Radius=0)  # -> Rectangle, Length; disabled
negative_2 = Negative(Value=division)  # disabled
area = Area(Geometry=rectangle_2.Rectangle)  # -> Area, Centroid; disabled
unit_x = UnitX(Factor=expr("x/2", [division, negative_2]))  # disabled
negative_3 = Negative(Value=unit_y)  # disabled
move = Move(Geometry=area.Centroid, Motion=unit_x)  # -> Geometry, Transform; disabled
number_slider_12 = Slider(1, range=0..1)  # disabled
dispatch = Dispatch(List=move.Geometry, DispatchPattern=[True, False])  # -> ListA, ListB; disabled
pi = Pi(Factor=number_slider_12)  # disabled
point_2 = Point(dispatch.ListB)  # disabled
point_3 = Point(dispatch.ListA)  # disabled
point_4 = Point(area.Centroid)  # disabled
arc = Arc(Plane=point_2, Radius=expr("x/8", integer), Angle=pi)  # -> Arc, Length; disabled
polygon = Polygon(Plane=point_3, Radius=3, Segments=number_slider_11, FilletRadius=0)  # -> Polygon, Length; disabled
explode = Explode(Curve=polygon.Polygon, Recursive=True)  # -> Segments, Vertices; disabled
move_2 = Move(Geometry=point_4, Motion=[unit_y, negative_3])  # -> Geometry, Transform; disabled
rotate = Rotate(Geometry=arc.Arc, Angle=1.570796327, Plane=point_2)  # -> Geometry, Transform; disabled
shift_list = ShiftList(List=explode.Vertices, Shift=1, Wrap=True)  # disabled
shift_list_2 = ShiftList(List=explode.Vertices, Shift=2, Wrap=True)  # disabled
point_on_curve = PointOnCurve(rotate.Geometry, parameter=0.691)  # disabled
number_slider_13 = Slider(1, range=0..1)  # disabled
dispatch_2 = Dispatch(List=move_2.Geometry, DispatchPattern=[True, False])  # -> ListA, ListB; disabled
list_item = ListItem(List=explode.Vertices, Index=0, Wrap=True)  # -> Item, Item1, Item2, Item3, Item4; disabled
list_item_2 = ListItem(List=explode.Vertices, Index=0, Wrap=True)  # -> Item, Item1, Item2, Item3, Item4; disabled
list_item_3 = ListItem(List=shift_list, Index=0, Wrap=True)  # -> Item, Item1, Item2, Item3, Item4; disabled
list_item_4 = ListItem(List=shift_list, Index=0, Wrap=True)  # -> Item, Item1, Item2, Item3, Item4; disabled
list_item_5 = ListItem(List=shift_list_2, Index=0, Wrap=True)  # -> Item, Item1, Item2, Item3, Item4; disabled
list_item_6 = ListItem(List=shift_list_2, Index=0, Wrap=True)  # -> Item, Item1, Item2, Item3, Item4; disabled
vector_2pt = Vector2Pt(PointA=point_on_curve, PointB=point_2, Unitize=False)  # -> Vector, Length; disabled
line = Line(StartPoint=dispatch_2.ListA, EndPoint=dispatch_2.ListB)  # disabled
amplitude = Amplitude(Vector=vector_2pt.Vector, Amplitude=number_slider_13)  # disabled
cross_reference = CrossReference(ListListA=list_item.Item, ListListB=[list_item_2.Item2, list_item_2.Item3], CrossMode=1)  # -> ListListA, ListListB; disabled
cross_reference_2 = CrossReference(ListListA=list_item_3.Item, ListListB=[list_item_4.Item2, list_item_4.Item3], CrossMode=1)  # -> ListListA, ListListB; disabled
cross_reference_3 = CrossReference(ListListA=list_item_5.Item, ListListB=[list_item_6.Item2, list_item_6.Item3], CrossMode=1)  # -> ListListA, ListListB; disabled
end_points = EndPoints(Curve=rotate.Geometry)  # -> Start, End; disabled
move_3 = Move(Geometry=point_on_curve, Motion=amplitude)  # -> Geometry, Transform; disabled
line_2 = Line(
    StartPoint=[cross_reference.ListListA, cross_reference_2.ListListA, cross_reference_3.ListListA],
    EndPoint=[cross_reference.ListListB, cross_reference_2.ListListB, cross_reference_3.ListListB])  # disabled
arc_3pt = Arc3Pt(PointA=end_points.Start, PointB=move_3.Geometry, PointC=end_points.End)  # -> Arc, Plane, Radius; disabled
merge = Merge(Data1=line_2)  # disabled
merge_2 = Merge(Data1=rectangle_2.Rectangle, Data2=arc_3pt.Arc, Data3=rotate.Geometry, Data4=line, Data5=merge)  # disabled
pipe = Pipe(Curve=merge_2, Radius=expr("x/30", division), Caps=2)  # disabled
solid_union = SolidUnion(Breps=pipe)  # disabled

count_2 = Count(1)

number_slider_14 = Slider(769, range=0..1100)
negative_4 = Negative(Value=number_slider_14)
number_slider_15 = Slider(1, range=0..1)
construct_domain_4 = ConstructDomain(DomainStart=number_slider_14, DomainEnd=negative_4)
number_slider_16 = Slider(0, range=0..10)
circle_3 = Circle(Plane=PlaneXY(0, 0, 0), Radius=Slider(100, range=0..100))
divide_curve_3 = DivideCurve(Curve=circle_3, Count=count, Kinks=False)  # -> Points, Tangents, Parameters
rectangle_3 = Rectangle(Plane=PlaneXY(0, 0, 0), XSize=construct_domain_4, YSize=construct_domain_4, Radius=0)  # -> Rectangle, Length
point_charge_2 = PointCharge(Point=divide_curve_3.Points, Charge=number_slider_15, Decay=number_slider_16, Bounds=rectangle_3.Rectangle)
spin_force_2 = SpinForce(
    Plane=divide_curve_3.Points,
    Strength=Slider(1, range=0..1),
    Radius=Slider(6.7, range=0..10),
    Decay=Slider(9, range=0..10),
    Bounds=rectangle_3.Rectangle)
circle_4 = Circle(Plane=divide_curve_3.Points, Radius=Slider(110, range=0..110))
divide_curve_4 = DivideCurve(Curve=circle_4, Count=Slider(10, range=0..100), Kinks=False)  # -> Points, Tangents, Parameters

point_charge_3 = PointCharge(Point=point, Charge=number_slider_15, Decay=number_slider_16, Bounds=rectangle_3.Rectangle)

merge_fields_2 = MergeFields(Fields=[point_charge_2, spin_force_2, point_charge_3])
field_line_2 = FieldLine(Field=merge_fields_2, Point=divide_curve_4.Points, Steps=1000, Accuracy=0.1, Method=3)  # -> flatten(Curve)

list_length = ListLength(List=field_line_2)
number_slider_17 = Slider(-20, range=-20..20)
negative_5 = Negative(Value=number_slider_17)
construct_domain_5 = ConstructDomain(DomainStart=number_slider_17, DomainEnd=negative_5)
range = Range(Domain=construct_domain_5, Steps=expr("x-1", list_length))
unit_z = UnitZ(Factor=range)
move_4 = Move(Geometry=field_line_2, Motion=unit_z)  # -> Geometry, Transform
flip_matrix = FlipMatrix(Data=move_4.Geometry)
divide_curve_5 = DivideCurve(Curve=flip_matrix, Count=count_2, Kinks=False)  # -> flatten(Points), Tangents, Parameters
surface_from_points = SurfaceFromPoints(Points=divide_curve_5.Points, UCount=Slider(10, range=0..100), Interpolate=False)
scale = Scale(Geometry=surface_from_points, Center=Point(0, 0, 0), Factor=Slider(0.46, range=0..1))  # -> Geometry, Transform
unit_z_2 = UnitZ(Factor=Slider(56, range=0..100))
move_5 = Move(Geometry=scale.Geometry, Motion=unit_z_2)  # -> Geometry, Transform
deconstruct_brep = DeconstructBrep(Brep=surface_from_points)  # -> Faces, Edges, Vertices
deconstruct_brep_2 = DeconstructBrep(Brep=move_5.Geometry)  # -> Faces, Edges, Vertices
explode_2 = Explode(Curve=deconstruct_brep.Edges, Recursive=True)  # -> Segments, Vertices
explode_3 = Explode(Curve=deconstruct_brep_2.Edges, Recursive=True)  # -> Segments, Vertices
loft = Loft(
    Curves=[explode_2.Segments, explode_3.Segments],
    Options={Adjust=False, Closed=False, LoftEnds=0, LoftSimp=0, LoftType=0, Rebuild=10, Refit=0.01})
geometry = Geometry(deconstruct_brep.Faces)
geometry_2 = Geometry(deconstruct_brep_2.Faces)
brep_join = BrepJoin(Breps=[geometry, loft, geometry_2])  # -> Breps, Closed

# ----
# Surface Edit for Zahner
# Bake me in to RHINO!
# Parameters to Play with!
rectangle_4 = Rectangle(Plane=PlaneXY(0, 0, 0), XSize=uv_point_count, YSize=width, Radius=0)  # -> Rectangle, Length
divide_surface = DivideSurface(Surface=rectangle_4.Rectangle, UCount=uv_point_count, VCount=uv_point_count)  # -> flatten(Points), Normals, Parameters
construct_domain_6 = ConstructDomain(DomainStart=0, DomainEnd=height_map)
dispatch_3 = Dispatch(List=divide_surface.Points, DispatchPattern=gene_pool)  # -> ListA, ListB
surface_from_points_2 = SurfaceFromPoints(Points=divide_surface.Points, UCount=expr("x+1", uv_point_count), Interpolate=False)
list_length_2 = ListLength(List=dispatch_3.ListA)  # -> flatten(Length)
range_2 = Range(Domain=construct_domain_6, Steps=expr("x-1", list_length_2))
unit_z_3 = UnitZ(Factor=range_2)
unit_z_4 = UnitZ(Factor=thickness_of_zinc)
number_slider_18 = Slider(198, range=-1..1000)
vec = VectorXYZ(XComponent=number_slider_18, YComponent=number_slider_18, ZComponent=0)  # -> Vector, Length

# ----
# Optional Jitter
# Node for
# SEED
jitter = Jitter(List=unit_z_3, Jitter=1, Seed=optional_seed_for_jitter_node)  # -> Values, Indices

point_deform = PointDeform(Geometry=surface_from_points_2, Points=dispatch_3.ListA, Motion=jitter.Values)
scale_2 = Scale(Geometry=point_deform, Center=Point(0, 0, 0), Factor=Slider(17, range=0..20))  # -> Geometry, Transform
move_6 = Move(Geometry=scale_2.Geometry, Motion=vec.Vector)  # -> Geometry, Transform

extrude = Extrude(Base=point_deform, Direction=unit_z_4)

volume = Volume(Geometry=extrude)  # -> Volume, Centroid
scale_3 = Scale(Geometry=extrude, Center=volume.Centroid, Factor=Slider(46, range=0..100))  # -> Geometry, Transform
