# Grasshopper definition WorldOfDuchameAirport003Buildings.gh (Grasshopper 1.0.7)
# Copyright: Wickerson Studios
# plug-ins: Bifocals

# Wickerson Studio
# 
# created by: Michael Wickerson
# 
# Grasshopper for Rhino 3D Algorithmic Modeling
# 
# www.wickersonstudios.com
# www.michaelwickerson.com
# https://www.youtube.com/channel/UC7J48Ppcsa6oncp6d29R0xw
# https://github.com/mwickerson
# https://www.facebook.com/michael.wickerson
# https://www.linkedin.com/in/michael-wickerson-696a80156/
# Wickerson Studio
# created by: Michael Wickerson
# Grasshopper for Rhino 3D Algorithmic Modeling
# www.wickersonstudios.com
# www.michaelwickerson.com
# https://www.youtube.com/channel/UC7J48Ppcsa6oncp6d29R0xw
# https://github.com/mwickerson
# https://www.facebook.com/michael.wickerson
# https://www.linkedin.com/in/michael-wickerson-696a80156/
image_sampler = ImageSampler(
    FilePath="C:\Users\Sculpture\Documents\2020Grasshopper\ScreenShots2019\Screenshots2020\SurfaceEditAlgorithm.PNG",
    Filter="Value",
    Interpolate=False,
    Umax=1,
    Umin=0,
    Vmax=1,
    Vmin=0,
    Wrap=1)
number_slider = Slider(5, range=3..5)  # disabled

B = B(2)  # disabled
# Place: Airport
# Location 8 - 23
# Flag:
# Good/Ill: GI
# Race/Class: Human
# Leader: Morus
# Class/Rank: Captain
integer = Integer(20)  # disabled
B_2 = B(6)  # disabled
construct_domain = ConstructDomain(DomainStart=0, DomainEnd=integer)  # disabled
construct_domain_2 = ConstructDomain(DomainStart=0, DomainEnd=expr("x/2", integer))  # disabled
division = Division(A=integer, B=B)  # disabled
division_2 = Division(A=integer, B=B_2)  # disabled
unit_y = UnitY(Factor=division_2)  # disabled
rectangle = Rectangle(Plane=PlaneXY(0, 0, 0), XSize=construct_domain, YSize=construct_domain_2, Radius=0)  # -> Rectangle, Length; disabled
negative = Negative(Value=division)  # disabled
area = Area(Geometry=rectangle.Rectangle)  # -> Area, Centroid; disabled
unit_x = UnitX(Factor=expr("x/2", [division, negative]))  # disabled
negative_2 = Negative(Value=unit_y)  # disabled
move = Move(Geometry=area.Centroid, Motion=unit_x)  # -> Geometry, Transform; disabled
number_slider_2 = Slider(1, range=0..1)  # disabled
dispatch = Dispatch(List=move.Geometry, DispatchPattern=[True, False])  # -> ListA, ListB; disabled
pi = Pi(Factor=number_slider_2)  # disabled
point = Point(dispatch.ListB)  # disabled
point_2 = Point(dispatch.ListA)  # disabled
point_3 = Point(area.Centroid)  # disabled
arc = Arc(Plane=point, Radius=expr("x/8", integer), Angle=pi)  # -> Arc, Length; disabled
polygon = Polygon(Plane=point_2, Radius=3, Segments=number_slider, FilletRadius=0)  # -> Polygon, Length; disabled
explode = Explode(Curve=polygon.Polygon, Recursive=True)  # -> Segments, Vertices; disabled
move_2 = Move(Geometry=point_3, Motion=[unit_y, negative_2])  # -> Geometry, Transform; disabled
rotate = Rotate(Geometry=arc.Arc, Angle=1.570796327, Plane=point)  # -> Geometry, Transform; disabled
shift_list = ShiftList(List=explode.Vertices, Shift=1, Wrap=True)  # disabled
shift_list_2 = ShiftList(List=explode.Vertices, Shift=2, Wrap=True)  # disabled
point_on_curve = PointOnCurve(rotate.Geometry, parameter=0.691)  # disabled
number_slider_3 = Slider(1, range=0..1)  # disabled
dispatch_2 = Dispatch(List=move_2.Geometry, DispatchPattern=[True, False])  # -> ListA, ListB; disabled
list_item = ListItem(List=explode.Vertices, Index=0, Wrap=True)  # -> Item, Item1, Item2, Item3, Item4; disabled
list_item_2 = ListItem(List=explode.Vertices, Index=0, Wrap=True)  # -> Item, Item1, Item2, Item3, Item4; disabled
list_item_3 = ListItem(List=shift_list, Index=0, Wrap=True)  # -> Item, Item1, Item2, Item3, Item4; disabled
list_item_4 = ListItem(List=shift_list, Index=0, Wrap=True)  # -> Item, Item1, Item2, Item3, Item4; disabled
list_item_5 = ListItem(List=shift_list_2, Index=0, Wrap=True)  # -> Item, Item1, Item2, Item3, Item4; disabled
list_item_6 = ListItem(List=shift_list_2, Index=0, Wrap=True)  # -> Item, Item1, Item2, Item3, Item4; disabled
vector_2pt = Vector2Pt(PointA=point_on_curve, PointB=point, Unitize=False)  # -> Vector, Length; disabled
line = Line(StartPoint=dispatch_2.ListA, EndPoint=dispatch_2.ListB)  # disabled
amplitude = Amplitude(Vector=vector_2pt.Vector, Amplitude=number_slider_3)  # disabled
cross_reference = CrossReference(ListListA=list_item.Item, ListListB=[list_item_2.Item2, list_item_2.Item3], CrossMode=1)  # -> ListListA, ListListB; disabled
cross_reference_2 = CrossReference(ListListA=list_item_3.Item, ListListB=[list_item_4.Item2, list_item_4.Item3], CrossMode=1)  # -> ListListA, ListListB; disabled
cross_reference_3 = CrossReference(ListListA=list_item_5.Item, ListListB=[list_item_6.Item2, list_item_6.Item3], CrossMode=1)  # -> ListListA, ListListB; disabled
end_points = EndPoints(Curve=rotate.Geometry)  # -> Start, End; disabled
move_3 = Move(Geometry=point_on_curve, Motion=amplitude)  # -> Geometry, Transform; disabled
line_2 = Line(
    StartPoint=[cross_reference.ListListA, cross_reference_2.ListListA, cross_reference_3.ListListA],
    EndPoint=[cross_reference.ListListB, cross_reference_2.ListListB, cross_reference_3.ListListB])  # disabled
arc_3pt = Arc3Pt(PointA=end_points.Start, PointB=move_3.Geometry, PointC=end_points.End)  # -> Arc, Plane, Radius; disabled
merge = Merge(Data1=line_2)  # disabled
merge_2 = Merge(Data1=rectangle.Rectangle, Data2=arc_3pt.Arc, Data3=rotate.Geometry, Data4=line, Data5=merge)  # disabled
pipe = Pipe(Curve=merge_2, Radius=expr("x/30", division), Caps=2)  # disabled
solid_union = SolidUnion(Breps=pipe)  # disabled

count = Count(1)
unit_x_2 = UnitX(Factor=Slider(400, range=0..400))
negative_3 = Negative(Value=unit_x_2)
polygon_2 = Polygon(Plane=PlaneXY(0, 0, 0), Radius=Slider(47, range=0..100), Segments=Slider(4, range=0..10), FilletRadius=0)  # -> Polygon, Length
curve = Curve(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)
curve_2 = Curve(polygon_2.Polygon)
number_slider_4 = Slider(3, range=0..10)
unit_z = UnitZ(Factor=1)
negative_4 = Negative(Value=unit_z)

number_slider_5 = Slider(1.908, range=0..2)
md_slider = MDSlider(
    SliderMode=0,
    slider_value=Point(0.3761499917, 0.5818377239, 0.5),
    x_domain=Domain(0, 1),
    y_domain=Domain(0, 1),
    z_domain=Domain(0, 1))
surface = Surface(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)

number_slider_6 = Slider(35, range=0..100)
surface_2 = Surface(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)
dimensions = Dimensions(Surface=surface_2)  # -> UDimension, VDimension
division_3 = Division(A=dimensions.UDimension, B=dimensions.VDimension)
multiplication = Multiplication(A=division_3, B=number_slider_6)

number_slider_7 = Slider(769, range=0..1100)
negative_5 = Negative(Value=number_slider_7)
number_slider_8 = Slider(1, range=0..1)
construct_domain_3 = ConstructDomain(DomainStart=number_slider_7, DomainEnd=negative_5)
number_slider_9 = Slider(0, range=0..10)
circle = Circle(Plane=PlaneXY(0, 0, 0), Radius=Slider(100, range=0..100))
rectangle_2 = Rectangle(Plane=PlaneXY(0, 0, 0), XSize=construct_domain_3, YSize=construct_domain_3, Radius=0)  # -> Rectangle, Length

number_slider_10 = Slider(963, range=0..1100)
negative_6 = Negative(Value=number_slider_10)
number_slider_11 = Slider(0.3, range=0..1)
construct_domain_4 = ConstructDomain(DomainStart=number_slider_10, DomainEnd=negative_6)
number_slider_12 = Slider(0, range=0..10)
circle_2 = Circle(Plane=PlaneXY(0, 0, 0), Radius=Slider(26, range=0..100))
divide_curve = DivideCurve(Curve=circle_2, Count=Slider(2, range=0..10), Kinks=False)  # -> Points, Tangents, Parameters
rectangle_3 = Rectangle(Plane=PlaneXY(0, 0, 0), XSize=construct_domain_4, YSize=construct_domain_4, Radius=0)  # -> Rectangle, Length
point_charge = PointCharge(Point=divide_curve.Points, Charge=number_slider_11, Decay=number_slider_12, Bounds=rectangle_3.Rectangle)
circle_3 = Circle(Plane=divide_curve.Points, Radius=Slider(15.8, range=0..110))
divide_curve_2 = DivideCurve(Curve=circle_3, Count=Slider(10, range=0..100), Kinks=False)  # -> Points, Tangents, Parameters

point_charge_2 = PointCharge(Point=divide_curve.Points, Charge=number_slider_11, Decay=number_slider_12, Bounds=rectangle_3.Rectangle)

merge_fields = MergeFields(Fields=[point_charge, point_charge_2])
field_line = FieldLine(Field=merge_fields, Point=divide_curve_2.Points, Steps=1000, Accuracy=0.1, Method=3)  # -> flatten(Curve)

list_length = ListLength(List=field_line)
number_slider_13 = Slider(-12.384, range=-20..20)
negative_7 = Negative(Value=number_slider_13)
construct_domain_5 = ConstructDomain(DomainStart=number_slider_13, DomainEnd=negative_7)
range = Range(Domain=construct_domain_5, Steps=expr("x-1", list_length))
unit_z_2 = UnitZ(Factor=range)
move_4 = Move(Geometry=field_line, Motion=unit_z_2)  # -> Geometry, Transform
flip_matrix = FlipMatrix(Data=move_4.Geometry)
divide_curve_3 = DivideCurve(Curve=flip_matrix, Count=count, Kinks=False)  # -> flatten(Points), Tangents, Parameters
surface_from_points = SurfaceFromPoints(Points=divide_curve_3.Points, UCount=Slider(10, range=0..100), Interpolate=False)
scale = Scale(Geometry=surface_from_points, Center=Point(0, 0, 0), Factor=Slider(0.46, range=0..1))  # -> Geometry, Transform
unit_z_3 = UnitZ(Factor=Slider(56, range=0..100))
move_5 = Move(Geometry=scale.Geometry, Motion=unit_z_3)  # -> Geometry, Transform
deconstruct_brep = DeconstructBrep(Brep=surface_from_points)  # -> Faces, Edges, Vertices
deconstruct_brep_2 = DeconstructBrep(Brep=move_5.Geometry)  # -> Faces, Edges, Vertices
explode_2 = Explode(Curve=deconstruct_brep.Edges, Recursive=True)  # -> Segments, Vertices
explode_3 = Explode(Curve=deconstruct_brep_2.Edges, Recursive=True)  # -> Segments, Vertices
loft = Loft(
    Curves=[explode_2.Segments, explode_3.Segments],
    Options={Adjust=False, Closed=False, LoftEnds=0, LoftSimp=0, LoftType=0, Rebuild=10, Refit=0.01})  # -> flatten(Loft)
geometry = Geometry(deconstruct_brep.Faces)
geometry_2 = Geometry(deconstruct_brep_2.Faces)

merge_3 = Merge(Data1=geometry, Data2=loft, Data3=geometry_2)
scale_2 = Scale(Geometry=merge_3, Center=Point(0, 0, 0), Factor=Slider(3, range=0..10))  # -> Geometry, Transform
move_6 = Move(Geometry=scale_2.Geometry, Motion=negative_3)  # -> Geometry, Transform
deconstruct_brep_3 = DeconstructBrep(Brep=move_6.Geometry)  # -> Faces, Edges, Vertices
list_item_7 = ListItem(List=deconstruct_brep_3.Faces, Index=0, Wrap=True)  # -> Item, Item1, Item2, Item3
surface_3 = Surface(list_item_7.Item)
surface_4 = Surface(reparameterize(surface_3))
divide_surface = DivideSurface(Surface=surface_4, UCount=number_slider_4, VCount=number_slider_4)  # -> Points, Normals, Parameters

point_4 = Point(flatten(divide_surface.Points))
random_reduce = RandomReduce(List=point_4, Reduction=Slider(32, range=0..100), Seed=1)
explode_4 = Explode(Curve=curve_2, Recursive=True)  # -> Segments, Vertices
area_2 = Area(Geometry=curve_2)  # -> Area, Centroid
construct_plane = ConstructPlane(Origin=random_reduce, XAxis=Vector(1, 0, 0), YAxis=Vector(0, 1, 0))
list_length_2 = ListLength(List=construct_plane)
construct_domain_6 = ConstructDomain(DomainStart=Slider(0.5, range=0.5..2), DomainEnd=Slider(2, range=0.5..2))
xz_plane = XZPlane(Origin=construct_plane)
range_2 = Range(Domain=construct_domain_6, Steps=expr("x-1", list_length_2))
construct_domain_7 = ConstructDomain(DomainStart=0, DomainEnd=Slider(2, range=0..2))
construct_domain_8 = ConstructDomain(DomainStart=0, DomainEnd=Slider(0, range=0..2))
scale_3 = Scale(Geometry=curve_2, Center=area_2.Centroid, Factor=range_2)  # -> Geometry, Transform
range_3 = Range(Domain=construct_domain_7, Steps=expr("x-1", list_length_2))
range_4 = Range(Domain=construct_domain_8, Steps=expr("x-1", list_length_2))
pi_2 = Pi(Factor=range_3)
pi_3 = Pi(Factor=range_4)
construct_domain_9 = ConstructDomain(DomainStart=Slider(78.903, range=0..100), DomainEnd=1)
rotate_3d = Rotate3D(Geometry=scale_3.Geometry, Angle=pi_2, Center=explode_4.Vertices, Axis=Vector(0, 0, 1))  # -> graft(Geometry), Transform
area_3 = Area(Geometry=rotate_3d.Geometry)  # -> Area, Centroid
range_5 = Range(Domain=construct_domain_9, Steps=expr("x-1", list_length_2))  # -> graft(Range)
scale_4 = Scale(Center=Point(0, 0, 0), Factor=0.5)  # -> Geometry, Transform
scale_nu = ScaleNU(
    Geometry=rotate_3d.Geometry,
    Plane=area_3.Centroid,
    ScaleX=Slider(0.8, range=0..1),
    ScaleY=Slider(0.68, range=0..1),
    ScaleZ=1)  # -> Geometry, Transform
unit_z_4 = UnitZ(Factor=range_5)
move_7 = Move(Geometry=scale_nu.Geometry, Motion=unit_z_4)  # -> Geometry, Transform
loft_2 = Loft(
    Curves=[rotate_3d.Geometry, move_7.Geometry],
    Options={Adjust=False, Closed=False, LoftEnds=0, LoftSimp=0, LoftType=0, Rebuild=10, Refit=0.01})  # -> flatten(Loft)
cap_holes = CapHoles(Brep=loft_2)
jitter = Jitter(List=cap_holes, Jitter=1, Seed=Slider(50, range=0..100))  # -> Values, Indices
orient = Orient(Geometry=jitter.Values, Source=PlaneXY(0, 0, 0), Target=construct_plane)  # -> Geometry, Transform
rotate_2 = Rotate(Geometry=orient.Geometry, Angle=pi_3, Plane=xz_plane)  # -> Geometry, Transform

volume = Volume(Geometry=rotate_2.Geometry)  # -> Volume, Centroid
line_sdl = LineSDL(Start=volume.Centroid, Direction=negative_4, Length=Slider(74, range=0..100))
pipe_2 = Pipe(Curve=line_sdl, Radius=Slider(5.99, range=0..10), Caps=0)

count_2 = Count(1)
number_slider_14 = Slider(6.62, range=0..10)
unit_z_5 = UnitZ(Factor=Slider(29.88, range=0..100))

divide_curve_4 = DivideCurve(Curve=circle, Count=Slider(2, range=0..10), Kinks=False)  # -> Points, Tangents, Parameters
point_charge_3 = PointCharge(Point=divide_curve_4.Points, Charge=number_slider_8, Decay=number_slider_9, Bounds=rectangle_2.Rectangle)
circle_4 = Circle(Plane=divide_curve_4.Points, Radius=Slider(110, range=0..110))
divide_curve_5 = DivideCurve(Curve=circle_4, Count=Slider(10, range=0..100), Kinks=False)  # -> Points, Tangents, Parameters

area_4 = Area(Geometry=surface_2)  # -> Area, Centroid
integer_2 = Integer(multiplication)
scale_5 = Scale(Geometry=surface_2, Center=area_4.Centroid, Factor=Slider(2.66, range=0..5))  # -> Geometry, Transform
expression = Expression(x=integer_2, Expression="x+1")
evaluate_surface = EvaluateSurface(Surface=reparameterize(scale_5.Geometry), Point=md_slider)  # -> Point, Normal, UDirection, VDirection, Frame

divide_surface_2 = DivideSurface(Surface=surface_2, UCount=integer_2, VCount=number_slider_6)  # -> flatten(Points), Normals, Parameters

distance = Distance(PointA=evaluate_surface.Point, PointB=divide_surface_2.Points)
expression_2 = Expression(w=graft(number_slider_5), t=distance, k=Slider(4, range=-10..10), Expression="sin(w*t + k*sin(w*t))")
expression_3 = Expression(w=graft(number_slider_5), t=distance, Expression="sin(w*t)^2")
multiplication_2 = Multiplication(A=Slider(8.72, range=0..10), B=expression_2)
unit_z_6 = UnitZ(Factor=multiplication_2)
move_8 = Move(Geometry=divide_surface_2.Points, Motion=unit_z_6)  # -> Geometry, Transform
surface_from_points_2 = SurfaceFromPoints(Points=move_8.Geometry, UCount=expression, Interpolate=False)

point_charge_4 = PointCharge(Point=divide_curve_4.Points, Charge=number_slider_8, Decay=number_slider_9, Bounds=rectangle_2.Rectangle)
scale_nu_2 = ScaleNU(
    Geometry=surface_from_points_2,
    Plane=PlaneXY(0, 0, 0),
    ScaleX=number_slider_14,
    ScaleY=number_slider_14,
    ScaleZ=Slider(2, range=0..10))  # -> Geometry, Transform
extrude = Extrude(Base=scale_nu_2.Geometry, Direction=unit_z_5)

merge_fields_2 = MergeFields(Fields=[point_charge_3, point_charge_4])
field_line_2 = FieldLine(Field=merge_fields_2, Point=divide_curve_5.Points, Steps=1000, Accuracy=0.1, Method=3)  # -> flatten(Curve)

list_length_3 = ListLength(List=field_line_2)
number_slider_15 = Slider(-12.384, range=-20..20)
negative_8 = Negative(Value=number_slider_15)
construct_domain_10 = ConstructDomain(DomainStart=number_slider_15, DomainEnd=negative_8)
range_6 = Range(Domain=construct_domain_10, Steps=expr("x-1", list_length_3))
unit_z_7 = UnitZ(Factor=range_6)
move_9 = Move(Geometry=field_line_2, Motion=unit_z_7)  # -> Geometry, Transform
flip_matrix_2 = FlipMatrix(Data=move_9.Geometry)
divide_curve_6 = DivideCurve(Curve=flip_matrix_2, Count=count_2, Kinks=False)  # -> flatten(Points), Tangents, Parameters
surface_from_points_3 = SurfaceFromPoints(Points=divide_curve_6.Points, UCount=Slider(10, range=0..100), Interpolate=False)
scale_6 = Scale(Geometry=surface_from_points_3, Center=Point(0, 0, 0), Factor=Slider(0.46, range=0..1))  # -> Geometry, Transform
unit_z_8 = UnitZ(Factor=Slider(56, range=0..100))
move_10 = Move(Geometry=scale_6.Geometry, Motion=unit_z_8)  # -> Geometry, Transform
deconstruct_brep_4 = DeconstructBrep(Brep=surface_from_points_3)  # -> Faces, Edges, Vertices
deconstruct_brep_5 = DeconstructBrep(Brep=move_10.Geometry)  # -> Faces, Edges, Vertices
explode_5 = Explode(Curve=deconstruct_brep_4.Edges, Recursive=True)  # -> Segments, Vertices
explode_6 = Explode(Curve=deconstruct_brep_5.Edges, Recursive=True)  # -> Segments, Vertices
loft_3 = Loft(
    Curves=[explode_5.Segments, explode_6.Segments],
    Options={Adjust=False, Closed=False, LoftEnds=0, LoftSimp=0, LoftType=0, Rebuild=10, Refit=0.01})  # -> flatten(Loft)
geometry_3 = Geometry(deconstruct_brep_4.Faces)
geometry_4 = Geometry(deconstruct_brep_5.Faces)

number_slider_16 = Slider(3, range=0..10)
surface_5 = Surface(reparameterize(loft_3))
number_slider_17 = Slider(10, range=0..10)
unit_z_9 = UnitZ(Factor=1)
divide_surface_3 = DivideSurface(Surface=surface_5, UCount=number_slider_16, VCount=number_slider_16)  # -> Points, Normals, Parameters
number_slider_18 = Slider(2, range=0..10)
line_sdl_2 = LineSDL(Start=divide_surface_3.Points, Direction=divide_surface_3.Normals, Length=number_slider_17)
line_sdl_3 = LineSDL(Start=divide_surface_3.Points, Direction=unit_z_9, Length=number_slider_17)
negative_9 = Negative(Value=Slider(0, range=0..10))
amplitude_2 = Amplitude(Vector=divide_surface_3.Normals, Amplitude=negative_9)
point_on_curve_2 = PointOnCurve(line_sdl_2, parameter=0.893)
point_on_curve_3 = PointOnCurve(line_sdl_2, parameter=0.339)
end_points_2 = EndPoints(Curve=line_sdl_3)  # -> Start, End
move_11 = Move(Geometry=[point_on_curve_2, point_on_curve_3], Motion=amplitude_2)  # -> Geometry, Transform
interpolate = Interpolate(Vertices=end_points_2.End, Degree=3, Periodic=False, KnotStyle=1)  # -> Curve, Length, Domain
arc_3pt_2 = Arc3Pt(PointA=move_11.Geometry, PointB=end_points_2.Start, PointC=end_points_2.End)  # -> Arc, Plane, Radius
pipe_3 = Pipe(Curve=[arc_3pt_2.Arc, interpolate.Curve], Radius=Slider(0.38, range=0..1), Caps=0)

merge_4 = Merge(Data1=geometry_3, Data2=loft_3, Data3=geometry_4)

point_5 = Point(flatten(end_points_2.End))
random_reduce_2 = RandomReduce(List=point_5, Reduction=Slider(32, range=0..100), Seed=1)
explode_7 = Explode(Curve=curve, Recursive=True)  # -> Segments, Vertices
number_slider_19 = Slider(429, range=0..1000)
area_5 = Area(Geometry=curve)  # -> Area, Centroid
construct_plane_2 = ConstructPlane(Origin=random_reduce_2, XAxis=Vector(1, 0, 0), YAxis=Vector(0, 1, 0))
list_length_4 = ListLength(List=construct_plane_2)
construct_domain_11 = ConstructDomain(DomainStart=Slider(0.5, range=0.5..2), DomainEnd=Slider(2, range=0.5..2))
xz_plane_2 = XZPlane(Origin=construct_plane_2)
range_7 = Range(Domain=construct_domain_11, Steps=expr("x-1", list_length_4))
construct_domain_12 = ConstructDomain(DomainStart=0, DomainEnd=Slider(2, range=0..2))
construct_domain_13 = ConstructDomain(DomainStart=0, DomainEnd=Slider(0.18, range=0..2))
scale_7 = Scale(Geometry=curve, Center=area_5.Centroid, Factor=range_7)  # -> Geometry, Transform
range_8 = Range(Domain=construct_domain_12, Steps=expr("x-1", list_length_4))
range_9 = Range(Domain=construct_domain_13, Steps=expr("x-1", list_length_4))
pi_4 = Pi(Factor=range_8)
pi_5 = Pi(Factor=range_9)
construct_domain_14 = ConstructDomain(DomainStart=Slider(15.588, range=0..100), DomainEnd=1)
rotate_3d_2 = Rotate3D(Geometry=scale_7.Geometry, Angle=pi_4, Center=explode_7.Vertices, Axis=Vector(0, 0, 1))  # -> graft(Geometry), Transform
area_6 = Area(Geometry=rotate_3d_2.Geometry)  # -> Area, Centroid
range_10 = Range(Domain=construct_domain_14, Steps=expr("x-1", list_length_4))  # -> graft(Range)
scale_8 = Scale(Center=Point(0, 0, 0), Factor=0.5)  # -> Geometry, Transform
scale_nu_3 = ScaleNU(
    Geometry=rotate_3d_2.Geometry,
    Plane=area_6.Centroid,
    ScaleX=Slider(0.8, range=0..1),
    ScaleY=Slider(0.68, range=0..1),
    ScaleZ=1)  # -> Geometry, Transform
unit_z_10 = UnitZ(Factor=range_10)
negative_10 = Negative(Value=unit_z_10)
move_12 = Move(Geometry=scale_nu_3.Geometry, Motion=negative_10)  # -> Geometry, Transform
loft_4 = Loft(
    Curves=[rotate_3d_2.Geometry, move_12.Geometry],
    Options={Adjust=False, Closed=False, LoftEnds=0, LoftSimp=0, LoftType=0, Rebuild=10, Refit=0.01})  # -> flatten(Loft)
cap_holes_2 = CapHoles(Brep=loft_4)
jitter_2 = Jitter(List=cap_holes_2, Jitter=1, Seed=Slider(50, range=0..100))  # -> Values, Indices
orient_2 = Orient(Geometry=jitter_2.Values, Source=PlaneXY(0, 0, 0), Target=construct_plane_2)  # -> Geometry, Transform
rotate_3 = Rotate(Geometry=orient_2.Geometry, Angle=pi_5, Plane=xz_plane_2)  # -> Geometry, Transform
