# Grasshopper definition WorldOfDuchameAkaWalls002.gh (Grasshopper 1.0.7)
# Copyright: Wickerson Studios
# plug-ins: Bifocals

# Wickerson Studio
# created by: Michael Wickerson
# Grasshopper for Rhino 3D Algorithmic Modeling
# www.wickersonstudios.com
# www.michaelwickerson.com
# https://www.youtube.com/channel/UC7J48Ppcsa6oncp6d29R0xw
# https://github.com/mwickerson
# https://www.facebook.com/michael.wickerson
# https://www.linkedin.com/in/michael-wickerson-696a80156/
image_sampler = ImageSampler(
    FilePath="C:\Users\Sculpture\Documents\2020Grasshopper\ScreenShots2019\Screenshots2020\SurfaceEditAlgorithm.PNG",
    Filter="Value",
    Interpolate=False,
    Umax=1,
    Umin=0,
    Vmax=1,
    Vmin=0,
    Wrap=1)

# ----
# Place: Aka
# Location 24-75
# Flag:
# Good/Ill: IG
# Race/Class: any
# Leader: none
# Class/Rank: rebel/bandit/monster
number_slider = Slider(3, range=3..24)
number_slider_2 = Slider(3, range=0..10)
plane = Plane(PlaneXY(0, 0, 0))
construct_domain = ConstructDomain(DomainStart=number_slider, DomainEnd=Slider(5, range=3..12))
construct_domain_2 = ConstructDomain(DomainStart=Slider(7.43, range=3..24), DomainEnd=Slider(33.14, range=3..44))
expression = Expression(x=number_slider_2, Expression="x-1")
polygon = Polygon(Plane=plane, Radius=Slider(20, range=0..100), Segments=Slider(8, range=0..10), FilletRadius=0)  # -> Polygon, Length
range = Range(Domain=construct_domain, Steps=expression)
range_2 = Range(Domain=construct_domain_2, Steps=expression)
divide_curve = DivideCurve(Curve=polygon.Polygon, Count=number_slider_2, Kinks=False)  # -> Points, Tangents, Parameters
polygon_2 = Polygon(Plane=plane, Radius=range_2, Segments=range, FilletRadius=0)  # -> Polygon, Length
jitter = Jitter(List=divide_curve.Points, Jitter=1, Seed=2)  # -> Values, Indices
orient = Orient(Geometry=polygon_2.Polygon, Source=PlaneXY(0, 0, 0), Target=jitter.Values)  # -> Geometry, Transform
curve = Curve(polygon.Polygon)
curve_2 = Curve(orient.Geometry)
trim_with_regions = TrimWithRegions(Curve=curve_2, Regions=curve)  # -> Inside, Outside
curve_3 = Curve(trim_with_regions.Outside)
construct_point = ConstructPoint(XCoordinate=0, YCoordinate=0, ZCoordinate=0)
explode = Explode(Curve=curve_3, Recursive=True)  # -> graft(Segments), Vertices
vector_2pt = Vector2Pt(PointA=explode.Vertices, PointB=construct_point, Unitize=False)  # -> Vector, Length
amplitude = Amplitude(Vector=vector_2pt.Vector, Amplitude=Slider(6.78, range=0..100))
move = Move(Geometry=graft(explode.Segments), Motion=amplitude)  # -> Geometry, Transform
construct_domain_3 = ConstructDomain(DomainStart=Slider(12, range=0..100), DomainEnd=Slider(23.2, range=0..100))
list_length = ListLength(List=move.Geometry)
range_3 = Range(Domain=construct_domain_3, Steps=expr("x-1", list_length))  # -> graft(Range)
loft = Loft(
    Curves=[explode.Segments, move.Geometry],
    Options={Adjust=False, Closed=False, LoftEnds=0, LoftSimp=0, LoftType=0, Rebuild=10, Refit=0.01})
unit_z = UnitZ(Factor=range_3)
extrude = Extrude(Base=loft, Direction=unit_z)

number_slider_3 = Slider(12, range=0..100)  # disabled
construct_domain_4 = ConstructDomain(DomainStart=0, DomainEnd=expr("x/2", number_slider_3))  # disabled
construct_domain_5 = ConstructDomain(DomainStart=0, DomainEnd=number_slider_3)  # disabled
rectangle = Rectangle(Plane=PlaneXY(0, 0, 0), XSize=construct_domain_5, YSize=construct_domain_4, Radius=0)  # -> Rectangle, Length; disabled
area = Area(Geometry=rectangle.Rectangle)  # -> Area, Centroid; disabled
deconstruct_brep = DeconstructBrep(Brep=rectangle.Rectangle)  # -> Faces, Edges, Vertices; disabled
list_item = ListItem(List=deconstruct_brep.Vertices, Index=0, Wrap=True)  # -> Item, Item1, Item2, Item3; disabled
panel = Panel(deconstruct_brep.Vertices)  # disabled
line = Line(StartPoint=area.Centroid, EndPoint=[list_item.Item, list_item.Item1, list_item.Item3])  # disabled
number_slider_4 = Slider(0.302, range=0..1)  # disabled
merge = Merge(Data1=line, Data2=rectangle.Rectangle)  # disabled
pipe = Pipe(Curve=merge, Radius=number_slider_4, Caps=0)  # disabled

number_slider_5 = Slider(-10, range=-10..10)
md_slider = MDSlider(
    SliderMode=0,
    slider_value=Point(0.1483628808, 0.7956557855, 0.5),
    x_domain=Domain(0, 1),
    y_domain=Domain(0, 1),
    z_domain=Domain(0, 1))
md_slider_2 = MDSlider(
    SliderMode=0,
    slider_value=Point(0.9403286445, 0.2734226134, 0.5),
    x_domain=Domain(0, 1),
    y_domain=Domain(0, 1),
    z_domain=Domain(0, 1))
md_slider_3 = MDSlider(
    SliderMode=0,
    slider_value=Point(0, 0.02408506812, 0.5),
    x_domain=Domain(0, 1),
    y_domain=Domain(0, 1),
    z_domain=Domain(0, 1))

number_slider_6 = Slider(50, range=0..50)
surface = Surface(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)
dimensions = Dimensions(Surface=surface)  # -> UDimension, VDimension
division = Division(A=dimensions.UDimension, B=dimensions.VDimension)
multiplication = Multiplication(A=division, B=number_slider_6)

area_2 = Area(Geometry=surface)  # -> Area, Centroid
integer = Integer(multiplication)
scale = Scale(Geometry=surface, Center=area_2.Centroid, Factor=Slider(2.12, range=0..5))  # -> Geometry, Transform
expression_2 = Expression(x=integer, Expression="x+1")
evaluate_surface = EvaluateSurface(Surface=reparameterize(scale.Geometry), Point=[md_slider, md_slider_3, md_slider_2])  # -> Point, Normal, UDirection, VDirection, Frame

divide_surface = DivideSurface(Surface=surface, UCount=integer, VCount=number_slider_6)  # -> flatten(Points), Normals, Parameters

distance = Distance(PointA=graft(evaluate_surface.Point), PointB=divide_surface.Points)
expression_3 = Expression(
    w=graft([Slider(1.363, range=0..2), Slider(0.051, range=0..2), Slider(0.11, range=0..2)]),
    t=distance,
    Expression="sin(w*t)^2")
multiplication_2 = Multiplication(A=Slider(3.62, range=0..20), B=expression_3)
unit_z_2 = UnitZ(Factor=multiplication_2)
move_2 = Move(Geometry=divide_surface.Points, Motion=unit_z_2)  # -> Geometry, Transform
surface_from_points = SurfaceFromPoints(Points=move_2.Geometry, UCount=expression_2, Interpolate=False)

flip_matrix = FlipMatrix(Data=expression_3)
mass_multiplication = MassMultiplication(Input=flip_matrix)  # -> flatten(Result), PartialResults
mass_addition = MassAddition(Input=flip_matrix)  # -> flatten(Result), PartialResults
