# Grasshopper definition WorldOfDuchameAngif002.gh (Grasshopper 1.0.7)
# Copyright: Wickerson Studios
# plug-ins: Bifocals

# Wickerson Studio
# created by: Michael Wickerson
# Grasshopper for Rhino 3D Algorithmic Modeling
# www.wickersonstudios.com
# www.michaelwickerson.com
# https://www.youtube.com/channel/UC7J48Ppcsa6oncp6d29R0xw
# https://github.com/mwickerson
# https://www.facebook.com/michael.wickerson
# https://www.linkedin.com/in/michael-wickerson-696a80156/
image_sampler = ImageSampler(
    FilePath="C:\Users\Sculpture\Documents\2020Grasshopper\ScreenShots2019\Screenshots2020\SurfaceEditAlgorithm.PNG",
    Filter="Value",
    Interpolate=False,
    Umax=1,
    Umin=0,
    Vmax=1,
    Vmin=0,
    Wrap=1)

number_slider = Slider(627, range=0..1000)
number_slider_2 = Slider(1709, range=0..6000)
number_slider_3 = Slider(474, range=0..1000)
number_slider_4 = Slider(22, range=0..100)
construct_point = ConstructPoint(XCoordinate=0, YCoordinate=0, ZCoordinate=0)
unit_z = UnitZ(Factor=1)
pi = Pi(Factor=Slider(1.31, range=0..10))
subtraction = Subtraction(A=number_slider_2, B=number_slider_3)
line_sdl = LineSDL(Start=construct_point, Direction=unit_z, Length=number_slider_2)
division = Division(A=pi, B=number_slider_4)
expression = Expression(x=number_slider_4, Expression="x+1")
division_2 = Division(A=subtraction, B=number_slider_4)
range = Range(Domain=pi, Steps=number_slider_4)
multiplication = Multiplication(A=division, B=Slider(1, range=0..2))
series = Series(Start=0, Step=division_2, Count=expression)
addition = Addition(A=number_slider, B=Slider(618, range=0..1000))
addition_2 = Addition(A=range, B=multiplication)
construct_domain = ConstructDomain(DomainStart=range, DomainEnd=addition_2)
construct_point_2 = ConstructPoint(XCoordinate=0, YCoordinate=0, ZCoordinate=series)
arc = Arc(Plane=construct_point_2, Radius=graft([number_slider, addition]), Angle=construct_domain)  # -> Arc, Length
flip_matrix = FlipMatrix(Data=arc.Arc)
unit_z_2 = UnitZ(Factor=number_slider_3)
loft = Loft(Curves=flip_matrix, Options={Adjust=False, Closed=False, LoftEnds=0, LoftSimp=0, LoftType=0, Rebuild=10, Refit=0.01})
extrude = Extrude(Base=loft, Direction=unit_z_2)
pipe = Pipe(Curve=line_sdl, Radius=number_slider, Caps=1)
construct_point_3 = ConstructPoint(XCoordinate=0, YCoordinate=0, ZCoordinate=0)
scale = Scale(Geometry=[extrude, pipe], Center=Point(0, 0, 0), Factor=Slider(0.012, range=0..0.1))  # -> Geometry, Transform
mirror = Mirror(Geometry=scale.Geometry, Plane=construct_point_3)  # -> Geometry, Transform

number_slider_5 = Slider(17, range=0..100)
construct_domain_2 = ConstructDomain(DomainStart=0, DomainEnd=Slider(322, range=0..1000))
number_slider_6 = Slider(56, range=0..100)
range_2 = Range(Domain=construct_domain_2, Steps=number_slider_5)
multiplication_2 = Multiplication(A=number_slider_6, B=Slider(1, range=0..1))
sine = Sine(Value=range_2)
construct_domain_3 = ConstructDomain(DomainStart=0, DomainEnd=multiplication_2)
multiplication_3 = Multiplication(A=sine, B=number_slider_6)
range_3 = Range(Domain=construct_domain_3, Steps=number_slider_5)
negative = Negative(Value=range_3)
construct_point_4 = ConstructPoint(XCoordinate=range_2, YCoordinate=multiplication_3, ZCoordinate=negative)
interpolate = Interpolate(Vertices=construct_point_4, Degree=3, Periodic=False, KnotStyle=1)  # -> Curve, Length, Domain

number_slider_7 = Slider(2, range=0..10)  # disabled
number_slider_8 = Slider(400, range=0..1000)  # disabled
number_slider_9 = Slider(101, range=0..1000)  # disabled
number_slider_10 = Slider(24, range=0..100)  # disabled
number_slider_11 = Slider(466, range=0..1000)  # disabled
number_slider_12 = Slider(2400, range=0..6000)  # disabled
number_slider_13 = Slider(1, range=0..2)  # disabled
construct_point_5 = ConstructPoint(XCoordinate=0, YCoordinate=0, ZCoordinate=0)  # disabled
unit_z_3 = UnitZ(Factor=1)  # disabled
pi_2 = Pi(Factor=number_slider_7)  # disabled
subtraction_2 = Subtraction(A=number_slider_12, B=number_slider_9)  # disabled
line_sdl_2 = LineSDL(Start=construct_point_5, Direction=unit_z_3, Length=number_slider_12)  # disabled
division_3 = Division(A=pi_2, B=number_slider_10)  # disabled
expression_2 = Expression(x=number_slider_10, Expression="x+1")  # disabled
division_4 = Division(A=subtraction_2, B=number_slider_10)  # disabled
range_4 = Range(Domain=pi_2, Steps=number_slider_10)  # disabled
multiplication_4 = Multiplication(A=division_3, B=number_slider_13)  # disabled
series_2 = Series(Start=0, Step=division_4, Count=expression_2)  # disabled
addition_3 = Addition(A=number_slider_8, B=number_slider_11)  # disabled
addition_4 = Addition(A=range_4, B=multiplication_4)  # disabled
construct_domain_4 = ConstructDomain(DomainStart=range_4, DomainEnd=addition_4)  # disabled
construct_point_6 = ConstructPoint(XCoordinate=0, YCoordinate=0, ZCoordinate=series_2)  # disabled
arc_2 = Arc(Plane=construct_point_6, Radius=graft([number_slider_8, addition_3]), Angle=construct_domain_4)  # -> Arc, Length; disabled
flip_matrix_2 = FlipMatrix(Data=arc_2.Arc)  # disabled
unit_z_4 = UnitZ(Factor=number_slider_9)  # disabled
loft_2 = Loft(Curves=flip_matrix_2, Options={Adjust=False, Closed=False, LoftEnds=0, LoftSimp=0, LoftType=0, Rebuild=10, Refit=0.01})  # disabled
extrude_2 = Extrude(Base=loft_2, Direction=unit_z_4)  # disabled
pipe_2 = Pipe(Curve=line_sdl_2, Radius=number_slider_8, Caps=1)  # disabled

# ----
# Place: Angif
# Location 51-71
# Flag:
# Good/Ill: I
# Race/Class: Troll
# Leader: KorduzSiack
# Class/Rank:
number_slider_14 = Slider(134, range=0..1000)  # disabled
number_slider_15 = Slider(6, range=0..100)  # disabled
construct_domain_5 = ConstructDomain(DomainStart=0, DomainEnd=number_slider_14)  # disabled
number_slider_16 = Slider(0.408, range=0..1)  # disabled
number_slider_17 = Slider(56, range=0..100)  # disabled
range_5 = Range(Domain=construct_domain_5, Steps=number_slider_15)  # disabled
multiplication_5 = Multiplication(A=number_slider_17, B=number_slider_16)  # disabled
sine_2 = Sine(Value=range_5)  # disabled
construct_domain_6 = ConstructDomain(DomainStart=0, DomainEnd=multiplication_5)  # disabled
multiplication_6 = Multiplication(A=sine_2, B=number_slider_17)  # disabled
range_6 = Range(Domain=construct_domain_6, Steps=number_slider_15)  # disabled
negative_2 = Negative(Value=range_6)  # disabled
construct_point_7 = ConstructPoint(XCoordinate=range_5, YCoordinate=multiplication_6, ZCoordinate=negative_2)  # disabled
interpolate_2 = Interpolate(Vertices=construct_point_7, Degree=3, Periodic=False, KnotStyle=1)  # -> Curve, Length, Domain; disabled
number_slider_18 = Slider(0.012, range=0..0.1)  # disabled
end_points = EndPoints(Curve=interpolate_2.Curve)  # -> Start, End; disabled
construct_point_8 = ConstructPoint(XCoordinate=0, YCoordinate=0, ZCoordinate=0)  # disabled
scale_2 = Scale(Geometry=[extrude_2, pipe_2], Center=Point(0, 0, 0), Factor=number_slider_18)  # -> Geometry, Transform; disabled
mirror_2 = Mirror(Geometry=scale_2.Geometry, Plane=construct_point_8)  # -> Geometry, Transform; disabled

number_slider_19 = Slider(12, range=0..100)  # disabled
construct_domain_7 = ConstructDomain(DomainStart=0, DomainEnd=expr("x/2", number_slider_19))  # disabled
construct_domain_8 = ConstructDomain(DomainStart=0, DomainEnd=number_slider_19)  # disabled
rectangle = Rectangle(Plane=PlaneXY(0, 0, 0), XSize=construct_domain_8, YSize=construct_domain_7, Radius=0)  # -> Rectangle, Length; disabled
unit_x = UnitX(Factor=expr("x/2.5", number_slider_19))  # disabled
area = Area(Geometry=rectangle.Rectangle)  # -> Area, Centroid; disabled
negative_3 = Negative(Value=unit_x)  # disabled
move = Move(Geometry=area.Centroid, Motion=[unit_x, negative_3])  # -> Geometry, Transform; disabled
dispatch = Dispatch(List=move.Geometry, DispatchPattern=[True, False])  # -> ListA, ListB; disabled
number_slider_20 = Slider(0.26, range=0..1)  # disabled
negative_4 = Negative(Value=number_slider_19)  # disabled
line = Line(StartPoint=dispatch.ListA, EndPoint=dispatch.ListB)  # disabled
scale_3 = Scale(Geometry=line, Center=area.Centroid, Factor=number_slider_20)  # -> Geometry, Transform; disabled
unit_y = UnitY(Factor=expr("x/7", [negative_4, number_slider_19]))  # disabled
move_2 = Move(Geometry=scale_3.Geometry, Motion=unit_y)  # -> Geometry, Transform; disabled
number_slider_21 = Slider(0.302, range=0..1)  # disabled
merge = Merge(Data1=line, Data2=rectangle.Rectangle, Data3=move_2.Geometry)  # disabled
pipe_3 = Pipe(Curve=merge, Radius=number_slider_21, Caps=2)  # disabled

number_slider_22 = Slider(10, range=0..100)
construct_domain_9 = ConstructDomain(DomainStart=0, DomainEnd=Slider(134, range=0..1000))
number_slider_23 = Slider(53, range=0..100)
range_7 = Range(Domain=construct_domain_9, Steps=number_slider_22)
multiplication_7 = Multiplication(A=number_slider_23, B=Slider(0.531, range=0..1))
sine_3 = Sine(Value=range_7)
construct_domain_10 = ConstructDomain(DomainStart=0, DomainEnd=multiplication_7)
multiplication_8 = Multiplication(A=sine_3, B=number_slider_23)
range_8 = Range(Domain=construct_domain_10, Steps=number_slider_22)
negative_5 = Negative(Value=range_8)
construct_point_9 = ConstructPoint(XCoordinate=range_7, YCoordinate=multiplication_8, ZCoordinate=negative_5)
interpolate_3 = Interpolate(Vertices=construct_point_9, Degree=3, Periodic=False, KnotStyle=1)  # -> Curve, Length, Domain

gene_pool = GenePool(
    Decimals=2,
    Maximum=1,
    Minimum=0,
    Value=[0, 0.1605456128, 0.22, 0.4, 0.44, 0.52, 0.55, 0.59, 0.6, 0.65, 0.67, 0.7, 0.73, 0.75, 0.76, 0.79, 0.89, 0.94, 0.96, 1])
gene_pool_2 = GenePool(
    Decimals=2,
    Maximum=15,
    Minimum=2,
    Value=[4.09, 3.796782631, 4.4, 2.920573501, 4.08, 4.85, 5.11, 4.04, 5, 8.23, 9.5, 10.93, 11.93, 10.75, 8.54, 7.42, 5.62, 3.83, 3.437305256, 4.36])
end_points_2 = EndPoints(Curve=interpolate.Curve)  # -> Start, End
orient = Orient(Geometry=mirror.Geometry, Source=PlaneXY(0, 0, 0), Target=end_points_2.End)  # -> Geometry, Transform
pipe_variable = PipeVariable(Curve=reparameterize(interpolate.Curve), Parameters=gene_pool, Radii=gene_pool_2, Caps=2)
deconstruct_brep = DeconstructBrep(Brep=pipe_variable)  # -> flatten(Faces), Edges, Vertices
merge_2 = Merge(Data1=pipe_variable, Data2=orient.Geometry)
list_item = ListItem(List=deconstruct_brep.Vertices, Index=Slider(2, range=0..1000), Wrap=True)  # -> flatten(Item)
deconstruct_brep_2 = DeconstructBrep(Brep=merge_2)  # -> flatten(Faces), Edges, Vertices
list_item_2 = ListItem(List=deconstruct_brep_2.Faces, Index=Slider(11, range=0..153), Wrap=True)
area_2 = Area(Geometry=list_item_2)  # -> Area, Centroid
point = Point(list_item)
line_2 = Line(StartPoint=point, EndPoint=area_2.Centroid)
vector_2pt = Vector2Pt(PointA=point, PointB=area_2.Centroid, Unitize=False)  # -> Vector, Length

scale_4 = Scale(Geometry=pipe_2, Center=Point(0, 0, 0), Factor=number_slider_18)  # -> Geometry, Transform; disabled

number_slider_24 = Slider(5, range=0..100)
construct_domain_11 = ConstructDomain(DomainStart=0, DomainEnd=Slider(97, range=0..1000))
number_slider_25 = Slider(100, range=0..100)
range_9 = Range(Domain=construct_domain_11, Steps=number_slider_24)
multiplication_9 = Multiplication(A=number_slider_25, B=Slider(0.311, range=0..1))
sine_4 = Sine(Value=range_9)
construct_domain_12 = ConstructDomain(DomainStart=0, DomainEnd=multiplication_9)
multiplication_10 = Multiplication(A=sine_4, B=number_slider_25)
negative_6 = Negative(Value=range_9)
range_10 = Range(Domain=construct_domain_12, Steps=number_slider_24)
negative_7 = Negative(Value=range_10)
construct_point_10 = ConstructPoint(XCoordinate=negative_6, YCoordinate=multiplication_10, ZCoordinate=negative_7)
interpolate_4 = Interpolate(Vertices=construct_point_10, Degree=3, Periodic=False, KnotStyle=1)  # -> Curve, Length, Domain

deconstruct_brep_3 = DeconstructBrep(Brep=scale_4.Geometry)  # -> Faces, Edges, Vertices; disabled
number_slider_26 = Slider(1, range=0..1)  # disabled
gene_pool_3 = GenePool(
    Decimals=2,
    Maximum=15,
    Minimum=2,
    Value=[8.803889681, 6.764848562, 3.943408044, 4.714148706, 4.451029396, 14.81653893, 5.203087254, 12.9290972, 4.318521836, 7.547862922, 4.668769789, 7.097684573, 5.093962934, 7.950816436, 3.372740129, 2.145923626, 7.561911431, 7.166888758, 12.72139649, 12.19328341])  # disabled
list_item_3 = ListItem(List=deconstruct_brep_3.Vertices, Index=number_slider_26, Wrap=True)  # disabled
gene_pool_4 = GenePool(
    Decimals=2,
    Maximum=1,
    Minimum=0,
    Value=[0, 0.1605456128, 0.22, 0.4, 0.44, 0.52, 0.55, 0.59, 0.6, 0.65, 0.67, 0.7, 0.73, 0.75, 0.76, 0.79, 0.89, 0.94, 0.96, 1])  # disabled
pipe_variable_2 = PipeVariable(Curve=reparameterize(interpolate_2.Curve), Parameters=gene_pool_4, Radii=gene_pool_3, Caps=2)  # disabled
orient_2 = Orient(Geometry=mirror_2.Geometry, Source=PlaneXY(0, 0, 0), Target=end_points.End)  # -> Geometry, Transform; disabled
mirror_3 = Mirror(Geometry=list_item_3, Plane=construct_point_8)  # -> Geometry, Transform; disabled
number_slider_27 = Slider(1.28, range=0..2)  # disabled
merge_3 = Merge(Data1=pipe_variable_2, Data2=orient_2.Geometry)  # disabled
orient_3 = Orient(Geometry=merge_3, Source=PlaneXY(0, 0, 0), Target=mirror_3.Geometry)  # -> Geometry, Transform; disabled
pi_3 = Pi(Factor=number_slider_27)  # disabled
rotate_3d = Rotate3D(Geometry=orient_3.Geometry, Angle=pi_3, Center=mirror_3.Geometry, Axis=Vector(0, 0, 1))  # -> Geometry, Transform; disabled

gene_pool_5 = GenePool(
    Decimals=2,
    Maximum=1,
    Minimum=0,
    Value=[0, 0.1605456128, 0.22, 0.4, 0.44, 0.52, 0.55, 0.59, 0.6, 0.65, 0.67, 0.7, 0.73, 0.75, 0.76, 0.79, 0.89, 0.94, 0.96, 1])
gene_pool_6 = GenePool(
    Decimals=2,
    Maximum=15,
    Minimum=2,
    Value=[4.01, 4.256183283, 4.81, 4.02, 3.86, 3.922190727, 5.21037455, 8.15, 8.68, 9.3, 9.45, 7.51, 5.5, 3.8, 3.44, 3.82, 3.4, 5.41, 6.3, 8.53])
end_points_3 = EndPoints(Curve=interpolate_3.Curve)  # -> Start, End
pipe_variable_3 = PipeVariable(Curve=reparameterize(interpolate_3.Curve), Parameters=gene_pool_5, Radii=gene_pool_6, Caps=2)
orient_4 = Orient(Geometry=mirror.Geometry, Source=PlaneXY(0, 0, 0), Target=end_points_3.End)  # -> Geometry, Transform
deconstruct_brep_4 = DeconstructBrep(Brep=orient_4.Geometry)  # -> flatten(Faces), Edges, Vertices
deconstruct_brep_5 = DeconstructBrep(Brep=pipe_variable_3)  # -> flatten(Faces), Edges, Vertices
merge_4 = Merge(Data1=pipe_variable_3, Data2=orient_4.Geometry)
list_item_4 = ListItem(List=deconstruct_brep_5.Vertices, Index=Slider(2, range=0..1000), Wrap=True)  # -> flatten(Item)
list_item_5 = ListItem(List=deconstruct_brep_4.Faces, Index=Slider(8, range=0..153), Wrap=True)
move_3 = Move(Geometry=merge_4, Motion=vector_2pt.Vector)  # -> Geometry, Transform
area_3 = Area(Geometry=list_item_5)  # -> Area, Centroid
deconstruct_brep_6 = DeconstructBrep(Brep=pipe_variable_3)  # -> flatten(Faces), Edges, Vertices
point_2 = Point(list_item_4)
line_3 = Line(StartPoint=point_2, EndPoint=area_3.Centroid)
vector_2pt_2 = Vector2Pt(PointA=point_2, PointB=area_3.Centroid, Unitize=False)  # -> Vector, Length
pi_4 = Pi(Factor=Slider(1.22, range=0..2))
point_3 = Point(area_2.Centroid)
rotate_3d_2 = Rotate3D(Geometry=move_3.Geometry, Angle=pi_4, Center=point_3, Axis=Vector(0, 0, 1))  # -> Geometry, Transform
deconstruct_brep_7 = DeconstructBrep(Brep=rotate_3d_2.Geometry)  # -> flatten(Faces), Edges, Vertices
list_item_6 = ListItem(List=deconstruct_brep_7.Faces, Index=Slider(11, range=0..153), Wrap=True)
area_4 = Area(Geometry=list_item_6)  # -> Area, Centroid
point_4 = Point(list_item)
line_4 = Line(StartPoint=point_4, EndPoint=area_4.Centroid)
vector_2pt_3 = Vector2Pt(PointA=point_4, PointB=area_4.Centroid, Unitize=False)  # -> Vector, Length

number_slider_28 = Slider(4, range=0..100)
construct_domain_13 = ConstructDomain(DomainStart=0, DomainEnd=Slider(134, range=0..1000))
number_slider_29 = Slider(32, range=0..100)
range_11 = Range(Domain=construct_domain_13, Steps=number_slider_28)
multiplication_11 = Multiplication(A=number_slider_29, B=Slider(0.35, range=0..1))
sine_5 = Sine(Value=range_11)
construct_domain_14 = ConstructDomain(DomainStart=0, DomainEnd=multiplication_11)
multiplication_12 = Multiplication(A=sine_5, B=number_slider_29)
negative_8 = Negative(Value=multiplication_12)
range_12 = Range(Domain=construct_domain_14, Steps=number_slider_28)
negative_9 = Negative(Value=range_12)
construct_point_11 = ConstructPoint(XCoordinate=range_11, YCoordinate=negative_8, ZCoordinate=negative_9)
interpolate_5 = Interpolate(Vertices=construct_point_11, Degree=3, Periodic=False, KnotStyle=1)  # -> Curve, Length, Domain

gene_pool_7 = GenePool(
    Decimals=2,
    Maximum=1,
    Minimum=0,
    Value=[0, 0.1605456128, 0.22, 0.37, 0.41, 0.52, 0.55, 0.59, 0.6, 0.65, 0.67, 0.7, 0.73, 0.75, 0.76, 0.79, 0.86, 0.88, 0.91, 1])
gene_pool_8 = GenePool(
    Decimals=2,
    Maximum=15,
    Minimum=2,
    Value=[3.930042522, 3.856968405, 4.681773391, 6.439035111, 7.723296507, 11.28840749, 11.72541085, 9.752275473, 10.32264664, 7.352919841, 4.339643241, 4.742654314, 2.900309796, 3.98, 3.597182471, 4.501789268, 4.5, 4.308874185, 4.53194203, 3.31])
end_points_4 = EndPoints(Curve=interpolate_4.Curve)  # -> Start, End
orient_5 = Orient(Geometry=mirror.Geometry, Source=PlaneXY(0, 0, 0), Target=end_points_4.End)  # -> Geometry, Transform
pipe_variable_4 = PipeVariable(Curve=reparameterize(interpolate_4.Curve), Parameters=gene_pool_7, Radii=gene_pool_8, Caps=2)
deconstruct_brep_8 = DeconstructBrep(Brep=orient_5.Geometry)  # -> flatten(Faces), Edges, Vertices
deconstruct_brep_9 = DeconstructBrep(Brep=pipe_variable_4)  # -> flatten(Faces), Edges, Vertices
merge_5 = Merge(Data1=pipe_variable_4, Data2=orient_5.Geometry)
move_4 = Move(Geometry=merge_5, Motion=vector_2pt_3.Vector)  # -> Geometry, Transform
list_item_7 = ListItem(List=deconstruct_brep_9.Vertices, Index=Slider(2, range=0..1000), Wrap=True)  # -> flatten(Item)
list_item_8 = ListItem(List=deconstruct_brep_8.Faces, Index=Slider(8, range=0..153), Wrap=True)
area_5 = Area(Geometry=list_item_8)  # -> Area, Centroid
deconstruct_brep_10 = DeconstructBrep(Brep=pipe_variable_4)  # -> flatten(Faces), Edges, Vertices
point_5 = Point(list_item_7)
line_5 = Line(StartPoint=point_5, EndPoint=area_5.Centroid)
vector_2pt_4 = Vector2Pt(PointA=point_5, PointB=area_5.Centroid, Unitize=False)  # -> Vector, Length
pi_5 = Pi(Factor=Slider(1.08, range=0..2))
point_6 = Point(area_4.Centroid)
rotate_3d_3 = Rotate3D(Geometry=move_4.Geometry, Angle=pi_5, Center=point_6, Axis=Vector(0, 0, 1))  # -> Geometry, Transform
deconstruct_brep_11 = DeconstructBrep(Brep=rotate_3d_3.Geometry)  # -> flatten(Faces), Edges, Vertices
list_item_9 = ListItem(List=deconstruct_brep_11.Faces, Index=Slider(11, range=0..153), Wrap=True)
area_6 = Area(Geometry=list_item_9)  # -> Area, Centroid
point_7 = Point(list_item)
line_6 = Line(StartPoint=point_7, EndPoint=area_6.Centroid)
vector_2pt_5 = Vector2Pt(PointA=point_7, PointB=area_6.Centroid, Unitize=False)  # -> Vector, Length

number_slider_30 = Slider(-10, range=-10..10)
md_slider = MDSlider(
    SliderMode=0,
    slider_value=Point(0.5997777799, 0.4423753692, 0.5),
    x_domain=Domain(0, 1),
    y_domain=Domain(0, 1),
    z_domain=Domain(0, 1))
md_slider_2 = MDSlider(
    SliderMode=0,
    slider_value=Point(0.9403286445, 0.2734226134, 0.5),
    x_domain=Domain(0, 1),
    y_domain=Domain(0, 1),
    z_domain=Domain(0, 1))
md_slider_3 = MDSlider(
    SliderMode=0,
    slider_value=Point(0, 0.02408506812, 0.5),
    x_domain=Domain(0, 1),
    y_domain=Domain(0, 1),
    z_domain=Domain(0, 1))
number_slider_31 = Slider(0.11, range=0..2)
number_slider_32 = Slider(1.363, range=0..2)

number_slider_33 = Slider(50, range=0..50)
surface = Surface(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)
dimensions = Dimensions(Surface=surface)  # -> UDimension, VDimension
division_5 = Division(A=dimensions.UDimension, B=dimensions.VDimension)
multiplication_13 = Multiplication(A=division_5, B=number_slider_33)

area_7 = Area(Geometry=surface)  # -> Area, Centroid
integer = Integer(multiplication_13)
scale_5 = Scale(Geometry=surface, Center=area_7.Centroid, Factor=Slider(2.12, range=0..5))  # -> Geometry, Transform
expression_3 = Expression(x=integer, Expression="x+1")
evaluate_surface = EvaluateSurface(Surface=reparameterize(scale_5.Geometry), Point=md_slider)  # -> Point, Normal, UDirection, VDirection, Frame

divide_surface = DivideSurface(Surface=surface, UCount=integer, VCount=number_slider_33)  # -> flatten(Points), Normals, Parameters

distance = Distance(PointA=graft(evaluate_surface.Point), PointB=divide_surface.Points)
expression_4 = Expression(w=graft(Slider(0.051, range=0..2)), t=distance, Expression="sin(w*t)^2")
multiplication_14 = Multiplication(A=Slider(3.62, range=0..20), B=expression_4)
unit_z_5 = UnitZ(Factor=multiplication_14)
move_5 = Move(Geometry=divide_surface.Points, Motion=unit_z_5)  # -> Geometry, Transform
surface_from_points = SurfaceFromPoints(Points=move_5.Geometry, UCount=expression_3, Interpolate=False)

flip_matrix_3 = FlipMatrix(Data=expression_4)
mass_multiplication = MassMultiplication(Input=flip_matrix_3)  # -> flatten(Result), PartialResults
mass_addition = MassAddition(Input=flip_matrix_3)  # -> flatten(Result), PartialResults

scale_6 = Scale(Geometry=surface_from_points, Center=Point(0, 0, 0), Factor=Slider(3.98, range=0..10))  # -> Geometry, Transform
multiplication_15 = Multiplication(B=5)
unit_z_6 = UnitZ(Factor=Slider(294, range=0..1000))
negative_10 = Negative(Value=unit_z_6)

extrude_3 = Extrude(Base=scale_6.Geometry, Direction=negative_10)

gene_pool_9 = GenePool(
    Decimals=2,
    Maximum=15,
    Minimum=2,
    Value=[3.050995434, 3.065559077, 2.331143019, 3.190663352, 5.212165233, 5.22999629, 5.84188321, 7.974631998, 10.17528992, 13.2582672, 14.18202615, 13.95286484, 12.26084883, 9.679826505, 9.077889286, 5.33208281, 2.761938639, 5.050511925, 2.565136196, 4.488159475])
gene_pool_10 = GenePool(
    Decimals=2,
    Maximum=1,
    Minimum=0,
    Value=[0, 0.1605456128, 0.22, 0.4, 0.44, 0.52, 0.55, 0.59, 0.6, 0.65, 0.67, 0.7, 0.73, 0.75, 0.76, 0.79, 0.89, 0.94, 0.96, 1])
end_points_5 = EndPoints(Curve=interpolate_5.Curve)  # -> Start, End
orient_6 = Orient(Geometry=mirror.Geometry, Source=PlaneXY(0, 0, 0), Target=end_points_5.End)  # -> Geometry, Transform
pipe_variable_5 = PipeVariable(Curve=reparameterize(interpolate_5.Curve), Parameters=gene_pool_10, Radii=gene_pool_9, Caps=2)
deconstruct_brep_12 = DeconstructBrep(Brep=orient_6.Geometry)  # -> flatten(Faces), Edges, Vertices
deconstruct_brep_13 = DeconstructBrep(Brep=pipe_variable_5)  # -> flatten(Faces), Edges, Vertices
merge_6 = Merge(Data1=pipe_variable_5, Data2=orient_6.Geometry)
move_6 = Move(Geometry=merge_6, Motion=vector_2pt_5.Vector)  # -> Geometry, Transform
list_item_10 = ListItem(List=deconstruct_brep_13.Vertices, Index=Slider(2, range=0..1000), Wrap=True)  # -> flatten(Item)
list_item_11 = ListItem(List=deconstruct_brep_12.Faces, Index=Slider(8, range=0..153), Wrap=True)
area_8 = Area(Geometry=list_item_11)  # -> Area, Centroid
deconstruct_brep_14 = DeconstructBrep(Brep=pipe_variable_5)  # -> flatten(Faces), Edges, Vertices
point_8 = Point(list_item_10)
line_7 = Line(StartPoint=point_8, EndPoint=area_8.Centroid)
vector_2pt_6 = Vector2Pt(PointA=point_8, PointB=area_8.Centroid, Unitize=False)  # -> Vector, Length
pi_6 = Pi(Factor=Slider(0.62, range=0..2))
point_9 = Point(area_6.Centroid)
point_10 = Point(list_item)

rotate_3d_4 = Rotate3D(Geometry=move_6.Geometry, Angle=pi_6, Center=point_9, Axis=Vector(0, 0, 1))  # -> Geometry, Transform

merge_7 = Merge(Data1=merge_2, Data2=rotate_3d_2.Geometry, Data3=rotate_3d_3.Geometry, Data4=rotate_3d_4.Geometry)

deconstruct_brep_15 = DeconstructBrep(Brep=rotate_3d_4.Geometry)  # -> flatten(Faces), Edges, Vertices
list_item_12 = ListItem(List=deconstruct_brep_15.Faces, Index=Slider(11, range=0..153), Wrap=True)
area_9 = Area(Geometry=list_item_12)  # -> Area, Centroid
line_8 = Line(StartPoint=point_10, EndPoint=area_9.Centroid)
vector_2pt_7 = Vector2Pt(PointA=point_10, PointB=area_9.Centroid, Unitize=False)  # -> Vector, Length
