# Grasshopper definition WorldOfDuchameAnive001Platteau.gh (Grasshopper 1.0.7)
# Copyright: Wickerson Studios
# plug-ins: Bifocals

# Wickerson Studio
# created by: Michael Wickerson
# Grasshopper for Rhino 3D Algorithmic Modeling
# www.wickersonstudios.com
# www.michaelwickerson.com
# https://www.youtube.com/channel/UC7J48Ppcsa6oncp6d29R0xw
# https://github.com/mwickerson
# https://www.facebook.com/michael.wickerson
# https://www.linkedin.com/in/michael-wickerson-696a80156/
image_sampler = ImageSampler(
    FilePath="C:\Users\Sculpture\Documents\2020Grasshopper\ScreenShots2019\Screenshots2020\SurfaceEditAlgorithm.PNG",
    Filter="Value",
    Interpolate=False,
    Umax=1,
    Umin=0,
    Vmax=1,
    Vmin=0,
    Wrap=1)

# ---- group: March6thAniveDuchameCampv_002
number_slider = Slider(242, range=0..300)  # disabled
number_slider_2 = Slider(36, range=0..100)  # disabled
number_slider_3 = Slider(100, range=0..100)  # disabled
number_slider_4 = Slider(300, range=0..300)  # disabled

unit_z = UnitZ(Factor=number_slider_3)  # disabled
circle = Circle(Plane=PlaneXY(0, 0, 0), Radius=number_slider)  # disabled
circle_2 = Circle(Plane=PlaneXY(0, 0, 0), Radius=number_slider_4)  # disabled
move = Move(Geometry=circle, Motion=unit_z)  # -> Geometry, Transform; disabled
area = Area(Geometry=move.Geometry)  # -> Area, Centroid; disabled
divide_curve = DivideCurve(Curve=circle_2, Count=number_slider_2, Kinks=False)  # -> Points, Tangents, Parameters; disabled
divide_curve_2 = DivideCurve(Curve=move.Geometry, Count=number_slider_2, Kinks=False)  # -> Points, Tangents, Parameters; disabled
number_slider_5 = Slider(0, range=0..1)  # disabled
number_slider_6 = Slider(0.011, range=0..0.1)  # disabled
dispatch = Dispatch(List=divide_curve_2.Points, DispatchPattern=[True, False])  # -> ListA, ListB; disabled
series = Series(Start=number_slider_5, Step=number_slider_6, Count=expr("x/2", number_slider_2))  # disabled
number_slider_7 = Slider(25, range=0..100)  # disabled
vector_2pt = Vector2Pt(PointA=dispatch.ListB, PointB=area.Centroid, Unitize=False)  # -> Vector, Length; disabled
vector_2pt_2 = Vector2Pt(PointA=area.Centroid, PointB=dispatch.ListA, Unitize=False)  # -> Vector, Length; disabled
jitter = Jitter(List=series, Jitter=1, Seed=number_slider_7)  # -> Values, Indices; disabled
multiplication = Multiplication(A=vector_2pt_2.Vector, B=jitter.Values)  # disabled
multiplication_2 = Multiplication(A=vector_2pt.Vector, B=jitter.Values)  # disabled
move_2 = Move(Geometry=dispatch.ListA, Motion=multiplication)  # -> Geometry, Transform; disabled
move_3 = Move(Geometry=dispatch.ListB, Motion=multiplication_2)  # -> Geometry, Transform; disabled
weave = Weave(Pattern=[0, 1], Stream0=move_2.Geometry, Stream1=move_3.Geometry, NullGaps=False)  # -> flatten(Weave); disabled
interpolate = Interpolate(Vertices=weave, Degree=3, Periodic=True, KnotStyle=1)  # -> Curve, Length, Domain; disabled
loft = Loft(
    Curves=[interpolate.Curve, circle_2],
    Options={Adjust=False, Closed=False, LoftEnds=0, LoftSimp=0, LoftType=0, Rebuild=10, Refit=0.01})  # disabled
cap_holes = CapHoles(Brep=loft)  # disabled

# ----
# Place: Anive
# Location 54-56
# Flag:
# Good/Ill: I
# Race/Class: Orc
# Leader: Urkyc
# Class/Rank: Chief
number_slider_8 = Slider(12, range=0..100)  # disabled
construct_domain = ConstructDomain(DomainStart=0, DomainEnd=expr("x/2", number_slider_8))  # disabled
construct_domain_2 = ConstructDomain(DomainStart=0, DomainEnd=number_slider_8)  # disabled
rectangle = Rectangle(Plane=PlaneXY(0, 0, 0), XSize=construct_domain_2, YSize=construct_domain, Radius=0)  # -> Rectangle, Length; disabled
unit_x = UnitX(Factor=expr("x/2.5", number_slider_8))  # disabled
area_2 = Area(Geometry=rectangle.Rectangle)  # -> Area, Centroid; disabled
negative = Negative(Value=unit_x)  # disabled
move_4 = Move(Geometry=area_2.Centroid, Motion=[unit_x, negative])  # -> Geometry, Transform; disabled
dispatch_2 = Dispatch(List=move_4.Geometry, DispatchPattern=[True, False])  # -> ListA, ListB; disabled
number_slider_9 = Slider(0.26, range=0..1)  # disabled
negative_2 = Negative(Value=number_slider_8)  # disabled
line = Line(StartPoint=dispatch_2.ListA, EndPoint=dispatch_2.ListB)  # disabled
scale = Scale(Geometry=line, Center=area_2.Centroid, Factor=number_slider_9)  # -> Geometry, Transform; disabled
unit_y = UnitY(Factor=expr("x/7", [negative_2, number_slider_8]))  # disabled
move_5 = Move(Geometry=scale.Geometry, Motion=unit_y)  # -> Geometry, Transform; disabled
number_slider_10 = Slider(0.302, range=0..1)  # disabled
merge = Merge(Data1=line, Data2=rectangle.Rectangle, Data3=move_5.Geometry)  # disabled
pipe = Pipe(Curve=merge, Radius=number_slider_10, Caps=2)  # disabled

number_slider_11 = Slider(77, range=1..101)
unit_z_2 = UnitZ(Factor=Slider(57, range=0..100))
circle_3 = Circle(Plane=PlaneXY(0, 0, 0), Radius=Slider(266, range=0..500))
circle_4 = Circle(Plane=PlaneXY(0, 0, 0), Radius=Slider(300, range=0..500))
area_3 = Area(Geometry=circle_3)  # -> Area, Centroid
divide_curve_3 = DivideCurve(Curve=circle_3, Count=number_slider_11, Kinks=False)  # -> Points, Tangents, Parameters
series_2 = Series(Start=Slider(0, range=0..1), Step=Slider(0.002826, range=0..0.1), Count=expr("x/2", number_slider_11))
dispatch_3 = Dispatch(List=divide_curve_3.Points, DispatchPattern=[True, False])  # -> ListA, ListB
jitter_2 = Jitter(List=series_2, Jitter=1, Seed=Slider(65, range=0..100))  # -> Values, Indices
vector_2pt_3 = Vector2Pt(PointA=area_3.Centroid, PointB=dispatch_3.ListA, Unitize=False)  # -> Vector, Length
vector_2pt_4 = Vector2Pt(PointA=dispatch_3.ListB, PointB=area_3.Centroid, Unitize=False)  # -> Vector, Length
multiplication_3 = Multiplication(A=vector_2pt_4.Vector, B=jitter_2.Values)
multiplication_4 = Multiplication(A=vector_2pt_3.Vector, B=jitter_2.Values)
move_6 = Move(Geometry=dispatch_3.ListA, Motion=multiplication_4)  # -> Geometry, Transform
move_7 = Move(Geometry=dispatch_3.ListB, Motion=multiplication_3)  # -> Geometry, Transform
weave_2 = Weave(Pattern=[0, 1], Stream0=move_6.Geometry, Stream1=move_7.Geometry, NullGaps=False)  # -> flatten(Weave)
interpolate_2 = Interpolate(Vertices=weave_2, Degree=3, Periodic=True, KnotStyle=1)  # -> Curve, Length, Domain

negative_3 = Negative(Value=unit_z_2)

move_8 = Move(Geometry=circle_4, Motion=negative_3)  # -> Geometry, Transform
loft_2 = Loft(
    Curves=[move_8.Geometry, interpolate_2.Curve],
    Options={Adjust=False, Closed=False, LoftEnds=0, LoftSimp=0, LoftType=0, Rebuild=10, Refit=0.01})
cap_holes_2 = CapHoles(Brep=loft_2)

deconstruct_brep = DeconstructBrep(Brep=cap_holes_2)  # -> Faces, Edges, Vertices
number_slider_12 = Slider(9, range=0..100)
rectangle_2 = Rectangle(Plane=PlaneXY(0, 0, 0), XSize=Slider(9, range=0..100), YSize=Slider(30, range=0..100), Radius=0)  # -> Rectangle, Length
rectangle_3 = Rectangle(Plane=PlaneXY(0, 0, 0), XSize=Slider(27, range=0..100), YSize=Slider(66, range=0..100), Radius=0)  # -> Rectangle, Length
list_item = ListItem(List=deconstruct_brep.Faces, Index=Slider(1, range=0..10), Wrap=True)
rectangular_array = RectangularArray(Geometry=rectangle_2.Rectangle, Cell=rectangle_3.Rectangle, XCount=number_slider_12, YCount=number_slider_12)  # -> Geometry, Transform
surface = Surface(reparameterize(list_item))
orient = Orient(Geometry=rectangular_array.Geometry, Source=PlaneXY(0, 0, 0), Target=surface)  # -> Geometry, Transform
area_4 = Area(Geometry=surface)  # -> Area, Centroid
scale_2 = Scale(Geometry=orient.Geometry, Center=area_4.Centroid, Factor=0.5)  # -> Geometry, Transform
unit_z_3 = UnitZ(Factor=Slider(6, range=0..20))
extrude = Extrude(Base=scale_2.Geometry, Direction=unit_z_3)
deconstruct_brep_2 = DeconstructBrep(Brep=extrude)  # -> Faces, Edges, Vertices
number_slider_13 = Slider(4.45, range=0..10)
list_item_2 = ListItem(List=deconstruct_brep_2.Vertices, Index=Slider(2, range=0..10), Wrap=True)
list_item_3 = ListItem(List=deconstruct_brep_2.Vertices, Index=Slider(3, range=0..10), Wrap=True)
list_item_4 = ListItem(List=deconstruct_brep_2.Vertices, Index=Slider(1, range=0..10), Wrap=True)
list_item_5 = ListItem(List=deconstruct_brep_2.Vertices, Index=Slider(4, range=0..10), Wrap=True)
list_item_6 = ListItem(List=deconstruct_brep_2.Vertices, Index=Slider(5, range=0..10), Wrap=True)
list_item_7 = ListItem(List=deconstruct_brep_2.Vertices, Index=Slider(7, range=0..10), Wrap=True)
list_item_8 = ListItem(List=deconstruct_brep_2.Vertices, Index=Slider(8, range=0..10), Wrap=True)
list_item_9 = ListItem(List=deconstruct_brep_2.Vertices, Index=Slider(6, range=0..10), Wrap=True)
unit_y_2 = UnitY(Factor=number_slider_13)
unit_y_3 = UnitY(Factor=number_slider_13)
unit_y_4 = UnitY(Factor=number_slider_13)
unit_y_5 = UnitY(Factor=number_slider_13)
number_slider_14 = Slider(13, range=0..100)
move_9 = Move(Geometry=list_item_9, Motion=expr("-x", unit_y_2))  # -> Geometry, Transform
move_10 = Move(Geometry=list_item_6, Motion=expr("-x", unit_y_4))  # -> Geometry, Transform
move_11 = Move(Geometry=list_item_7, Motion=unit_y_3)  # -> Geometry, Transform
move_12 = Move(Geometry=list_item_8, Motion=unit_y_5)  # -> Geometry, Transform
vector_2pt_5 = Vector2Pt(PointA=move_10.Geometry, PointB=list_item_5, Unitize=False)  # -> Vector, Length
vector_2pt_6 = Vector2Pt(PointA=move_12.Geometry, PointB=list_item_4, Unitize=False)  # -> Vector, Length
vector_2pt_7 = Vector2Pt(PointA=move_9.Geometry, PointB=list_item_3, Unitize=False)  # -> Vector, Length
vector_2pt_8 = Vector2Pt(PointA=move_11.Geometry, PointB=list_item_2, Unitize=False)  # -> Vector, Length
line_sdl = LineSDL(Start=move_11.Geometry, Direction=vector_2pt_8.Vector, Length=number_slider_14)
line_sdl_2 = LineSDL(Start=move_10.Geometry, Direction=vector_2pt_5.Vector, Length=number_slider_14)
line_sdl_3 = LineSDL(Start=move_12.Geometry, Direction=vector_2pt_6.Vector, Length=number_slider_14)
line_sdl_4 = LineSDL(Start=move_9.Geometry, Direction=vector_2pt_7.Vector, Length=number_slider_14)
loft_3 = Loft(
    Curves=[line_sdl_2, line_sdl_4],
    Options={Adjust=False, Closed=False, LoftEnds=0, LoftSimp=0, LoftType=0, Rebuild=10, Refit=0.01})
loft_4 = Loft(
    Curves=[line_sdl_3, line_sdl],
    Options={Adjust=False, Closed=False, LoftEnds=0, LoftSimp=0, LoftType=0, Rebuild=10, Refit=0.01})
unit_z_4 = UnitZ(Factor=1)
extrude_2 = Extrude(Base=[loft_3, loft_4], Direction=unit_z_4)

line_line = LineLine(Line1=line_sdl_2, Line2=line_sdl_3)  # -> flatten(ParamA), ParamB, PointA, PointB
line_2 = Line(StartPoint=list_item_6, EndPoint=list_item_8)
unit_x_2 = UnitX(Factor=Slider(0.7, range=0..2))
point_on_curve = PointOnCurve(line_2, parameter=0.5)
point = Point(line_line.PointA)
construct_domain_3 = ConstructDomain(DomainStart=Slider(15, range=0..100), DomainEnd=Slider(0, range=0..100))
range = Range(Domain=construct_domain_3, Steps=Slider(32, range=0..100))
sine = Sine(Value=range)
cosine = Cosine(Value=range)
xy_plane = XYPlane(Origin=point)
construct_point = ConstructPoint(XCoordinate=range, YCoordinate=sine, ZCoordinate=cosine)
series_3 = Series(Start=0, Step=1, Count=Slider(6, range=0..10))
interpolate_3 = Interpolate(Vertices=construct_point, Degree=3, Periodic=False, KnotStyle=1)  # -> Curve, Length, Domain
deconstruct_plane = DeconstructPlane(Plane=xy_plane)  # -> Origin, XAxis, YAxis, ZAxis
yz_plane = YZPlane(Origin=Point(0, 0, 0))
rotate = Rotate(Geometry=interpolate_3.Curve, Angle=series_3, Plane=yz_plane)  # -> Geometry, Transform
orient_2 = Orient(Geometry=rotate.Geometry, Source=PlaneXY(0, 0, 0), Target=xy_plane)  # -> Geometry, Transform
number_slider_15 = Slider(0.21, range=0..1)
scale_nu = ScaleNU(
    Geometry=orient_2.Geometry,
    Plane=xy_plane,
    ScaleX=Slider(1, range=0..1),
    ScaleY=number_slider_15,
    ScaleZ=number_slider_15)  # -> Geometry, Transform
pi = Pi(Factor=Slider(0.006, range=0..1))
xz_plane = XZPlane(Origin=Point(0, 0, 0))
pi_2 = Pi(Factor=Slider(0.147, range=0..1))
flip_plane = FlipPlane(Plane=xz_plane, ReverseX=False, ReverseY=False, SwapAxes=True)
rotate_2 = Rotate(Geometry=scale_nu.Geometry, Angle=pi, Plane=xy_plane)  # -> Geometry, Transform
rotate_3d = Rotate3D(Geometry=rotate_2.Geometry, Angle=expr("-x", pi_2), Center=deconstruct_plane.Origin, Axis=flip_plane)  # -> Geometry, Transform

negative_4 = Negative(Value=unit_x_2)
geometry = Geometry(cap_holes_2)

move_13 = Move(Geometry=point_on_curve, Motion=negative_4)  # -> Geometry, Transform
vector_2pt_9 = Vector2Pt(PointA=point, PointB=move_13.Geometry, Unitize=False)  # -> Vector, Length
rotate_3d_2 = Rotate3D(Geometry=rotate_3d.Geometry, Angle=expr("-x", pi_2), Center=deconstruct_plane.Origin, Axis=vector_2pt_9.Vector)  # -> Geometry, Transform
pipe_2 = Pipe(Curve=[rotate_3d.Geometry, rotate_3d_2.Geometry], Radius=Slider(0.168, range=0..1), Caps=1)

merge_2 = Merge(Data1=extrude, Data2=extrude_2, Data3=pipe_2)
