# Grasshopper definition WorldOfDuchameAntusoCaves003.gh (Grasshopper 1.0.7)
# Copyright: Wickerson Studios
# plug-ins: Anemone, Bifocals

# Wickerson Studio
# created by: Michael Wickerson
# Grasshopper for Rhino 3D Algorithmic Modeling
# www.wickersonstudios.com
# www.michaelwickerson.com
# https://www.youtube.com/channel/UC7J48Ppcsa6oncp6d29R0xw
# https://github.com/mwickerson
# https://www.facebook.com/michael.wickerson
# https://www.linkedin.com/in/michael-wickerson-696a80156/
image_sampler = ImageSampler(
    FilePath="C:\Users\Sculpture\Documents\2020Grasshopper\ScreenShots2019\Screenshots2020\SurfaceEditAlgorithm.PNG",
    Filter="Value",
    Interpolate=False,
    Umax=1,
    Umin=0,
    Vmax=1,
    Vmin=0,
    Wrap=1)

number_slider = Slider(400, range=0..1000)
number_slider_2 = Slider(101, range=0..1000)
number_slider_3 = Slider(24, range=0..100)
number_slider_4 = Slider(2400, range=0..6000)
construct_point = ConstructPoint(XCoordinate=0, YCoordinate=0, ZCoordinate=0)
unit_z = UnitZ(Factor=1)
pi = Pi(Factor=Slider(2, range=0..10))
subtraction = Subtraction(A=number_slider_4, B=number_slider_2)
line_sdl = LineSDL(Start=construct_point, Direction=unit_z, Length=number_slider_4)
division = Division(A=pi, B=number_slider_3)
expression = Expression(x=number_slider_3, Expression="x+1")
division_2 = Division(A=subtraction, B=number_slider_3)
range = Range(Domain=pi, Steps=number_slider_3)
multiplication = Multiplication(A=division, B=Slider(1, range=0..2))
series = Series(Start=0, Step=division_2, Count=expression)
addition = Addition(A=number_slider, B=Slider(466, range=0..1000))
addition_2 = Addition(A=range, B=multiplication)
construct_domain = ConstructDomain(DomainStart=range, DomainEnd=addition_2)
construct_point_2 = ConstructPoint(XCoordinate=0, YCoordinate=0, ZCoordinate=series)
arc = Arc(Plane=construct_point_2, Radius=graft([number_slider, addition]), Angle=construct_domain)  # -> Arc, Length
flip_matrix = FlipMatrix(Data=arc.Arc)
unit_z_2 = UnitZ(Factor=number_slider_2)
loft = Loft(Curves=flip_matrix, Options={Adjust=False, Closed=False, LoftEnds=0, LoftSimp=0, LoftType=0, Rebuild=10, Refit=0.01})
extrude = Extrude(Base=loft, Direction=unit_z_2)
pipe = Pipe(Curve=line_sdl, Radius=number_slider, Caps=1)

region = Region({Plane=PlaneXY(286.5, 61.5, 0), Size=Domain2(u=-422.5..422.5, v=-100.5..100.5)})
# Anemone Loops with Remote
region_2 = Region({Plane=PlaneXY(82.5, 49, 0), Size=Domain2(u=-320.5..320.5, v=-273..273)})
populate_2d = Populate2D(Region={Plane=PlaneXY(82.5, 49, 0), Size=Domain2(u=-320.5..320.5, v=-273..273)}, Count=Slider(4, range=0..10), Seed=1)
populate_2d_2 = Populate2D(
    Region={Plane=PlaneXY(286.5, 61.5, 0), Size=Domain2(u=-422.5..422.5, v=-100.5..100.5)},
    Count=Slider(3, range=0..10),
    Seed=Slider(61, range=0..1000))
loop_start = LoopStart(Repeat=Slider(234, range=0..1000), Trigger=Toggle(True), Data=populate_2d)  # -> port, Counter, Data
spin_force = SpinForce(Plane=populate_2d_2, Strength=Slider(512, range=0..1100), Radius=Slider(5.439, range=0..10), Decay=2)

# ----
# Place: Antuso
# Location 28-68
# Flag:
# Good/Ill: I
# Race/Class: Bandit/Orc
# Leader: Gursoin/Yurkec
# Class/Rank: Captain/Chief
number_slider_5 = Slider(12, range=0..100)  # disabled
construct_domain_2 = ConstructDomain(DomainStart=0, DomainEnd=expr("x/2", number_slider_5))  # disabled
construct_domain_3 = ConstructDomain(DomainStart=0, DomainEnd=number_slider_5)  # disabled
rectangle = Rectangle(Plane=PlaneXY(0, 0, 0), XSize=construct_domain_3, YSize=construct_domain_2, Radius=0)  # -> Rectangle, Length; disabled
unit_x = UnitX(Factor=expr("x/2.5", number_slider_5))  # disabled
area = Area(Geometry=rectangle.Rectangle)  # -> Area, Centroid; disabled
negative = Negative(Value=unit_x)  # disabled
move = Move(Geometry=area.Centroid, Motion=[unit_x, negative])  # -> Geometry, Transform; disabled
dispatch = Dispatch(List=move.Geometry, DispatchPattern=[True, False])  # -> ListA, ListB; disabled
number_slider_6 = Slider(0.26, range=0..1)  # disabled
negative_2 = Negative(Value=number_slider_5)  # disabled
line = Line(StartPoint=dispatch.ListA, EndPoint=dispatch.ListB)  # disabled
scale = Scale(Geometry=line, Center=area.Centroid, Factor=number_slider_6)  # -> Geometry, Transform; disabled
unit_y = UnitY(Factor=expr("x/7", [negative_2, number_slider_5]))  # disabled
move_2 = Move(Geometry=scale.Geometry, Motion=unit_y)  # -> Geometry, Transform; disabled
number_slider_7 = Slider(0.302, range=0..1)  # disabled
merge = Merge(Data1=line, Data2=rectangle.Rectangle, Data3=move_2.Geometry)  # disabled
pipe_2 = Pipe(Curve=merge, Radius=number_slider_7, Caps=2)  # disabled

merge_fields = MergeFields(Fields=spin_force)
evaluate_field = EvaluateField(Field=merge_fields, Point=loop_start.Data)  # -> Tensor, Strength
amplitude = Amplitude(Vector=evaluate_field.Tensor, Amplitude=Slider(13, range=0..110))
move_3 = Move(Geometry=loop_start.Data, Motion=amplitude)  # -> Geometry, Transform
loop_end = LoopEnd(port=loop_start.port, Exit=False, Data=move_3.Geometry, TimeOutVal=0, pausedState=False, state="Constant & Record")
flip_matrix_2 = FlipMatrix(Data=loop_end)
polyline = PolyLine(Vertices=flip_matrix_2, Closed=False)
msphere = MeshSphere(Base=flip_matrix_2, Radius=10, UCount=10, VCount=20)  # disabled
gene_pool = GenePool(
    Decimals=2,
    Maximum=1,
    Minimum=0,
    Value=[0, 0.07, 0.13, 0.15, 0.19, 0.25, 0.28, 0.34, 0.39, 0.44, 0.46, 0.5, 0.55, 0.59, 0.66, 0.7, 0.77, 0.82, 0.9, 1])
gene_pool_2 = GenePool(
    Decimals=2,
    Maximum=10,
    Minimum=0,
    Value=[0.3108750667, 1.039347644, 0.8616812392, 0.8221351618, 1.081676492, 3.279517689, 3.571988719, 3.173987956, 3.321434142, 4.029909258, 3.617336235, 4.188125042, 5.902866949, 5.533529657, 7.50063081, 7.983449257, 8.111051655, 8.700533225, 8.738852717, 9.527687063])
curve = Curve(polyline)
pipe_variable = PipeVariable(Curve=reparameterize(polyline), Parameters=gene_pool, Radii=gene_pool_2, Caps=0)
scale_2 = Scale(Geometry=flatten([extrude, pipe]), Center=Point(0, 0, 0), Factor=Slider(0.01, range=0..0.01))  # -> Geometry, Transform
end_points = EndPoints(Curve=curve)  # -> Start, flatten(End)
orient = Orient(Geometry=scale_2.Geometry, Source=PlaneXY(0, 0, 0), Target=[end_points.End, end_points.Start])  # -> Geometry, Transform
deconstruct_brep = DeconstructBrep(Brep=orient.Geometry)  # -> Faces, Edges, flatten(Vertices)
list_item = ListItem(List=deconstruct_brep.Vertices, Index=Slider(208, range=0..1000), Wrap=True)
geometry = Geometry(list_item)
construct_plane = ConstructPlane(Origin=geometry, XAxis=Vector(1, 0, 0), YAxis=Vector(0, 1, 0))

number_slider_8 = Slider(400, range=0..1000)
number_slider_9 = Slider(101, range=0..1000)
number_slider_10 = Slider(24, range=0..100)
number_slider_11 = Slider(2400, range=0..6000)
construct_point_3 = ConstructPoint(XCoordinate=0, YCoordinate=0, ZCoordinate=0)
unit_z_3 = UnitZ(Factor=1)
pi_2 = Pi(Factor=Slider(2, range=0..10))
subtraction_2 = Subtraction(A=number_slider_11, B=number_slider_9)
line_sdl_2 = LineSDL(Start=construct_point_3, Direction=unit_z_3, Length=number_slider_11)
division_3 = Division(A=pi_2, B=number_slider_10)
expression_2 = Expression(x=number_slider_10, Expression="x+1")
division_4 = Division(A=subtraction_2, B=number_slider_10)
range_2 = Range(Domain=pi_2, Steps=number_slider_10)
multiplication_2 = Multiplication(A=division_3, B=Slider(1, range=0..2))
series_2 = Series(Start=0, Step=division_4, Count=expression_2)
addition_3 = Addition(A=number_slider_8, B=Slider(466, range=0..1000))
addition_4 = Addition(A=range_2, B=multiplication_2)
construct_domain_4 = ConstructDomain(DomainStart=range_2, DomainEnd=addition_4)
construct_point_4 = ConstructPoint(XCoordinate=0, YCoordinate=0, ZCoordinate=series_2)
arc_2 = Arc(Plane=construct_point_4, Radius=graft([number_slider_8, addition_3]), Angle=construct_domain_4)  # -> Arc, Length
flip_matrix_3 = FlipMatrix(Data=arc_2.Arc)
unit_z_4 = UnitZ(Factor=number_slider_9)
loft_2 = Loft(Curves=flip_matrix_3, Options={Adjust=False, Closed=False, LoftEnds=0, LoftSimp=0, LoftType=0, Rebuild=10, Refit=0.01})
extrude_2 = Extrude(Base=loft_2, Direction=unit_z_4)
pipe_3 = Pipe(Curve=line_sdl_2, Radius=number_slider_8, Caps=1)

# ----
# Anemone Loops with Remote
number_slider_12 = Slider(423, range=0..1000)
number_slider_13 = Slider(677, range=0..1000)
rectangle_2 = Rectangle(Plane=construct_plane, XSize=number_slider_12, YSize=number_slider_12, Radius=0)  # -> Rectangle, Length
rectangle_3 = Rectangle(Plane=construct_plane, XSize=number_slider_13, YSize=number_slider_13, Radius=0)  # -> Rectangle, Length
region_3 = Region(rectangle_3.Rectangle)
region_4 = Region(rectangle_2.Rectangle)
populate_2d_3 = Populate2D(Region=region_3, Count=Slider(3, range=0..10), Seed=1)
populate_2d_4 = Populate2D(Region=region_4, Count=Slider(2, range=0..10), Seed=Slider(252, range=0..1000))
loop_start_2 = LoopStart(Repeat=Slider(180, range=0..1000), Trigger=Toggle(True), Data=populate_2d_3)  # -> port, Counter, Data
spin_force_2 = SpinForce(Plane=populate_2d_4, Strength=Slider(400, range=0..1100), Radius=Slider(6.731, range=0..10), Decay=2)
merge_fields_2 = MergeFields(Fields=spin_force_2)
evaluate_field_2 = EvaluateField(Field=merge_fields_2, Point=loop_start_2.Data)  # -> Tensor, Strength
amplitude_2 = Amplitude(Vector=evaluate_field_2.Tensor, Amplitude=Slider(22, range=0..110))
move_4 = Move(Geometry=loop_start_2.Data, Motion=amplitude_2)  # -> Geometry, Transform
loop_end_2 = LoopEnd(port=loop_start_2.port, Exit=False, Data=move_4.Geometry, TimeOutVal=0, pausedState=False, state="Constant & Record")
flip_matrix_4 = FlipMatrix(Data=loop_end_2)
polyline_2 = PolyLine(Vertices=flip_matrix_4, Closed=False)
msphere_2 = MeshSphere(Base=flip_matrix_4, Radius=10, UCount=10, VCount=20)  # disabled
gene_pool_3 = GenePool(
    Decimals=2,
    Maximum=1,
    Minimum=0,
    Value=[0, 0.07, 0.13, 0.15, 0.19, 0.25, 0.28, 0.34, 0.39, 0.44, 0.46, 0.5, 0.55, 0.59, 0.66, 0.7, 0.77, 0.82, 0.9, 1])
gene_pool_4 = GenePool(
    Decimals=2,
    Maximum=10,
    Minimum=0,
    Value=[0.2102814849, 0.4384182248, 0.5958813388, 0.6483700338, 0.6279050037, 3.842520982, 3.617595176, 2.777337319, 3.323113072, 4.753683278, 3.803352337, 4.413433537, 6.149740232, 6.099835717, 6.624501111, 8.945456672, 8.940140353, 7.709510012, 8.714823088, 9.441662148])
curve_2 = Curve(polyline_2)  # disabled
pipe_variable_2 = PipeVariable(Curve=reparameterize(polyline_2), Parameters=gene_pool_3, Radii=gene_pool_4, Caps=0)  # disabled
scale_3 = Scale(Geometry=flatten([extrude_2, pipe_3]), Center=Point(0, 0, 0), Factor=Slider(0.01, range=0..0.01))  # -> Geometry, Transform; disabled
end_points_2 = EndPoints(Curve=curve_2)  # -> Start, flatten(End); disabled
orient_2 = Orient(Geometry=scale_3.Geometry, Source=PlaneXY(0, 0, 0), Target=[end_points_2.End, end_points_2.Start])  # -> Geometry, Transform
deconstruct_brep_2 = DeconstructBrep(Brep=orient_2.Geometry)  # -> Faces, Edges, flatten(Vertices)
list_item_2 = ListItem(List=deconstruct_brep_2.Vertices, Index=Slider(208, range=0..1000), Wrap=True)
geometry_2 = Geometry(list_item_2)
construct_plane_2 = ConstructPlane(Origin=geometry_2, XAxis=Vector(1, 0, 0), YAxis=Vector(0, 1, 0))
