# Grasshopper definition WorldOfDuchameAntusoCaves004.gh (Grasshopper 1.0.7)
# Copyright: Wickerson Studios
# plug-ins: Anemone, Bifocals

# Wickerson Studio
# created by: Michael Wickerson
# Grasshopper for Rhino 3D Algorithmic Modeling
# www.wickersonstudios.com
# www.michaelwickerson.com
# https://www.youtube.com/channel/UC7J48Ppcsa6oncp6d29R0xw
# https://github.com/mwickerson
# https://www.facebook.com/michael.wickerson
# https://www.linkedin.com/in/michael-wickerson-696a80156/
image_sampler = ImageSampler(
    FilePath="C:\Users\Sculpture\Documents\2020Grasshopper\ScreenShots2019\Screenshots2020\SurfaceEditAlgorithm.PNG",
    Filter="Value",
    Interpolate=False,
    Umax=1,
    Umin=0,
    Vmax=1,
    Vmin=0,
    Wrap=1)

number_slider = Slider(400, range=0..1000)
number_slider_2 = Slider(101, range=0..1000)
number_slider_3 = Slider(24, range=0..100)
number_slider_4 = Slider(2400, range=0..6000)
construct_point = ConstructPoint(XCoordinate=0, YCoordinate=0, ZCoordinate=0)
unit_z = UnitZ(Factor=1)
pi = Pi(Factor=Slider(2, range=0..10))
subtraction = Subtraction(A=number_slider_4, B=number_slider_2)
line_sdl = LineSDL(Start=construct_point, Direction=unit_z, Length=number_slider_4)
division = Division(A=pi, B=number_slider_3)
expression = Expression(x=number_slider_3, Expression="x+1")
division_2 = Division(A=subtraction, B=number_slider_3)
range = Range(Domain=pi, Steps=number_slider_3)
multiplication = Multiplication(A=division, B=Slider(1, range=0..2))
series = Series(Start=0, Step=division_2, Count=expression)
addition = Addition(A=number_slider, B=Slider(466, range=0..1000))
addition_2 = Addition(A=range, B=multiplication)
construct_domain = ConstructDomain(DomainStart=range, DomainEnd=addition_2)
construct_point_2 = ConstructPoint(XCoordinate=0, YCoordinate=0, ZCoordinate=series)
arc = Arc(Plane=construct_point_2, Radius=graft([number_slider, addition]), Angle=construct_domain)  # -> Arc, Length
flip_matrix = FlipMatrix(Data=arc.Arc)
unit_z_2 = UnitZ(Factor=number_slider_2)
loft = Loft(Curves=flip_matrix, Options={Adjust=False, Closed=False, LoftEnds=0, LoftSimp=0, LoftType=0, Rebuild=10, Refit=0.01})
extrude = Extrude(Base=loft, Direction=unit_z_2)
pipe = Pipe(Curve=line_sdl, Radius=number_slider, Caps=1)

region = Region({Plane=PlaneXY(286.5, 61.5, 0), Size=Domain2(u=-422.5..422.5, v=-100.5..100.5)})
# Anemone Loops with Remote
region_2 = Region({Plane=PlaneXY(82.5, 49, 0), Size=Domain2(u=-320.5..320.5, v=-273..273)})
populate_2d = Populate2D(Region={Plane=PlaneXY(82.5, 49, 0), Size=Domain2(u=-320.5..320.5, v=-273..273)}, Count=Slider(4, range=0..10), Seed=1)
populate_2d_2 = Populate2D(
    Region={Plane=PlaneXY(286.5, 61.5, 0), Size=Domain2(u=-422.5..422.5, v=-100.5..100.5)},
    Count=Slider(3, range=0..10),
    Seed=Slider(61, range=0..1000))
loop_start = LoopStart(Repeat=Slider(234, range=0..1000), Trigger=Toggle(True), Data=populate_2d)  # -> port, Counter, Data
spin_force = SpinForce(Plane=populate_2d_2, Strength=Slider(512, range=0..1100), Radius=Slider(5.439, range=0..10), Decay=2)

# ----
# Place: Antuso
# Location 28-68
# Flag:
# Good/Ill: I
# Race/Class: Bandit/Orc
# Leader: Gursoin/Yurkec
# Class/Rank: Captain/Chief
number_slider_5 = Slider(12, range=0..100)  # disabled
construct_domain_2 = ConstructDomain(DomainStart=0, DomainEnd=expr("x/2", number_slider_5))  # disabled
construct_domain_3 = ConstructDomain(DomainStart=0, DomainEnd=number_slider_5)  # disabled
rectangle = Rectangle(Plane=PlaneXY(0, 0, 0), XSize=construct_domain_3, YSize=construct_domain_2, Radius=0)  # -> Rectangle, Length; disabled
unit_x = UnitX(Factor=expr("x/2.5", number_slider_5))  # disabled
area = Area(Geometry=rectangle.Rectangle)  # -> Area, Centroid; disabled
negative = Negative(Value=unit_x)  # disabled
move = Move(Geometry=area.Centroid, Motion=[unit_x, negative])  # -> Geometry, Transform; disabled
dispatch = Dispatch(List=move.Geometry, DispatchPattern=[True, False])  # -> ListA, ListB; disabled
number_slider_6 = Slider(0.26, range=0..1)  # disabled
negative_2 = Negative(Value=number_slider_5)  # disabled
line = Line(StartPoint=dispatch.ListA, EndPoint=dispatch.ListB)  # disabled
scale = Scale(Geometry=line, Center=area.Centroid, Factor=number_slider_6)  # -> Geometry, Transform; disabled
unit_y = UnitY(Factor=expr("x/7", [negative_2, number_slider_5]))  # disabled
move_2 = Move(Geometry=scale.Geometry, Motion=unit_y)  # -> Geometry, Transform; disabled
number_slider_7 = Slider(0.302, range=0..1)  # disabled
merge = Merge(Data1=line, Data2=rectangle.Rectangle, Data3=move_2.Geometry)  # disabled
pipe_2 = Pipe(Curve=merge, Radius=number_slider_7, Caps=2)  # disabled

merge_fields = MergeFields(Fields=spin_force)
evaluate_field = EvaluateField(Field=merge_fields, Point=loop_start.Data)  # -> Tensor, Strength
amplitude = Amplitude(Vector=evaluate_field.Tensor, Amplitude=Slider(13, range=0..110))
move_3 = Move(Geometry=loop_start.Data, Motion=amplitude)  # -> Geometry, Transform
loop_end = LoopEnd(port=loop_start.port, Exit=False, Data=move_3.Geometry, TimeOutVal=0, pausedState=False, state="Constant & Record")
flip_matrix_2 = FlipMatrix(Data=loop_end)
polyline = PolyLine(Vertices=flip_matrix_2, Closed=False)
msphere = MeshSphere(Base=flip_matrix_2, Radius=10, UCount=10, VCount=20)  # disabled
gene_pool = GenePool(
    Decimals=2,
    Maximum=1,
    Minimum=0,
    Value=[0, 0.07, 0.13, 0.15, 0.19, 0.25, 0.28, 0.34, 0.39, 0.44, 0.46, 0.5, 0.55, 0.89, 0.66, 0.7, 0.77, 0.82, 0.9, 1])
gene_pool_2 = GenePool(
    Decimals=2,
    Maximum=10,
    Minimum=0,
    Value=[0.3108750667, 1.039347644, 0.8616812392, 0.8221351618, 1.081676492, 3.279517689, 3.571988719, 3.173987956, 3.321434142, 4.029909258, 3.617336235, 4.188125042, 5.902866949, 5.533529657, 7.50063081, 7.983449257, 8.111051655, 8.700533225, 8.738852717, 9.527687063])
curve = Curve(polyline)
scale_2 = Scale(Geometry=flatten([extrude, pipe]), Center=Point(0, 0, 0), Factor=Slider(0.01, range=0..0.01))  # -> Geometry, Transform
pipe_variable = PipeVariable(Curve=reparameterize(polyline), Parameters=gene_pool, Radii=gene_pool_2, Caps=0)
end_points = EndPoints(Curve=curve)  # -> Start, flatten(End)
orient = Orient(Geometry=scale_2.Geometry, Source=PlaneXY(0, 0, 0), Target=[end_points.End, end_points.Start])  # -> Geometry, Transform
deconstruct_brep = DeconstructBrep(Brep=orient.Geometry)  # -> Faces, Edges, flatten(Vertices)
list_item = ListItem(List=deconstruct_brep.Vertices, Index=Slider(208, range=0..1000), Wrap=True)
geometry = Geometry(list_item)
construct_plane = ConstructPlane(Origin=geometry, XAxis=Vector(1, 0, 0), YAxis=Vector(0, 1, 0))
number_slider_8 = Slider(423, range=0..1000)

number_slider_9 = Slider(400, range=0..1000)
number_slider_10 = Slider(2400, range=0..6000)
number_slider_11 = Slider(101, range=0..1000)
number_slider_12 = Slider(24, range=0..100)
construct_point_3 = ConstructPoint(XCoordinate=0, YCoordinate=0, ZCoordinate=0)
unit_z_3 = UnitZ(Factor=1)
pi_2 = Pi(Factor=Slider(2, range=0..10))
subtraction_2 = Subtraction(A=number_slider_10, B=number_slider_11)
line_sdl_2 = LineSDL(Start=construct_point_3, Direction=unit_z_3, Length=number_slider_10)
division_3 = Division(A=pi_2, B=number_slider_12)
expression_2 = Expression(x=number_slider_12, Expression="x+1")
division_4 = Division(A=subtraction_2, B=number_slider_12)
range_2 = Range(Domain=pi_2, Steps=number_slider_12)
multiplication_2 = Multiplication(A=division_3, B=Slider(1, range=0..2))
series_2 = Series(Start=0, Step=division_4, Count=expression_2)
addition_3 = Addition(A=number_slider_9, B=Slider(466, range=0..1000))
addition_4 = Addition(A=range_2, B=multiplication_2)
construct_domain_4 = ConstructDomain(DomainStart=range_2, DomainEnd=addition_4)
construct_point_4 = ConstructPoint(XCoordinate=0, YCoordinate=0, ZCoordinate=series_2)
arc_2 = Arc(Plane=construct_point_4, Radius=graft([number_slider_9, addition_3]), Angle=construct_domain_4)  # -> Arc, Length
flip_matrix_3 = FlipMatrix(Data=arc_2.Arc)
unit_z_4 = UnitZ(Factor=number_slider_11)
loft_2 = Loft(Curves=flip_matrix_3, Options={Adjust=False, Closed=False, LoftEnds=0, LoftSimp=0, LoftType=0, Rebuild=10, Refit=0.01})
extrude_2 = Extrude(Base=loft_2, Direction=unit_z_4)
pipe_3 = Pipe(Curve=line_sdl_2, Radius=number_slider_9, Caps=1)

number_slider_13 = Slider(254, range=0..1000)
rectangle_2 = Rectangle(Plane=construct_plane, XSize=number_slider_8, YSize=number_slider_8, Radius=0)  # -> Rectangle, Length
# Anemone Loops with Remote
rectangle_3 = Rectangle(Plane=construct_plane, XSize=number_slider_13, YSize=number_slider_13, Radius=0)  # -> Rectangle, Length
region_3 = Region(rectangle_3.Rectangle)
region_4 = Region(rectangle_2.Rectangle)
populate_2d_3 = Populate2D(Region=region_3, Count=Slider(3, range=0..10), Seed=1)
populate_2d_4 = Populate2D(Region=region_4, Count=Slider(2, range=0..10), Seed=Slider(252, range=0..1000))
number_slider_14 = Slider(5.26, range=0..10)
loop_start_2 = LoopStart(Repeat=Slider(180, range=0..1000), Trigger=Toggle(True), Data=populate_2d_3)  # -> port, Counter, Data
spin_force_2 = SpinForce(Plane=populate_2d_4, Strength=Slider(607, range=0..1100), Radius=Slider(6.731, range=0..10), Decay=2)
merge_fields_2 = MergeFields(Fields=spin_force_2)
evaluate_field_2 = EvaluateField(Field=merge_fields_2, Point=loop_start_2.Data)  # -> Tensor, Strength
amplitude_2 = Amplitude(Vector=evaluate_field_2.Tensor, Amplitude=Slider(22, range=0..110))
move_4 = Move(Geometry=loop_start_2.Data, Motion=amplitude_2)  # -> Geometry, Transform
loop_end_2 = LoopEnd(port=loop_start_2.port, Exit=False, Data=move_4.Geometry, TimeOutVal=0, pausedState=False, state="Constant & Record")
flip_matrix_4 = FlipMatrix(Data=loop_end_2)
polyline_2 = PolyLine(Vertices=flip_matrix_4, Closed=False)
msphere_2 = MeshSphere(Base=flip_matrix_4, Radius=10, UCount=10, VCount=20)  # disabled
gene_pool_3 = GenePool(
    Decimals=2,
    Maximum=1,
    Minimum=0,
    Value=[0, 0.07, 0.13, 0.15, 0.19, 0.25, 0.28, 0.34, 0.39, 0.44, 0.46, 0.5, 0.55, 0.59, 0.66, 0.7, 0.77, 0.82, 0.9, 1])
gene_pool_4 = GenePool(
    Decimals=2,
    Maximum=10,
    Minimum=0,
    Value=[4.16, 5.1, 4.35, 5.06, 3.77, 3.842520982, 3.617595176, 2.777337319, 3.323113072, 4.753683278, 3.803352337, 4.413433537, 6.149740232, 6.099835717, 6.624501111, 8.945456672, 8.940140353, 7.709510012, 8.714823088, 9.441662148])
curve_2 = Curve(polyline_2)
pipe_variable_2 = PipeVariable(Curve=reparameterize(polyline_2), Parameters=gene_pool_3, Radii=gene_pool_4, Caps=0)
scale_3 = Scale(Geometry=flatten([extrude_2, pipe_3]), Center=Point(0, 0, 0), Factor=Slider(0.01, range=0..0.01))  # -> Geometry, Transform
end_points_2 = EndPoints(Curve=curve_2)  # -> Start, flatten(End)
orient_2 = Orient(Geometry=scale_3.Geometry, Source=PlaneXY(0, 0, 0), Target=[end_points_2.End, end_points_2.Start])  # -> Geometry, Transform
deconstruct_brep_2 = DeconstructBrep(Brep=orient_2.Geometry)  # -> Faces, Edges, flatten(Vertices)
list_item_2 = ListItem(List=deconstruct_brep_2.Vertices, Index=Slider(208, range=0..1000), Wrap=True)
geometry_2 = Geometry(list_item_2)
construct_plane_2 = ConstructPlane(Origin=geometry_2, XAxis=Vector(1, 0, 0), YAxis=Vector(0, 1, 0))

number_slider_15 = Slider(55, range=1..101)
unit_z_5 = UnitZ(Factor=Slider(39, range=0..100))
circle = Circle(Plane=PlaneXY(0, 0, 0), Radius=Slider(266, range=0..500))
circle_2 = Circle(Plane=PlaneXY(0, 0, 0), Radius=Slider(300, range=0..500))
area_2 = Area(Geometry=circle)  # -> Area, Centroid
divide_curve = DivideCurve(Curve=circle, Count=number_slider_15, Kinks=False)  # -> Points, Tangents, Parameters
series_3 = Series(Start=Slider(0, range=0..1), Step=Slider(0.002826, range=0..0.1), Count=expr("x/2", number_slider_15))
dispatch_2 = Dispatch(List=divide_curve.Points, DispatchPattern=[True, False])  # -> ListA, ListB
jitter = Jitter(List=series_3, Jitter=1, Seed=Slider(65, range=0..100))  # -> Values, Indices
vector_2pt = Vector2Pt(PointA=area_2.Centroid, PointB=dispatch_2.ListA, Unitize=False)  # -> Vector, Length
vector_2pt_2 = Vector2Pt(PointA=dispatch_2.ListB, PointB=area_2.Centroid, Unitize=False)  # -> Vector, Length
multiplication_3 = Multiplication(A=vector_2pt_2.Vector, B=jitter.Values)
multiplication_4 = Multiplication(A=vector_2pt.Vector, B=jitter.Values)
move_5 = Move(Geometry=dispatch_2.ListA, Motion=multiplication_4)  # -> Geometry, Transform
move_6 = Move(Geometry=dispatch_2.ListB, Motion=multiplication_3)  # -> Geometry, Transform
weave = Weave(Pattern=[0, 1], Stream0=move_5.Geometry, Stream1=move_6.Geometry, NullGaps=False)  # -> flatten(Weave)
interpolate = Interpolate(Vertices=weave, Degree=3, Periodic=True, KnotStyle=1)  # -> Curve, Length, Domain

negative_3 = Negative(Value=unit_z_5)

move_7 = Move(Geometry=circle_2, Motion=negative_3)  # -> Geometry, Transform
loft_3 = Loft(
    Curves=[move_7.Geometry, interpolate.Curve],
    Options={Adjust=False, Closed=False, LoftEnds=0, LoftSimp=0, LoftType=0, Rebuild=10, Refit=0.01})
cap_holes = CapHoles(Brep=loft_3)

deconstruct_brep_3 = DeconstructBrep(Brep=cap_holes)  # -> Faces, Edges, Vertices
number_slider_16 = Slider(9, range=0..100)
rectangle_4 = Rectangle(Plane=PlaneXY(0, 0, 0), XSize=Slider(9, range=0..100), YSize=Slider(30, range=0..100), Radius=0)  # -> Rectangle, Length
rectangle_5 = Rectangle(Plane=PlaneXY(0, 0, 0), XSize=Slider(27, range=0..100), YSize=Slider(66, range=0..100), Radius=0)  # -> Rectangle, Length
list_item_3 = ListItem(List=deconstruct_brep_3.Faces, Index=Slider(1, range=0..10), Wrap=True)
rectangular_array = RectangularArray(Geometry=rectangle_4.Rectangle, Cell=rectangle_5.Rectangle, XCount=number_slider_16, YCount=number_slider_16)  # -> Geometry, Transform
surface = Surface(reparameterize(list_item_3))
orient_3 = Orient(Geometry=rectangular_array.Geometry, Source=PlaneXY(0, 0, 0), Target=surface)  # -> Geometry, Transform
area_3 = Area(Geometry=surface)  # -> Area, Centroid
scale_4 = Scale(Geometry=orient_3.Geometry, Center=area_3.Centroid, Factor=0.5)  # -> Geometry, Transform
unit_z_6 = UnitZ(Factor=Slider(6, range=0..20))
extrude_3 = Extrude(Base=scale_4.Geometry, Direction=unit_z_6)
deconstruct_brep_4 = DeconstructBrep(Brep=extrude_3)  # -> Faces, Edges, Vertices
number_slider_17 = Slider(4.45, range=0..10)
list_item_4 = ListItem(List=deconstruct_brep_4.Vertices, Index=Slider(2, range=0..10), Wrap=True)
list_item_5 = ListItem(List=deconstruct_brep_4.Vertices, Index=Slider(3, range=0..10), Wrap=True)
list_item_6 = ListItem(List=deconstruct_brep_4.Vertices, Index=Slider(1, range=0..10), Wrap=True)
list_item_7 = ListItem(List=deconstruct_brep_4.Vertices, Index=Slider(4, range=0..10), Wrap=True)
list_item_8 = ListItem(List=deconstruct_brep_4.Vertices, Index=Slider(5, range=0..10), Wrap=True)
list_item_9 = ListItem(List=deconstruct_brep_4.Vertices, Index=Slider(7, range=0..10), Wrap=True)
list_item_10 = ListItem(List=deconstruct_brep_4.Vertices, Index=Slider(8, range=0..10), Wrap=True)
list_item_11 = ListItem(List=deconstruct_brep_4.Vertices, Index=Slider(6, range=0..10), Wrap=True)
unit_y_2 = UnitY(Factor=number_slider_17)
unit_y_3 = UnitY(Factor=number_slider_17)
unit_y_4 = UnitY(Factor=number_slider_17)
unit_y_5 = UnitY(Factor=number_slider_17)
number_slider_18 = Slider(13, range=0..100)
move_8 = Move(Geometry=list_item_11, Motion=expr("-x", unit_y_2))  # -> Geometry, Transform
move_9 = Move(Geometry=list_item_8, Motion=expr("-x", unit_y_4))  # -> Geometry, Transform
move_10 = Move(Geometry=list_item_9, Motion=unit_y_3)  # -> Geometry, Transform
move_11 = Move(Geometry=list_item_10, Motion=unit_y_5)  # -> Geometry, Transform
vector_2pt_3 = Vector2Pt(PointA=move_9.Geometry, PointB=list_item_7, Unitize=False)  # -> Vector, Length
vector_2pt_4 = Vector2Pt(PointA=move_11.Geometry, PointB=list_item_6, Unitize=False)  # -> Vector, Length
vector_2pt_5 = Vector2Pt(PointA=move_8.Geometry, PointB=list_item_5, Unitize=False)  # -> Vector, Length
vector_2pt_6 = Vector2Pt(PointA=move_10.Geometry, PointB=list_item_4, Unitize=False)  # -> Vector, Length
line_sdl_3 = LineSDL(Start=move_10.Geometry, Direction=vector_2pt_6.Vector, Length=number_slider_18)
line_sdl_4 = LineSDL(Start=move_9.Geometry, Direction=vector_2pt_3.Vector, Length=number_slider_18)
line_sdl_5 = LineSDL(Start=move_11.Geometry, Direction=vector_2pt_4.Vector, Length=number_slider_18)
line_sdl_6 = LineSDL(Start=move_8.Geometry, Direction=vector_2pt_5.Vector, Length=number_slider_18)
loft_4 = Loft(
    Curves=[line_sdl_4, line_sdl_6],
    Options={Adjust=False, Closed=False, LoftEnds=0, LoftSimp=0, LoftType=0, Rebuild=10, Refit=0.01})
loft_5 = Loft(
    Curves=[line_sdl_5, line_sdl_3],
    Options={Adjust=False, Closed=False, LoftEnds=0, LoftSimp=0, LoftType=0, Rebuild=10, Refit=0.01})
unit_z_7 = UnitZ(Factor=1)
extrude_4 = Extrude(Base=[loft_4, loft_5], Direction=unit_z_7)

line_line = LineLine(Line1=line_sdl_4, Line2=line_sdl_5)  # -> flatten(ParamA), ParamB, PointA, PointB
line_2 = Line(StartPoint=list_item_8, EndPoint=list_item_10)
unit_x_2 = UnitX(Factor=Slider(0.7, range=0..2))
point_on_curve = PointOnCurve(line_2, parameter=0.5)
point = Point(line_line.PointA)
construct_domain_5 = ConstructDomain(DomainStart=Slider(15, range=0..100), DomainEnd=Slider(0, range=0..100))
range_3 = Range(Domain=construct_domain_5, Steps=Slider(32, range=0..100))
sine = Sine(Value=range_3)
cosine = Cosine(Value=range_3)
xy_plane = XYPlane(Origin=point)
construct_point_5 = ConstructPoint(XCoordinate=range_3, YCoordinate=sine, ZCoordinate=cosine)
series_4 = Series(Start=0, Step=1, Count=Slider(6, range=0..10))
interpolate_2 = Interpolate(Vertices=construct_point_5, Degree=3, Periodic=False, KnotStyle=1)  # -> Curve, Length, Domain
deconstruct_plane = DeconstructPlane(Plane=xy_plane)  # -> Origin, XAxis, YAxis, ZAxis
yz_plane = YZPlane(Origin=Point(0, 0, 0))
rotate = Rotate(Geometry=interpolate_2.Curve, Angle=series_4, Plane=yz_plane)  # -> Geometry, Transform
orient_4 = Orient(Geometry=rotate.Geometry, Source=PlaneXY(0, 0, 0), Target=xy_plane)  # -> Geometry, Transform
number_slider_19 = Slider(0.21, range=0..1)
scale_nu = ScaleNU(
    Geometry=orient_4.Geometry,
    Plane=xy_plane,
    ScaleX=Slider(1, range=0..1),
    ScaleY=number_slider_19,
    ScaleZ=number_slider_19)  # -> Geometry, Transform
pi_3 = Pi(Factor=Slider(0.006, range=0..1))
xz_plane = XZPlane(Origin=Point(0, 0, 0))
pi_4 = Pi(Factor=Slider(0.423, range=0..1))
flip_plane = FlipPlane(Plane=xz_plane, ReverseX=False, ReverseY=False, SwapAxes=True)
rotate_2 = Rotate(Geometry=scale_nu.Geometry, Angle=pi_3, Plane=xy_plane)  # -> Geometry, Transform
rotate_3d = Rotate3D(Geometry=rotate_2.Geometry, Angle=expr("-x", pi_4), Center=deconstruct_plane.Origin, Axis=flip_plane)  # -> Geometry, Transform

negative_4 = Negative(Value=unit_x_2)
geometry_3 = Geometry(cap_holes)

move_12 = Move(Geometry=point_on_curve, Motion=negative_4)  # -> Geometry, Transform
vector_2pt_7 = Vector2Pt(PointA=point, PointB=move_12.Geometry, Unitize=False)  # -> Vector, Length
rotate_3d_2 = Rotate3D(Geometry=rotate_3d.Geometry, Angle=expr("-x", pi_4), Center=deconstruct_plane.Origin, Axis=vector_2pt_7.Vector)  # -> Geometry, Transform
pipe_4 = Pipe(Curve=[rotate_3d.Geometry, rotate_3d_2.Geometry], Radius=Slider(0.168, range=0..1), Caps=1)

merge_2 = Merge(Data1=extrude_3, Data2=extrude_4, Data3=pipe_4)

volume = Volume(Geometry=geometry_3)  # -> Volume, Centroid
scale_5 = Scale(Geometry=geometry_3, Center=volume.Centroid, Factor=number_slider_14)  # -> Geometry, Transform
scale_6 = Scale(Geometry=merge_2, Center=volume.Centroid, Factor=number_slider_14)  # -> Geometry, Transform
merge_3 = Merge(Data1=scale_5.Geometry)
merge_4 = Merge(Data1=pipe_variable, Data2=orient.Geometry, Data3=pipe_variable_2, Data4=orient_2.Geometry, Data6=scale_6.Geometry)
