# Grasshopper definition WorldOfDuchameArfaxMines002.gh (Grasshopper 1.0.7)
# Copyright: Wickerson Studios
# plug-ins: Fractals, Bifocals

# Wickerson Studio
# created by: Michael Wickerson
# Grasshopper for Rhino 3D Algorithmic Modeling
# www.wickersonstudios.com
# www.michaelwickerson.com
# https://www.youtube.com/channel/UC7J48Ppcsa6oncp6d29R0xw
# https://github.com/mwickerson
# https://www.facebook.com/michael.wickerson
# https://www.linkedin.com/in/michael-wickerson-696a80156/
image_sampler = ImageSampler(
    FilePath="C:\Users\Sculpture\Documents\2020Grasshopper\ScreenShots2019\Screenshots2020\SurfaceEditAlgorithm.PNG",
    Filter="Value",
    Interpolate=False,
    Umax=1,
    Umin=0,
    Vmax=1,
    Vmin=0,
    Wrap=1)

# ----
# Place: Arfax
# Location 30-77
# Flag:
# Good/Ill: I
# Race/Class: Goblins
# Leader: Reyuck/Yagnodeamon
# Class/Rank: Chieftan/Lord
number_slider = Slider(12, range=0..100)  # disabled
construct_domain = ConstructDomain(DomainStart=0, DomainEnd=expr("x/2", number_slider))  # disabled
construct_domain_2 = ConstructDomain(DomainStart=0, DomainEnd=number_slider)  # disabled
rectangle = Rectangle(Plane=PlaneXY(0, 0, 0), XSize=construct_domain_2, YSize=construct_domain, Radius=0)  # -> Rectangle, Length; disabled
unit_x = UnitX(Factor=expr("x/2.5", number_slider))  # disabled
area = Area(Geometry=rectangle.Rectangle)  # -> Area, Centroid; disabled
negative = Negative(Value=unit_x)  # disabled
move = Move(Geometry=area.Centroid, Motion=[unit_x, negative])  # -> Geometry, Transform; disabled
dispatch = Dispatch(List=move.Geometry, DispatchPattern=[True, False])  # -> ListA, ListB; disabled
number_slider_2 = Slider(0.26, range=0..1)  # disabled
negative_2 = Negative(Value=number_slider)  # disabled
line = Line(StartPoint=dispatch.ListA, EndPoint=dispatch.ListB)  # disabled
scale = Scale(Geometry=line, Center=area.Centroid, Factor=number_slider_2)  # -> Geometry, Transform; disabled
unit_y = UnitY(Factor=expr("x/7", [negative_2, number_slider]))  # disabled
move_2 = Move(Geometry=scale.Geometry, Motion=unit_y)  # -> Geometry, Transform; disabled
number_slider_3 = Slider(0.302, range=0..1)  # disabled
merge = Merge(Data1=line, Data2=rectangle.Rectangle, Data3=move_2.Geometry)  # disabled
pipe = Pipe(Curve=merge, Radius=number_slider_3, Caps=2)  # disabled

generation_point = GenerationPoint(Point(1, -14, 0))

dla_fractal = DLAFractal(
    NumberOfIterations=Slider(475, range=0..1000),
    GenerationPoint=generation_point,
    Multiplier=Slider(6, range=0..10),
    CanvasHeight=100,
    CanvasWidth=100,
    LoopOnCanvasEdge=True)
gene_pool = GenePool(Decimals=2, Maximum=1, Minimum=0, Value=[0, 0.21, 0.3, 0.37, 0.45, 0.49, 0.54, 0.73, 0.85, 1])
interpolate = Interpolate(Vertices=dla_fractal, Degree=3, Periodic=False, KnotStyle=1)  # -> Curve, Length, Domain
gene_pool_2 = GenePool(
    Decimals=2,
    Maximum=3,
    Minimum=0,
    Value=[2.264210231, 0.5542967238, 2.793421618, 1.445181956, 0.4080929874, 2.069850959, 0.4296449588, 2.609632075, 1.660729063, 2.14])
shatter = Shatter(Curve=reparameterize(interpolate.Curve), Parameters=gene_pool)  # -> flatten(Segments)
pipe_variable = PipeVariable(Curve=reparameterize(shatter), Parameters=gene_pool, Radii=gene_pool_2, Caps=0)

number_slider_4 = Slider(16, range=0..100)
pi = Pi(Factor=Slider(1.18, range=0..2))
generation_code = GenerationCode("-F-F-F-F-F-F")
panel = Panel(generation_code)
vogel_sunflower = VogelSunflower(NumberOfIterations=number_slider_4, GenerationPoint=generation_point, Degree=5)  # -> Points, Radius
l_systems_turtle = LSystemsTurtle(
    GenerationPoint=generation_point,
    GenerationCode="-f-F-F-f-f-F-F-F-f-f-f-f",
    Iterations=number_slider_4,
    Angle=pi,
    StepLength=10)  # -> Points, Lines
interpolate_2 = Interpolate(Vertices=vogel_sunflower.Points, Degree=3, Periodic=False, KnotStyle=1)  # -> Curve, Length, Domain
geometry = Geometry(l_systems_turtle.Points)
geometry_2 = Geometry(l_systems_turtle.Lines)

generation_point_2 = GenerationPoint(Point(1, -14, 0))

dla_fractal_2 = DLAFractal(
    NumberOfIterations=Slider(187, range=0..1000),
    GenerationPoint=generation_point_2,
    Multiplier=Slider(6, range=0..10),
    CanvasHeight=100,
    CanvasWidth=100,
    LoopOnCanvasEdge=True)
gene_pool_3 = GenePool(Decimals=2, Maximum=1, Minimum=0, Value=[0, 0.21, 0.3, 0.37, 0.45, 0.49, 0.54, 0.73, 0.85, 1])
interpolate_3 = Interpolate(Vertices=dla_fractal_2, Degree=3, Periodic=False, KnotStyle=1)  # -> Curve, Length, Domain
gene_pool_4 = GenePool(
    Decimals=2,
    Maximum=3,
    Minimum=0,
    Value=[2.264210231, 0.5542967238, 2.793421618, 1.445181956, 0.4080929874, 2.069850959, 0.4296449588, 2.609632075, 1.660729063, 2.14])
shatter_2 = Shatter(Curve=reparameterize(interpolate_3.Curve), Parameters=gene_pool_3)  # -> flatten(Segments)
pipe_variable_2 = PipeVariable(Curve=reparameterize(shatter_2), Parameters=gene_pool_3, Radii=gene_pool_4, Caps=0)
