# Grasshopper definition WorldOfDuchameAugsamCaves001.gh (Grasshopper 1.0.7)
# Copyright: Wickerson Studios
# plug-ins: Bifocals

# Wickerson Studio
# created by: Michael Wickerson
# Grasshopper for Rhino 3D Algorithmic Modeling
# www.wickersonstudios.com
# www.michaelwickerson.com
# https://www.youtube.com/channel/UC7J48Ppcsa6oncp6d29R0xw
# https://github.com/mwickerson
# https://www.facebook.com/michael.wickerson
# https://www.linkedin.com/in/michael-wickerson-696a80156/
image_sampler = ImageSampler(
    FilePath="C:\Users\Sculpture\Documents\2020Grasshopper\ScreenShots2019\Screenshots2020\SurfaceEditAlgorithm.PNG",
    Filter="Value",
    Interpolate=False,
    Umax=1,
    Umin=0,
    Vmax=1,
    Vmin=0,
    Wrap=1)

number_slider = Slider(27, range=0..100)
unit_z = UnitZ(Factor=Slider(88, range=0..100))
plane_surface = PlaneSurface(Plane=PlaneXY(0, 0, 0), XSize=Domain(-100, 100), YSize=Domain(-100, 100))
construct_point = ConstructPoint(XCoordinate=Slider(0.52, range=0..1), YCoordinate=Slider(0.46, range=0..1), ZCoordinate=0)
extrude = Extrude(Base=plane_surface, Direction=unit_z)
divide_surface = DivideSurface(Surface=plane_surface, UCount=number_slider, VCount=number_slider)  # -> flatten(Points), Normals, Parameters
evaluate_surface = EvaluateSurface(Surface=reparameterize(plane_surface), Point=construct_point)  # -> Point, Normal, UDirection, VDirection, Frame
distance = Distance(PointA=divide_surface.Points, PointB=evaluate_surface.Point)
remap = Remap(data=distance, min=0, max=1)
graph_mapper = GraphMapper(
    remap,
    x0=0,
    x1=1,
    y0=0,
    y1=1,
    container_name="Bezier",
    cpx=[0, 0.3297710717, 0.03053435124, 1],
    cpy=[0.1273238659, 0.5788732171, 1, 1])
graph_mapper_2 = GraphMapper(
    graph_mapper,
    x0=0,
    x1=1,
    y0=0,
    y1=1,
    container_name="Sine",
    Equation_px=[0.4215188324, 1],
    Equation_py=[0.204285562, 0.9376811385])
remap_2 = Remap(data=graph_mapper_2, min=Slider(0, range=0..100), max=Slider(35, range=0..100))
unit_z_2 = UnitZ(Factor=remap_2)
move = Move(Geometry=divide_surface.Points, Motion=unit_z_2)  # -> Geometry, Transform
surface_from_points = SurfaceFromPoints(Points=move.Geometry, UCount=expr("x+1", number_slider), Interpolate=False)
split_brep = SplitBrep(Brep=extrude, Cutter=surface_from_points)
dispatch = Dispatch(List=split_brep, DispatchPattern=[True, False])  # -> ListA, ListB
brep = Brep(dispatch.ListA)
brep_join = BrepJoin(Breps=[brep, surface_from_points])  # -> flatten(Breps), Closed
solid_union = SolidUnion(Breps=brep_join.Breps)

number_slider_2 = Slider(10, range=0..100)
construct_domain = ConstructDomain(DomainStart=Slider(18, range=0..100), DomainEnd=number_slider_2)
yz_plane = YZPlane(Origin=Point(0, 0, 0))
range = Range(Domain=construct_domain, Steps=Slider(10, range=0..10))
ellipse = Ellipse(Plane=yz_plane, Radius1=Slider(2, range=0..10), Radius2=Slider(6.08, range=0..10))  # -> Ellipse, Focus1, Focus2
series = Series(Start=Slider(0.49, range=0..1), Step=Slider(0.04, range=-0.01..0.1), Count=10)
series_2 = Series(Start=number_slider_2, Step=1, Count=10)
jitter = Jitter(List=series, Jitter=1, Seed=Slider(12, range=0..100))  # -> Values, Indices
jitter_2 = Jitter(List=series, Jitter=1, Seed=Slider(36, range=0..100))  # -> Values, Indices
jitter_3 = Jitter(List=series_2, Jitter=1, Seed=2)  # -> Values, Indices
scale_nu = ScaleNU(Geometry=ellipse.Ellipse, Plane=yz_plane, ScaleX=jitter.Values, ScaleY=jitter_2.Values, ScaleZ=1)  # -> Geometry, Transform
unit_z_3 = UnitZ(Factor=jitter_3.Values)
series_3 = Series(Start=Slider(0, range=0..1), Step=Slider(0.19, range=0..1), Count=10)
move_2 = Move(Geometry=scale_nu.Geometry, Motion=unit_z_3)  # -> Geometry, Transform
jitter_4 = Jitter(List=series_3, Jitter=1, Seed=2)  # -> Values, Indices
area = Area(Geometry=move_2.Geometry)  # -> Area, Centroid
pi = Pi(Factor=jitter_4.Values)
rotate_3d = Rotate3D(Geometry=move_2.Geometry, Angle=pi, Center=area.Centroid, Axis=Vector(0, 0, 1))  # -> Geometry, Transform
md_slider = MDSlider(SliderMode=0, slider_value=Point(0.5, 0.5, 0.5), x_domain=Domain(0, 1), y_domain=Domain(0, 1), z_domain=Domain(0, 1))
boundary_surfaces = BoundarySurfaces(Edges=rotate_3d.Geometry)
evaluate_surface_2 = EvaluateSurface(Surface=reparameterize(boundary_surfaces), Point=md_slider)  # -> Point, Normal, UDirection, VDirection, Frame
series_4 = Series(Start=Slider(67, range=0..100), Step=Slider(2, range=0..10), Count=10)
jitter_5 = Jitter(List=series_4, Jitter=1, Seed=Slider(19, range=0..100))  # -> Values, Indices
multiplication = Multiplication(A=evaluate_surface_2.Normal, B=jitter_5.Values)
extrude_2 = Extrude(Base=boundary_surfaces, Direction=multiplication)

# ----
# Place: Augsam
# Location 46-74
# Flag:
# Good/Ill: I
# Race/Class: Trolls
# Leader: Cuol
# Class/Rank: Leader
number_slider_3 = Slider(12, range=0..100)  # disabled
construct_domain_2 = ConstructDomain(DomainStart=0, DomainEnd=expr("x/2", number_slider_3))  # disabled
construct_domain_3 = ConstructDomain(DomainStart=0, DomainEnd=number_slider_3)  # disabled
rectangle = Rectangle(Plane=PlaneXY(0, 0, 0), XSize=construct_domain_3, YSize=construct_domain_2, Radius=0)  # -> Rectangle, Length; disabled
unit_x = UnitX(Factor=expr("x/2.5", number_slider_3))  # disabled
area_2 = Area(Geometry=rectangle.Rectangle)  # -> Area, Centroid; disabled
negative = Negative(Value=unit_x)  # disabled
move_3 = Move(Geometry=area_2.Centroid, Motion=[unit_x, negative])  # -> Geometry, Transform; disabled
dispatch_2 = Dispatch(List=move_3.Geometry, DispatchPattern=[True, False])  # -> ListA, ListB; disabled
number_slider_4 = Slider(0.26, range=0..1)  # disabled
negative_2 = Negative(Value=number_slider_3)  # disabled
line = Line(StartPoint=dispatch_2.ListA, EndPoint=dispatch_2.ListB)  # disabled
scale = Scale(Geometry=line, Center=area_2.Centroid, Factor=number_slider_4)  # -> Geometry, Transform; disabled
unit_y = UnitY(Factor=expr("x/7", [negative_2, number_slider_3]))  # disabled
move_4 = Move(Geometry=scale.Geometry, Motion=unit_y)  # -> Geometry, Transform; disabled
number_slider_5 = Slider(0.302, range=0..1)  # disabled
merge = Merge(Data1=line, Data2=rectangle.Rectangle, Data3=move_4.Geometry)  # disabled
pipe = Pipe(Curve=merge, Radius=number_slider_5, Caps=2)  # disabled

deconstruct_brep = DeconstructBrep(Brep=extrude_2)  # -> Faces, Edges, Vertices
list_item = ListItem(List=deconstruct_brep.Faces, Index=Slider(2, range=0..10), Wrap=True)
area_3 = Area(Geometry=list_item)  # -> Area, Centroid
series_5 = Series(Start=Slider(5.12, range=0..10), Step=Slider(0.608, range=0..1), Count=10)
construct_plane = ConstructPlane(Origin=area_3.Centroid, XAxis=Vector(1, 0, 0), YAxis=Vector(0, 1, 0))  # -> flatten(Plane)
jitter_6 = Jitter(List=series_5, Jitter=1, Seed=Slider(12, range=0..100))  # -> Values, Indices
sphere = Sphere(Base=construct_plane, Radius=jitter_6.Values)
series_6 = Series(Start=Slider(0.26, range=0..1), Step=Slider(0.13, range=0..1), Count=10)
series_7 = Series(Start=Slider(0.37, range=0..1), Step=Slider(0.17, range=0..1), Count=10)
jitter_7 = Jitter(List=series_6, Jitter=1, Seed=Slider(12, range=0..100))  # -> Values, Indices
scale_nu_2 = ScaleNU(Geometry=sphere, Plane=construct_plane, ScaleX=series_7, ScaleY=jitter_7.Values, ScaleZ=Slider(0.59, range=0..1))  # -> Geometry, Transform

number_slider_6 = Slider(4, range=0..100)
vector_xyz = VectorXYZ(
    XComponent=expr("-x", number_slider_6),
    YComponent=expr("-x*2", number_slider_6),
    ZComponent=expr("2*x", number_slider_6))  # -> Vector, Length
height = Slider(10, range=-1..10)
planesrf = PlaneSurface(Plane=PlaneXY(0, 0, 0), XSize=Slider(11, range=0..100), YSize=Slider(14, range=0..100))
move_5 = Move(Geometry=planesrf, Motion=vector_xyz.Vector)  # -> Geometry, Transform
pop2d = Populate2D(Region=move_5.Geometry, Count=Slider(398, range=0..1100), Seed=1)
del = DelaunayMesh(Points=pop2d, Plane=PlaneXY(0, 0, 0))
demesh = DeconstructMesh(Mesh=del)  # -> Vertices, Faces, Colours, Normals
lng = ListLength(List=demesh.Vertices)
pdecon = Deconstruct(Point=demesh.Vertices)  # -> XComponent, YComponent, ZComponent
random = Random(Range=Domain(0, 1), Number=lng, Seed=2)
multiplication_2 = Multiplication(A=random, B=height)
pt = ConstructPoint(XCoordinate=pdecon.XComponent, YCoordinate=pdecon.YComponent, ZCoordinate=multiplication_2)

solid_difference = SolidDifference(BrepsA=solid_union, BrepsB=extrude_2)
conmesh = ConstructMesh(Vertices=pt, Faces=demesh.Faces)

brep_2 = Brep(scale_nu_2.Geometry)
solid_difference_2 = SolidDifference(BrepsA=solid_difference, BrepsB=brep_2)

# ==== cluster Remap: Remaps numbers
data = ClusterInput()
min = ClusterInput()
max = ClusterInput()
bnd = Bounds(Numbers=data)
dom = ConstructDomain(DomainStart=min, DomainEnd=max)
remap = RemapNumbers(Value=data, Source=bnd, Target=dom)  # -> Mapped, Clipped
R = ClusterOutput(remap.Mapped)
