# Grasshopper definition WorldOfDuchameAxiomCastle001.gh (Grasshopper 1.0.7)
# Copyright: Wickerson Studios
# plug-ins: Pufferfish, Bifocals

# ---- group: March4thAirportDuchame003
number_slider = Slider(9.297, range=0..100)
number_slider_2 = Slider(13.7, range=0..40)

# ---- group: March4thAirportDuchame002
number_slider_3 = Slider(8.107, range=0..100)
number_slider_4 = Slider(7.92, range=0..10)

# ---- group: March3rdAirportDuchame
# East west Docks
number_slider_5 = Slider(0.64, range=0..1)
# The World of Duchame
# 
# Airport
number_slider_6 = Slider(4, range=0..100)
construct_domain = ConstructDomain(DomainStart=number_slider_6, DomainEnd=Slider(8, range=0..100))
range = Range(Domain=construct_domain, Steps=Slider(7, range=0..100))
sine = Sine(Value=range)
multiplication = Multiplication(A=range, B=Slider(20, range=0..100))
multiplication_2 = Multiplication(A=sine, B=Slider(9, range=0..100))
construct_point = ConstructPoint(XCoordinate=expr("-x", multiplication), YCoordinate=multiplication_2, ZCoordinate=0)
pi = Pi(Factor=number_slider_5)
pi_2 = Pi(Factor=Slider(0.32, range=0..1))
construct_point_2 = ConstructPoint(XCoordinate=multiplication, YCoordinate=multiplication_2, ZCoordinate=0)
pi_3 = Pi(Factor=Slider(0.339, range=0..1))
pi_4 = Pi(Factor=Slider(0.593, range=0..1))
list_item = ListItem(List=construct_point_2, Index=0, Wrap=True)
list_item_2 = ListItem(List=construct_point, Index=0, Wrap=True)
construct_plane = ConstructPlane(Origin=list_item_2, XAxis=Vector(1, 0, 0), YAxis=Vector(0, 1, 0))
construct_plane_2 = ConstructPlane(Origin=list_item, XAxis=Vector(1, 0, 0), YAxis=Vector(0, 1, 0))
rotate = Rotate(Geometry=construct_point_2, Angle=expr("-x", pi_2), Plane=construct_plane_2)  # -> Geometry, Transform
rotate_2 = Rotate(Geometry=construct_point, Angle=expr("-x", pi_4), Plane=construct_plane)  # -> Geometry, Transform
rotate_3 = Rotate(Geometry=construct_point_2, Angle=pi, Plane=construct_plane_2)  # -> Geometry, Transform
rotate_4 = Rotate(Geometry=construct_point, Angle=pi_3, Plane=construct_plane)  # -> Geometry, Transform

# ---- group: March3rdAirportDuchame002
# East west Docks
number_slider_7 = Slider(0.64, range=0..1)
construct_domain_2 = ConstructDomain(DomainStart=Slider(4, range=0..100), DomainEnd=Slider(8, range=0..100))
range_2 = Range(Domain=construct_domain_2, Steps=Slider(7, range=0..100))
sine_2 = Sine(Value=range_2)
multiplication_3 = Multiplication(A=range_2, B=Slider(20, range=0..100))
multiplication_4 = Multiplication(A=sine_2, B=Slider(9, range=0..100))
construct_point_3 = ConstructPoint(XCoordinate=expr("-x", multiplication_3), YCoordinate=multiplication_4, ZCoordinate=0)
pi_5 = Pi(Factor=number_slider_7)
pi_6 = Pi(Factor=Slider(0.32, range=0..1))
construct_point_4 = ConstructPoint(XCoordinate=multiplication_3, YCoordinate=multiplication_4, ZCoordinate=0)
pi_7 = Pi(Factor=Slider(0.339, range=0..1))
pi_8 = Pi(Factor=Slider(0.593, range=0..1))
list_item_3 = ListItem(List=construct_point_4, Index=0, Wrap=True)
list_item_4 = ListItem(List=construct_point_3, Index=0, Wrap=True)
construct_plane_3 = ConstructPlane(Origin=list_item_4, XAxis=Vector(1, 0, 0), YAxis=Vector(0, 1, 0))
construct_plane_4 = ConstructPlane(Origin=list_item_3, XAxis=Vector(1, 0, 0), YAxis=Vector(0, 1, 0))
rotate_5 = Rotate(Geometry=construct_point_4, Angle=expr("-x", pi_6), Plane=construct_plane_4)  # -> Geometry, Transform
rotate_6 = Rotate(Geometry=construct_point_3, Angle=expr("-x", pi_8), Plane=construct_plane_3)  # -> Geometry, Transform
rotate_7 = Rotate(Geometry=construct_point_4, Angle=pi_5, Plane=construct_plane_4)  # -> Geometry, Transform
rotate_8 = Rotate(Geometry=construct_point_3, Angle=pi_7, Plane=construct_plane_3)  # -> Geometry, Transform

# ---- group: March4thAirportDuchame001
# East west Docks
number_slider_8 = Slider(9, range=0..100)
# The World of Duchame
# 
# Airport
number_slider_9 = Slider(4, range=0..100)
construct_domain_3 = ConstructDomain(DomainStart=number_slider_9, DomainEnd=Slider(8, range=0..100))
range_3 = Range(Domain=construct_domain_3, Steps=Slider(7, range=0..100))
sine_3 = Sine(Value=range_3)
multiplication_5 = Multiplication(A=range_3, B=Slider(20, range=0..100))
multiplication_6 = Multiplication(A=sine_3, B=number_slider_8)
construct_point_5 = ConstructPoint(XCoordinate=expr("-x", multiplication_5), YCoordinate=multiplication_6, ZCoordinate=0)
pi_9 = Pi(Factor=Slider(0.64, range=0..1))
pi_10 = Pi(Factor=Slider(0.32, range=0..1))
construct_point_6 = ConstructPoint(XCoordinate=multiplication_5, YCoordinate=multiplication_6, ZCoordinate=0)
pi_11 = Pi(Factor=Slider(0.339, range=0..1))
pi_12 = Pi(Factor=Slider(0.593, range=0..1))
list_item_5 = ListItem(List=construct_point_6, Index=0, Wrap=True)
list_item_6 = ListItem(List=construct_point_5, Index=0, Wrap=True)
construct_plane_5 = ConstructPlane(Origin=list_item_6, XAxis=Vector(1, 0, 0), YAxis=Vector(0, 1, 0))
construct_plane_6 = ConstructPlane(Origin=list_item_5, XAxis=Vector(1, 0, 0), YAxis=Vector(0, 1, 0))
rotate_9 = Rotate(Geometry=construct_point_6, Angle=expr("-x", pi_10), Plane=construct_plane_6)  # -> Geometry, Transform
rotate_10 = Rotate(Geometry=construct_point_5, Angle=expr("-x", pi_12), Plane=construct_plane_5)  # -> Geometry, Transform
rotate_11 = Rotate(Geometry=construct_point_6, Angle=pi_9, Plane=construct_plane_6)  # -> Geometry, Transform
rotate_12 = Rotate(Geometry=construct_point_5, Angle=pi_11, Plane=construct_plane_5)  # -> Geometry, Transform

# ---- group: March4thAirportDuchame003
number_slider_10 = Slider(1, range=0..1)
number_slider_11 = Slider(2.266, range=0..100)
number_slider_12 = Slider(20, range=0..100)
number_slider_13 = Slider(5.578, range=0..100)

# ---- group: March4thAirportDuchame002
number_slider_14 = Slider(1, range=0..1)
number_slider_15 = Slider(3, range=0..100)
number_slider_16 = Slider(9, range=0..100)
number_slider_17 = Slider(2, range=0..100)

# ---- group: March4thAirportDuchame003
number_slider_18 = Slider(93, range=0..100)
number_slider_19 = Slider(3.11, range=0..10)
number_slider_20 = Slider(0.29, range=0..1)

# ---- group: March4thAirportDuchame002
number_slider_21 = Slider(27, range=0..100)
number_slider_22 = Slider(3.51, range=0..10)
number_slider_23 = Slider(0.24, range=0..1)

# ---- group: March3rdAirportDuchame
number_slider_24 = Slider(17, range=0..100)
number_slider_25 = Slider(17, range=0..100)
vector_xyz = VectorXYZ(XComponent=number_slider_24, YComponent=number_slider_24, ZComponent=0)  # -> Vector, Length
vector_xyz_2 = VectorXYZ(XComponent=expr("-x", number_slider_24), YComponent=number_slider_24, ZComponent=0)  # -> Vector, Length
vector_xyz_3 = VectorXYZ(XComponent=expr("-x", number_slider_25), YComponent=number_slider_25, ZComponent=0)  # -> Vector, Length
vector_xyz_4 = VectorXYZ(XComponent=number_slider_25, YComponent=number_slider_25, ZComponent=0)  # -> Vector, Length
unit_z = UnitZ(Factor=Slider(12, range=0..100))
unit_z_2 = UnitZ(Factor=Slider(17, range=0..100))
move = Move(Geometry=[rotate_3.Geometry, rotate.Geometry], Motion=vector_xyz.Vector)  # -> Geometry, Transform
move_2 = Move(Geometry=[rotate_3.Geometry, rotate.Geometry], Motion=vector_xyz_2.Vector)  # -> Geometry, Transform
move_3 = Move(Geometry=[rotate_2.Geometry, rotate_4.Geometry], Motion=vector_xyz_3.Vector)  # -> Geometry, Transform
move_4 = Move(Geometry=[rotate_2.Geometry, rotate_4.Geometry], Motion=vector_xyz_4.Vector)  # -> Geometry, Transform
move_5 = Move(Geometry=reverse([rotate_2.Geometry, rotate_4.Geometry]), Motion=unit_z_2)  # -> Geometry, Transform
move_6 = Move(Geometry=[rotate_3.Geometry, rotate.Geometry], Motion=unit_z)  # -> Geometry, Transform
move_7 = Move(Geometry=move.Geometry, Motion=unit_z)  # -> Geometry, Transform
move_8 = Move(Geometry=move_3.Geometry, Motion=unit_z_2)  # -> Geometry, Transform
reverse_list = ReverseList(List=move_5.Geometry)
reverse_list_2 = ReverseList(List=move_5.Geometry)
line = Line(StartPoint=move_7.Geometry, EndPoint=move_6.Geometry)
line_2 = Line(StartPoint=move_7.Geometry, EndPoint=move.Geometry)
line_3 = Line(StartPoint=[rotate_3.Geometry, rotate.Geometry], EndPoint=move_6.Geometry)
line_4 = Line(StartPoint=reverse_list_2, EndPoint=move_8.Geometry)
line_5 = Line(StartPoint=[rotate_2.Geometry, rotate_4.Geometry], EndPoint=reverse_list)
line_6 = Line(StartPoint=move_8.Geometry, EndPoint=move_3.Geometry)
merge = Merge(Data1=line, Data2=line_4)
merge_2 = Merge(Data1=line_2, Data2=line_3, Data3=line_6, Data4=line_5)
perp_frames = PerpFrames(Curve=merge, Count=Slider(2, range=0..10), Align=True)  # -> Frames, Parameters
rectangle = Rectangle(Plane=perp_frames.Frames, XSize=Slider(2, range=0..10), YSize=Slider(9, range=0..10), Radius=0)  # -> Rectangle, Length

# ---- group: March3rdAirportDuchame002
number_slider_26 = Slider(17, range=0..100)
number_slider_27 = Slider(17, range=0..100)
vector_xyz_5 = VectorXYZ(XComponent=number_slider_26, YComponent=number_slider_26, ZComponent=0)  # -> Vector, Length
vector_xyz_6 = VectorXYZ(XComponent=expr("-x", number_slider_26), YComponent=number_slider_26, ZComponent=0)  # -> Vector, Length
vector_xyz_7 = VectorXYZ(XComponent=expr("-x", number_slider_27), YComponent=number_slider_27, ZComponent=0)  # -> Vector, Length
vector_xyz_8 = VectorXYZ(XComponent=number_slider_27, YComponent=number_slider_27, ZComponent=0)  # -> Vector, Length
unit_z_3 = UnitZ(Factor=Slider(12, range=0..100))
unit_z_4 = UnitZ(Factor=Slider(17, range=0..100))
move_9 = Move(Geometry=[rotate_7.Geometry, rotate_5.Geometry], Motion=vector_xyz_5.Vector)  # -> Geometry, Transform
move_10 = Move(Geometry=[rotate_7.Geometry, rotate_5.Geometry], Motion=vector_xyz_6.Vector)  # -> Geometry, Transform
move_11 = Move(Geometry=[rotate_6.Geometry, rotate_8.Geometry], Motion=vector_xyz_7.Vector)  # -> Geometry, Transform
move_12 = Move(Geometry=[rotate_6.Geometry, rotate_8.Geometry], Motion=vector_xyz_8.Vector)  # -> Geometry, Transform
move_13 = Move(Geometry=reverse([rotate_6.Geometry, rotate_8.Geometry]), Motion=unit_z_4)  # -> Geometry, Transform
move_14 = Move(Geometry=[rotate_7.Geometry, rotate_5.Geometry], Motion=unit_z_3)  # -> Geometry, Transform
move_15 = Move(Geometry=move_9.Geometry, Motion=unit_z_3)  # -> Geometry, Transform
move_16 = Move(Geometry=move_11.Geometry, Motion=unit_z_4)  # -> Geometry, Transform
reverse_list_3 = ReverseList(List=move_13.Geometry)
reverse_list_4 = ReverseList(List=move_13.Geometry)
line_7 = Line(StartPoint=move_15.Geometry, EndPoint=move_14.Geometry)
line_8 = Line(StartPoint=[rotate_7.Geometry, rotate_5.Geometry], EndPoint=move_14.Geometry)
line_9 = Line(StartPoint=reverse_list_4, EndPoint=move_16.Geometry)
line_10 = Line(StartPoint=[rotate_6.Geometry, rotate_8.Geometry], EndPoint=reverse_list_3)
line_11 = Line(StartPoint=move_15.Geometry, EndPoint=move_9.Geometry)
line_12 = Line(StartPoint=move_16.Geometry, EndPoint=move_11.Geometry)
merge_3 = Merge(Data1=line_7, Data2=line_9)
merge_4 = Merge(Data1=line_11, Data2=line_8, Data3=line_12, Data4=line_10)
perp_frames_2 = PerpFrames(Curve=merge_3, Count=Slider(2, range=0..10), Align=True)  # -> Frames, Parameters
rectangle_2 = Rectangle(Plane=perp_frames_2.Frames, XSize=Slider(2, range=0..10), YSize=Slider(9, range=0..10), Radius=0)  # -> Rectangle, Length

# ---- group: March4thAirportDuchame001
number_slider_28 = Slider(17, range=0..100)
number_slider_29 = Slider(17, range=0..100)
vector_xyz_9 = VectorXYZ(XComponent=number_slider_28, YComponent=number_slider_28, ZComponent=0)  # -> Vector, Length
vector_xyz_10 = VectorXYZ(XComponent=expr("-x", number_slider_28), YComponent=number_slider_28, ZComponent=0)  # -> Vector, Length
vector_xyz_11 = VectorXYZ(XComponent=expr("-x", number_slider_29), YComponent=number_slider_29, ZComponent=0)  # -> Vector, Length
vector_xyz_12 = VectorXYZ(XComponent=number_slider_29, YComponent=number_slider_29, ZComponent=0)  # -> Vector, Length
unit_z_5 = UnitZ(Factor=Slider(12, range=0..100))
unit_z_6 = UnitZ(Factor=Slider(17, range=0..100))
move_17 = Move(Geometry=[rotate_11.Geometry, rotate_9.Geometry], Motion=vector_xyz_9.Vector)  # -> Geometry, Transform
move_18 = Move(Geometry=[rotate_11.Geometry, rotate_9.Geometry], Motion=vector_xyz_10.Vector)  # -> Geometry, Transform
move_19 = Move(Geometry=[rotate_10.Geometry, rotate_12.Geometry], Motion=vector_xyz_11.Vector)  # -> Geometry, Transform
move_20 = Move(Geometry=[rotate_10.Geometry, rotate_12.Geometry], Motion=vector_xyz_12.Vector)  # -> Geometry, Transform
move_21 = Move(Geometry=reverse([rotate_10.Geometry, rotate_12.Geometry]), Motion=unit_z_6)  # -> Geometry, Transform
move_22 = Move(Geometry=[rotate_11.Geometry, rotate_9.Geometry], Motion=unit_z_5)  # -> Geometry, Transform
move_23 = Move(Geometry=move_17.Geometry, Motion=unit_z_5)  # -> Geometry, Transform
move_24 = Move(Geometry=move_19.Geometry, Motion=unit_z_6)  # -> Geometry, Transform
reverse_list_5 = ReverseList(List=move_21.Geometry)
reverse_list_6 = ReverseList(List=move_21.Geometry)
line_13 = Line(StartPoint=move_23.Geometry, EndPoint=move_22.Geometry)
line_14 = Line(StartPoint=move_23.Geometry, EndPoint=move_17.Geometry)
line_15 = Line(StartPoint=[rotate_11.Geometry, rotate_9.Geometry], EndPoint=move_22.Geometry)
line_16 = Line(StartPoint=reverse_list_6, EndPoint=move_24.Geometry)
line_17 = Line(StartPoint=[rotate_10.Geometry, rotate_12.Geometry], EndPoint=reverse_list_5)
line_18 = Line(StartPoint=move_24.Geometry, EndPoint=move_19.Geometry)
merge_5 = Merge(Data1=line_13, Data2=line_16)
merge_6 = Merge(Data1=line_14, Data2=line_15, Data3=line_18, Data4=line_17)
perp_frames_3 = PerpFrames(Curve=merge_5, Count=Slider(2, range=0..10), Align=True)  # -> Frames, Parameters
rectangle_3 = Rectangle(Plane=perp_frames_3.Frames, XSize=Slider(2, range=0..10), YSize=Slider(9, range=0..10), Radius=0)  # -> Rectangle, Length

# ---- group: March3rdAirportDuchame002
# The World of Duchame
# 
# Airport
number_slider_30 = Slider(1.68, range=0..10)
md_slider = MDSlider(SliderMode=0, slider_value=Point(0.5, 0.5, 0.5), x_domain=Domain(0, 1), y_domain=Domain(0, 1), z_domain=Domain(0, 1))
number_slider_31 = Slider(2.22, range=0..10)
brep = Brep()
cap_holes = CapHoles(Brep=brep)
deconstruct_brep = DeconstructBrep(Brep=cap_holes)  # -> Faces, Edges, Vertices
list_item_7 = ListItem(List=deconstruct_brep.Faces, Index=Slider(0, range=0..10), Wrap=True)
evaluate_surface = EvaluateSurface(Surface=list_item_7, Point=md_slider)  # -> Point, Normal, UDirection, VDirection, Frame
multiplication_7 = Multiplication(A=evaluate_surface.Normal, B=Slider(20, range=0..100))
extrude = Extrude(Base=list_item_7, Direction=multiplication_7)
number_slider_32 = Slider(5, range=0..10)
deconstruct_brep_2 = DeconstructBrep(Brep=extrude)  # -> Faces, Edges, Vertices
list_item_8 = ListItem(List=deconstruct_brep_2.Vertices, Index=0, Wrap=True)
pi_13 = Pi(Factor=Slider(0.18, range=0..1))
list_item_9 = ListItem(List=deconstruct_brep_2.Faces, Index=number_slider_32, Wrap=True)
rotate_3d = Rotate3D(Geometry=extrude, Angle=expr("-x", pi_13), Center=list_item_8, Axis=Vector(-196.7361301, 171.4839052, 0))  # -> Geometry, Transform
evaluate_surface_2 = EvaluateSurface(Surface=list_item_9, Point=md_slider)  # -> Point, Normal, UDirection, VDirection, Frame
deconstruct_brep_3 = DeconstructBrep(Brep=rotate_3d.Geometry)  # -> Faces, Edges, Vertices
multiplication_8 = Multiplication(A=evaluate_surface_2.Normal, B=Slider(46, range=0..100))
extrude_2 = Extrude(Base=list_item_9, Direction=multiplication_8)
list_item_10 = ListItem(List=deconstruct_brep_3.Faces, Index=number_slider_32, Wrap=True)
multiplication_9 = Multiplication(A=evaluate_surface_2.Normal, B=Slider(90, range=0..100))
deconstruct_brep_4 = DeconstructBrep(Brep=extrude_2)  # -> Faces, Edges, Vertices
pi_14 = Pi(Factor=Slider(0.08, range=0..1))
extrude_3 = Extrude(Base=list_item_10, Direction=multiplication_9)
list_item_11 = ListItem(List=deconstruct_brep_4.Faces, Index=Slider(2, range=0..10), Wrap=True)
evaluate_surface_3 = EvaluateSurface(Surface=list_item_11, Point=md_slider)  # -> Point, Normal, UDirection, VDirection, Frame
rotate_3d_2 = Rotate3D(Geometry=extrude_3, Angle=expr("-x", pi_14), Center=list_item_8, Axis=Vector(-196.7361301, 171.4839052, 0))  # -> Geometry, Transform
multiplication_10 = Multiplication(A=evaluate_surface_3.Normal, B=Slider(100, range=0..100))
extrude_4 = Extrude(Base=list_item_11, Direction=multiplication_10)
deconstruct_brep_5 = DeconstructBrep(Brep=rotate_3d_2.Geometry)  # -> Faces, Edges, Vertices
construct_domain_4 = ConstructDomain(DomainStart=0, DomainEnd=Slider(141, range=0..200))
number_slider_33 = Slider(5, range=0..100)
list_item_12 = ListItem(List=deconstruct_brep_5.Vertices, Index=Slider(6, range=0..10), Wrap=True)
list_item_13 = ListItem(List=deconstruct_brep_5.Edges, Index=Slider(5, range=0..10), Wrap=True)
deconstruct_brep_6 = DeconstructBrep(Brep=extrude_4)  # -> Faces, Edges, Vertices
range_4 = Range(Domain=construct_domain_4, Steps=Slider(4, range=0..10))
list_item_14 = ListItem(List=deconstruct_brep_6.Faces, Index=Slider(4, range=0..10), Wrap=True)
line_sdl = LineSDL(Start=list_item_12, Direction=list_item_13, Length=expr("-x", Slider(56, range=0..100)))
number_slider_34 = Slider(33, range=0..100)
evaluate_surface_4 = EvaluateSurface(Surface=list_item_14, Point=md_slider)  # -> Point, Normal, UDirection, VDirection, Frame
dispatch = Dispatch(List=deconstruct_brep_6.Vertices, DispatchPattern=[True, False])  # -> ListA, ListB
vector_xyz_13 = VectorXYZ(XComponent=range_4, YComponent=range_4, ZComponent=expr("x/3", range_4))  # -> Vector, Length
multiplication_11 = Multiplication(A=evaluate_surface_4.Normal, B=Slider(53, range=0..100))
vector_xyz_14 = VectorXYZ(XComponent=number_slider_34, YComponent=number_slider_34, ZComponent=0)  # -> Vector, Length
move_25 = Move(Geometry=line_sdl, Motion=vector_xyz_13.Vector)  # -> graft(Geometry), Transform
extrude_5 = Extrude(Base=list_item_14, Direction=multiplication_11)
unit_z_7 = UnitZ(Factor=Slider(12, range=0..100))
move_26 = Move(Geometry=move_25.Geometry, Motion=vector_xyz_14.Vector)  # -> Geometry, Transform
move_27 = Move(Geometry=dispatch.ListB, Motion=unit_z_7)  # -> Geometry, Transform
move_28 = Move(Geometry=extrude_5, Motion=unit_z_7)  # -> Geometry, Transform
param_viewer = ParamViewer(move_25.Geometry)
loft = Loft(
    Curves=[move_25.Geometry, move_26.Geometry],
    Options={Adjust=False, Closed=False, LoftEnds=0, LoftSimp=0, LoftType=0, Rebuild=10, Refit=0.01})
line_19 = Line(StartPoint=dispatch.ListB, EndPoint=move_27.Geometry)
deconstruct_brep_7 = DeconstructBrep(Brep=loft)  # -> Faces, Edges, Vertices
unit_z_8 = UnitZ(Factor=Slider(100, range=0..100))
move_29 = Move(Geometry=deconstruct_brep_7.Vertices, Motion=expr("-x", unit_z_8))  # -> Geometry, Transform
extrude_6 = Extrude(Base=loft, Direction=multiplication_11)
deconstruct_brep_8 = DeconstructBrep(Brep=move_28.Geometry)  # -> Faces, Edges, Vertices
line_20 = Line(StartPoint=deconstruct_brep_7.Vertices, EndPoint=move_29.Geometry)
list_item_15 = ListItem(List=deconstruct_brep_8.Edges, Index=Slider(0, range=0..100), Wrap=True)
list_item_16 = ListItem(List=deconstruct_brep_8.Edges, Index=Slider(1, range=0..10), Wrap=True)
pipe = Pipe(Curve=line_20, Radius=number_slider_30, Caps=0)
deconstruct_brep_9 = DeconstructBrep(Brep=extrude_6)  # -> Faces, Edges, Vertices
point_on_curve = PointOnCurve(list_item_15, parameter=0.707)
point_on_curve_2 = PointOnCurve(list_item_15, parameter=0.5)
point_on_curve_3 = PointOnCurve(list_item_16, parameter=0.707)
point_on_curve_4 = PointOnCurve(list_item_16, parameter=0.5)
unit_z_9 = UnitZ(Factor=Slider(12, range=0..100))
list_item_17 = ListItem(List=deconstruct_brep_9.Edges, Index=Slider(0, range=0..100), Wrap=True)
list_item_18 = ListItem(List=deconstruct_brep_9.Edges, Index=Slider(1, range=0..10), Wrap=True)
line_21 = Line(StartPoint=point_on_curve_2, EndPoint=point_on_curve)
unit_z_10 = UnitZ(Factor=Slider(34, range=0..100))
line_22 = Line(StartPoint=point_on_curve_4, EndPoint=point_on_curve_3)
unit_z_11 = UnitZ(Factor=Slider(37, range=0..100))
point_on_curve_5 = PointOnCurve(list_item_17, parameter=0.707)
point_on_curve_6 = PointOnCurve(list_item_17, parameter=0.5)
move_30 = Move(Geometry=line_22, Motion=unit_z_9)  # -> Geometry, Transform
point_on_curve_7 = PointOnCurve(list_item_18, parameter=0.707)
point_on_curve_8 = PointOnCurve(list_item_18, parameter=0.5)
unit_z_12 = UnitZ(Factor=Slider(12, range=0..100))
move_31 = Move(Geometry=line_21, Motion=unit_z_10)  # -> Geometry, Transform
move_32 = Move(Geometry=line_22, Motion=unit_z_11)  # -> Geometry, Transform
line_23 = Line(StartPoint=point_on_curve_6, EndPoint=point_on_curve_5)
unit_z_13 = UnitZ(Factor=Slider(37, range=0..100))
line_24 = Line(StartPoint=point_on_curve_8, EndPoint=point_on_curve_7)
unit_z_14 = UnitZ(Factor=Slider(37, range=0..100))
loft_2 = Loft(
    Curves=[line_21, move_31.Geometry],
    Options={Adjust=False, Closed=False, LoftEnds=0, LoftSimp=0, LoftType=0, Rebuild=10, Refit=0.01})
move_33 = Move(Geometry=line_24, Motion=unit_z_12)  # -> Geometry, Transform
loft_3 = Loft(
    Curves=[move_30.Geometry, move_32.Geometry],
    Options={Adjust=False, Closed=False, LoftEnds=0, LoftSimp=0, LoftType=0, Rebuild=10, Refit=0.01})
move_34 = Move(Geometry=line_23, Motion=unit_z_13)  # -> Geometry, Transform
move_35 = Move(Geometry=line_24, Motion=unit_z_14)  # -> Geometry, Transform
number_slider_35 = Slider(2.68, range=0..10)
solid_difference = SolidDifference(BrepsA=deconstruct_brep_8.Faces, BrepsB=[loft_2, loft_3])
loft_4 = Loft(
    Curves=[line_23, move_34.Geometry],
    Options={Adjust=False, Closed=False, LoftEnds=0, LoftSimp=0, LoftType=0, Rebuild=10, Refit=0.01})
loft_5 = Loft(
    Curves=[move_33.Geometry, move_35.Geometry],
    Options={Adjust=False, Closed=False, LoftEnds=0, LoftSimp=0, LoftType=0, Rebuild=10, Refit=0.01})
number_slider_36 = Slider(2.68, range=0..10)
solid_difference_2 = SolidDifference(BrepsA=deconstruct_brep_9.Faces, BrepsB=[loft_4, loft_5])

# ---- group: March3rdAirportDuchame
loft_6 = Loft(
    Curves=rectangle.Rectangle,
    Options={Adjust=False, Closed=False, LoftEnds=0, LoftSimp=0, LoftType=0, Rebuild=10, Refit=0.01})
pipe_2 = Pipe(Curve=merge_2, Radius=1, Caps=0)

# ---- group: March3rdAirportDuchame002
pipe_3 = Pipe(Curve=merge_4, Radius=number_slider_30, Caps=0)
loft_7 = Loft(
    Curves=rectangle_2.Rectangle,
    Options={Adjust=False, Closed=False, LoftEnds=0, LoftSimp=0, LoftType=0, Rebuild=10, Refit=0.01})  # -> flatten(Loft)

# ---- group: March4thAirportDuchame001
loft_8 = Loft(
    Curves=rectangle_3.Rectangle,
    Options={Adjust=False, Closed=False, LoftEnds=0, LoftSimp=0, LoftType=0, Rebuild=10, Refit=0.01})
pipe_4 = Pipe(Curve=merge_6, Radius=1, Caps=0)

# ---- group: March3rdAirportDuchame004
# East west Docks
number_slider_37 = Slider(0.64, range=0..1)
construct_domain_5 = ConstructDomain(DomainStart=Slider(4, range=0..100), DomainEnd=Slider(8, range=0..100))
range_5 = Range(Domain=construct_domain_5, Steps=Slider(7, range=0..100))
sine_4 = Sine(Value=range_5)
multiplication_12 = Multiplication(A=range_5, B=Slider(20, range=0..100))
multiplication_13 = Multiplication(A=sine_4, B=Slider(9, range=0..100))
construct_point_7 = ConstructPoint(XCoordinate=expr("-x", multiplication_12), YCoordinate=multiplication_13, ZCoordinate=0)
pi_15 = Pi(Factor=number_slider_37)
pi_16 = Pi(Factor=Slider(0.32, range=0..1))
construct_point_8 = ConstructPoint(XCoordinate=multiplication_12, YCoordinate=multiplication_13, ZCoordinate=0)
pi_17 = Pi(Factor=Slider(0.339, range=0..1))
pi_18 = Pi(Factor=Slider(0.593, range=0..1))
list_item_19 = ListItem(List=construct_point_8, Index=0, Wrap=True)
list_item_20 = ListItem(List=construct_point_7, Index=0, Wrap=True)
construct_plane_7 = ConstructPlane(Origin=list_item_20, XAxis=Vector(1, 0, 0), YAxis=Vector(0, 1, 0))
construct_plane_8 = ConstructPlane(Origin=list_item_19, XAxis=Vector(1, 0, 0), YAxis=Vector(0, 1, 0))
rotate_13 = Rotate(Geometry=construct_point_8, Angle=expr("-x", pi_16), Plane=construct_plane_8)  # -> Geometry, Transform
rotate_14 = Rotate(Geometry=construct_point_7, Angle=expr("-x", pi_18), Plane=construct_plane_7)  # -> Geometry, Transform
rotate_15 = Rotate(Geometry=construct_point_8, Angle=pi_15, Plane=construct_plane_8)  # -> Geometry, Transform
rotate_16 = Rotate(Geometry=construct_point_7, Angle=pi_17, Plane=construct_plane_7)  # -> Geometry, Transform

# The World of Duchame
# 
# Airport
number_slider_38 = Slider(3, range=0..100)
number_slider_39 = Slider(12, range=0..100)
number_slider_40 = Slider(2, range=0..10)
construct_point_9 = ConstructPoint(XCoordinate=expr("-x", number_slider_39), YCoordinate=expr("-x", number_slider_38), ZCoordinate=number_slider_40)
construct_point_10 = ConstructPoint(XCoordinate=number_slider_39, YCoordinate=number_slider_38, ZCoordinate=number_slider_40)
line_25 = Line(StartPoint=construct_point_10, EndPoint=construct_point_9)
unit_z_15 = UnitZ(Factor=number_slider_40)
point_on_curve_9 = PointOnCurve(line_25, parameter=0.5)
number_slider_41 = Slider(0.1, range=0..0.1)
move_36 = Move(Geometry=point_on_curve_9, Motion=expr("-x", unit_z_15))  # -> Geometry, Transform
construct_domain_6 = ConstructDomain(DomainStart=number_slider_41, DomainEnd=Slider(1, range=0..1))
arc_3pt = Arc3Pt(PointA=construct_point_10, PointB=move_36.Geometry, PointC=construct_point_9)  # -> Arc, Plane, Radius
number_slider_42 = Slider(1, range=0..1)
range_6 = Range(Domain=construct_domain_6, Steps=10)
construct_domain_7 = ConstructDomain(DomainStart=Slider(1.96, range=0..10), DomainEnd=number_slider_41)
scale = Scale(Geometry=arc_3pt.Arc, Center=point_on_curve_9, Factor=range_6)  # -> flatten(Geometry), Transform
construct_point_11 = ConstructPoint(XCoordinate=Slider(1, range=0..1), YCoordinate=0, ZCoordinate=0)
range_7 = Range(Domain=construct_domain_7, Steps=10)
number_slider_43 = Slider(0, range=0..10)
rotate_3d_3 = Rotate3D(Geometry=scale.Geometry, Angle=range_7, Center=point_on_curve_9, Axis=construct_point_11)  # -> Geometry, Transform
unit_y = UnitY(Factor=1)
move_37 = Move(Geometry=rotate_3d_3.Geometry, Motion=unit_y)  # -> Geometry, Transform
list_item_21 = ListItem(List=move_37.Geometry, Index=expr("x-1", number_slider_43), Wrap=True)
xz_plane = XZPlane(Origin=Point(0, 0, 0))
mirror = Mirror(Geometry=move_37.Geometry, Plane=xz_plane)  # -> Geometry, Transform
list_item_22 = ListItem(List=mirror.Geometry, Index=expr("x-1", number_slider_43), Wrap=True)
loft_9 = Loft(
    Curves=move_37.Geometry,
    Options={Adjust=False, Closed=False, LoftEnds=0, LoftSimp=0, LoftType=0, Rebuild=10, Refit=0.01})
loft_10 = Loft(
    Curves=[list_item_21, list_item_22],
    Options={Adjust=False, Closed=False, LoftEnds=0, LoftSimp=0, LoftType=0, Rebuild=10, Refit=0.01})
loft_11 = Loft(Curves=mirror.Geometry, Options={Adjust=False, Closed=False, LoftEnds=0, LoftSimp=0, LoftType=0, Rebuild=10, Refit=0.01})
unit_z_16 = UnitZ(Factor=1)
extrude_7 = Extrude(Base=[loft_9, loft_11, loft_10], Direction=unit_z_16)
construct_domain_8 = ConstructDomain(DomainStart=0, DomainEnd=Slider(1.53, range=0..10))
range_8 = Range(Domain=construct_domain_8, Steps=Slider(3, range=0..100))
pi_19 = Pi(Factor=Slider(1.9, range=0..10))
polar_array = PolarArray(Geometry=extrude_7, Plane=construct_plane_7, Count=10, Angle=pi_19)  # -> Geometry, Transform
construct_domain_9 = ConstructDomain(DomainStart=Slider(0.23, range=0..1), DomainEnd=Slider(0.56, range=0..1))
flip_matrix = FlipMatrix(Data=polar_array.Geometry)
range_9 = Range(Domain=construct_domain_9, Steps=Slider(1, range=0..10))
scale_2 = Scale(Geometry=flip_matrix, Center=Point(0, 0, 0), Factor=range_8)  # -> graft(Geometry), Transform
pi_20 = Pi(Factor=range_9)
param_viewer_2 = ParamViewer(flip_matrix)
rotate_3d_4 = Rotate3D(Geometry=scale_2.Geometry, Angle=pi_20, Center=Point(0, 0, 0), Axis=Vector(0, 0, 1))  # -> Geometry, Transform
unit_z_17 = UnitZ(Factor=Slider(5, range=0..5))
move_38 = Move(Geometry=rotate_3d_4.Geometry, Motion=unit_z_17)  # -> Geometry, Transform

number_slider_44 = Slider(17, range=0..100)
number_slider_45 = Slider(17, range=0..100)
vector_xyz_15 = VectorXYZ(XComponent=number_slider_44, YComponent=number_slider_44, ZComponent=0)  # -> Vector, Length
vector_xyz_16 = VectorXYZ(XComponent=expr("-x", number_slider_44), YComponent=number_slider_44, ZComponent=0)  # -> Vector, Length
vector_xyz_17 = VectorXYZ(XComponent=expr("-x", number_slider_45), YComponent=number_slider_45, ZComponent=0)  # -> Vector, Length
vector_xyz_18 = VectorXYZ(XComponent=number_slider_45, YComponent=number_slider_45, ZComponent=0)  # -> Vector, Length
unit_z_18 = UnitZ(Factor=Slider(12, range=0..100))
unit_z_19 = UnitZ(Factor=Slider(17, range=0..100))
move_39 = Move(Geometry=[rotate_15.Geometry, rotate_13.Geometry], Motion=vector_xyz_15.Vector)  # -> Geometry, Transform
move_40 = Move(Geometry=[rotate_15.Geometry, rotate_13.Geometry], Motion=vector_xyz_16.Vector)  # -> Geometry, Transform
move_41 = Move(Geometry=[rotate_14.Geometry, rotate_16.Geometry], Motion=vector_xyz_17.Vector)  # -> Geometry, Transform
move_42 = Move(Geometry=[rotate_14.Geometry, rotate_16.Geometry], Motion=vector_xyz_18.Vector)  # -> Geometry, Transform
move_43 = Move(Geometry=reverse([rotate_14.Geometry, rotate_16.Geometry]), Motion=unit_z_19)  # -> Geometry, Transform
move_44 = Move(Geometry=[rotate_15.Geometry, rotate_13.Geometry], Motion=unit_z_18)  # -> Geometry, Transform
move_45 = Move(Geometry=move_39.Geometry, Motion=unit_z_18)  # -> Geometry, Transform
move_46 = Move(Geometry=move_41.Geometry, Motion=unit_z_19)  # -> Geometry, Transform
reverse_list_7 = ReverseList(List=move_43.Geometry)
reverse_list_8 = ReverseList(List=move_43.Geometry)
line_26 = Line(StartPoint=move_45.Geometry, EndPoint=move_44.Geometry)
line_27 = Line(StartPoint=move_45.Geometry, EndPoint=move_39.Geometry)
line_28 = Line(StartPoint=[rotate_15.Geometry, rotate_13.Geometry], EndPoint=move_44.Geometry)
line_29 = Line(StartPoint=reverse_list_8, EndPoint=move_46.Geometry)
line_30 = Line(StartPoint=[rotate_14.Geometry, rotate_16.Geometry], EndPoint=reverse_list_7)
line_31 = Line(StartPoint=move_46.Geometry, EndPoint=move_41.Geometry)
merge_7 = Merge(Data1=line_26, Data2=line_29)
merge_8 = Merge(Data1=line_27, Data2=line_28, Data3=line_31, Data4=line_30)
perp_frames_4 = PerpFrames(Curve=merge_7, Count=Slider(2, range=0..10), Align=True)  # -> Frames, Parameters
rectangle_4 = Rectangle(Plane=perp_frames_4.Frames, XSize=Slider(2, range=0..10), YSize=Slider(9, range=0..10), Radius=0)  # -> Rectangle, Length

# ---- group: March3rdAirportDuchame002
pipe_5 = Pipe(Curve=line_19, Radius=number_slider_31, Caps=0)

# ---- group: March3rdAirportDuchame004
loft_12 = Loft(
    Curves=rectangle_4.Rectangle,
    Options={Adjust=False, Closed=False, LoftEnds=0, LoftSimp=0, LoftType=0, Rebuild=10, Refit=0.01})
pipe_6 = Pipe(Curve=merge_8, Radius=1, Caps=0)

# ---- group: March3rdAirportDuchame002
offset_surface = OffsetSurface(Surface=solid_difference, Distance=expr("-x", number_slider_35), BothSides=False, CreateSolid=True)

offset_surface_2 = OffsetSurface(Surface=solid_difference_2, Distance=expr("-x", number_slider_36), BothSides=False, CreateSolid=True)

# ---- group: March4thAirportDuchame003
construct_domain_10 = ConstructDomain(DomainStart=number_slider, DomainEnd=1)
number_slider_46 = Slider(300, range=0..300)
range_10 = Range(Domain=construct_domain_10, Steps=10)
square = Square(Value=range_10)
multiplication_14 = Multiplication(A=range_10, B=number_slider_2)
construct_domain_11 = ConstructDomain(DomainStart=0, DomainEnd=number_slider_46)
construct_point_12 = ConstructPoint(XCoordinate=square, YCoordinate=0, ZCoordinate=expr("-x", multiplication_14))
construct_domain_12 = ConstructDomain(DomainStart=number_slider_11, DomainEnd=number_slider_10)
range_11 = Range(Domain=construct_domain_11, Steps=number_slider_46)
point = Point(construct_point_12)
interpolate = Interpolate(Vertices=construct_point_12, Degree=3, Periodic=False, KnotStyle=1)  # -> Curve, Length, Domain
move_47 = Move(Geometry=point, Motion=Vector(0, 0, 10))  # -> Geometry, Transform
sine_5 = Sine(Value=range_11)
cosine = Cosine(Value=range_11)
perp_frames_5 = PerpFrames(Curve=interpolate.Curve, Count=Slider(1, range=0..1), Align=True)  # -> Frames, Parameters
construct_plane_9 = ConstructPlane(Origin=point, XAxis=Vector(1, 0, 0), YAxis=Vector(0, 1, 0))
construct_point_13 = ConstructPoint(XCoordinate=sine_5, YCoordinate=cosine, ZCoordinate=range_11)
dispatch_2 = Dispatch(List=perp_frames_5.Frames, DispatchPattern=[True, False])  # -> ListA, ListB
series = Series(Start=0, Step=number_slider_13, Count=expr("x+1", number_slider_12))
range_12 = Range(Domain=construct_domain_12, Steps=number_slider_12)
interpolate_2 = Interpolate(Vertices=construct_point_13, Degree=3, Periodic=False, KnotStyle=1)  # -> Curve, Length, Domain
orient = Orient(Geometry=interpolate_2.Curve, Source=PlaneXY(0, 0, 0), Target=construct_plane_9)  # -> Geometry, Transform
unit_y_2 = UnitY(Factor=series)
construct_domain_13 = ConstructDomain(DomainStart=Slider(0, range=0..100), DomainEnd=Slider(2, range=0..10))
range_13 = Range(Domain=construct_domain_13, Steps=Slider(4, range=0..10))
unit_y_3 = UnitY(Factor=number_slider_18)
pi_21 = Pi(Factor=range_13)  # -> graft(Output)
unit_z_20 = UnitZ(Factor=number_slider_19)
pi_22 = Pi(Factor=number_slider_20)
pipe_7 = Pipe(Curve=orient.Geometry, Radius=Slider(0.6, range=0..10), Caps=0)  # -> flatten(Pipe)
xz_plane_2 = XZPlane(Origin=Point(0, 0, 0))
rotate_3d_5 = Rotate3D(Geometry=pipe_7, Angle=pi_21, Center=point, Axis=Vector(0, 0, 1))  # -> Geometry, Transform

point_on_curve_10 = PointOnCurve(interpolate.Curve, parameter=0.352)
number_slider_47 = Slider(0.54, range=0..2)

series_2 = Series(Start=0, Step=number_slider_47, Count=expr("x+1", number_slider_12))
scale_3 = Scale(Geometry=interpolate.Curve, Center=point_on_curve_10, Factor=range_12)  # -> flatten(Geometry), Transform
unit_z_21 = UnitZ(Factor=series_2)  # -> expr("x^2", UnitVector)
move_48 = Move(Geometry=scale_3.Geometry, Motion=unit_y_2)  # -> Geometry, Transform
move_49 = Move(Geometry=move_48.Geometry, Motion=unit_z_21)  # -> graft(Geometry), Transform
point_on_curve_11 = PointOnCurve(move_49.Geometry, parameter=0.5)
extrude_8 = Extrude(Base=move_49.Geometry, Direction=unit_y_3)
perp_frames_6 = PerpFrames(Curve=move_49.Geometry, Count=Slider(2, range=0..10), Align=True)  # -> Frames, Parameters
list_item_23 = ListItem(List=perp_frames_6.Frames, Index=Slider(1, range=0..1), Wrap=True)
extrude_9 = Extrude(Base=extrude_8, Direction=unit_z_20)

rotate_17 = Rotate(Geometry=extrude_9, Angle=expr("-x", pi_22), Plane=list_item_23)  # -> Geometry, Transform
mirror_2 = Mirror(Geometry=rotate_17.Geometry, Plane=xz_plane_2)  # -> Geometry, Transform

# ---- group: March4thAirportDuchame002
construct_domain_14 = ConstructDomain(DomainStart=number_slider_3, DomainEnd=1)
range_14 = Range(Domain=construct_domain_14, Steps=10)
square_2 = Square(Value=range_14)
multiplication_15 = Multiplication(A=range_14, B=number_slider_4)
construct_point_14 = ConstructPoint(XCoordinate=square_2, YCoordinate=0, ZCoordinate=expr("-x", multiplication_15))
construct_domain_15 = ConstructDomain(DomainStart=number_slider_15, DomainEnd=number_slider_14)
interpolate_3 = Interpolate(Vertices=construct_point_14, Degree=3, Periodic=False, KnotStyle=1)  # -> Curve, Length, Domain
perp_frames_7 = PerpFrames(Curve=interpolate_3.Curve, Count=Slider(1, range=0..1), Align=True)  # -> Frames, Parameters
dispatch_3 = Dispatch(List=perp_frames_7.Frames, DispatchPattern=[True, False])  # -> ListA, ListB
series_3 = Series(Start=0, Step=number_slider_17, Count=expr("x+1", number_slider_16))
range_15 = Range(Domain=construct_domain_15, Steps=number_slider_16)
unit_y_4 = UnitY(Factor=series_3)
unit_y_5 = UnitY(Factor=number_slider_21)
unit_z_22 = UnitZ(Factor=number_slider_22)
pi_23 = Pi(Factor=number_slider_23)
xz_plane_3 = XZPlane(Origin=Point(0, 0, 0))

point_on_curve_12 = PointOnCurve(interpolate_3.Curve, parameter=0.602)
number_slider_48 = Slider(0.46, range=0..2)

series_4 = Series(Start=0, Step=number_slider_48, Count=expr("x+1", number_slider_16))
scale_4 = Scale(Geometry=interpolate_3.Curve, Center=point_on_curve_12, Factor=range_15)  # -> flatten(Geometry), Transform
unit_z_23 = UnitZ(Factor=series_4)  # -> expr("x^2", UnitVector)
move_50 = Move(Geometry=scale_4.Geometry, Motion=unit_y_4)  # -> Geometry, Transform
move_51 = Move(Geometry=move_50.Geometry, Motion=unit_z_23)  # -> graft(Geometry), Transform
point_on_curve_13 = PointOnCurve(move_51.Geometry, parameter=0.5)
extrude_10 = Extrude(Base=move_51.Geometry, Direction=unit_y_5)
perp_frames_8 = PerpFrames(Curve=move_51.Geometry, Count=Slider(2, range=0..10), Align=True)  # -> Frames, Parameters
list_item_24 = ListItem(List=perp_frames_8.Frames, Index=Slider(1, range=0..1), Wrap=True)
extrude_11 = Extrude(Base=extrude_10, Direction=unit_z_22)

rotate_18 = Rotate(Geometry=extrude_11, Angle=expr("-x", pi_23), Plane=list_item_24)  # -> Geometry, Transform
mirror_3 = Mirror(Geometry=rotate_18.Geometry, Plane=xz_plane_3)  # -> Geometry, Transform
