# Grasshopper definition WorldOfDuchameAxiomCastle002.gh (Grasshopper 1.0.7)
# Copyright: Wickerson Studios
# plug-ins: Bifocals

# Wickerson Studio
# created by: Michael Wickerson
# Grasshopper for Rhino 3D Algorithmic Modeling
# www.wickersonstudios.com
# www.michaelwickerson.com
# https://www.youtube.com/channel/UC7J48Ppcsa6oncp6d29R0xw
# https://github.com/mwickerson
# https://www.facebook.com/michael.wickerson
# https://www.linkedin.com/in/michael-wickerson-696a80156/
# Place: Axiom
# Location 52-25
# Flag:
# Good/Ill: G
# Race/Class: Men/Any
# Leader: Smequel Vance
# Class/Rank: King
image_sampler = ImageSampler(
    FilePath="C:\Users\Sculpture\Documents\2020Grasshopper\ScreenShots2019\Screenshots2020\SurfaceEditAlgorithm.PNG",
    Filter="Value",
    Interpolate=False,
    Umax=1,
    Umin=0,
    Vmax=1,
    Vmin=0,
    Wrap=1)

# ----
# Optional Gene Pool
# for Dispatch Pattern
gene_pool = GenePool(Decimals=0, Maximum=1, Minimum=0, Value=[0, 1, 0.3456139091, 0.2262482751, 1, 1, 0, 0, 1, 0])

# ----
# Bake me in to RHINO!
# Parameters to Play with!
uv_point_count = Slider(93, range=0..500)
negative = Negative(Value=uv_point_count)
height_map = Slider(1.69, range=0..2)
construct_domain = ConstructDomain(DomainStart=negative, DomainEnd=uv_point_count)
rectangle = Rectangle(Plane=PlaneXY(0, 0, 0), XSize=construct_domain, YSize=construct_domain, Radius=0)  # -> Rectangle, Length
divide_surface = DivideSurface(Surface=rectangle.Rectangle, UCount=uv_point_count, VCount=uv_point_count)  # -> flatten(Points), Normals, Parameters
dispatch = Dispatch(List=divide_surface.Points, DispatchPattern=gene_pool)  # -> ListA, ListB
construct_domain_2 = ConstructDomain(DomainStart=height_map, DomainEnd=Slider(12, range=0..100))
surface_from_points = SurfaceFromPoints(Points=divide_surface.Points, UCount=expr("x+1", uv_point_count), Interpolate=False)
list_length = ListLength(List=dispatch.ListA)  # -> flatten(Length)

rectangle_2 = Rectangle(Plane=PlaneXY(0, 0, 0), XSize=uv_point_count, YSize=uv_point_count, Radius=0)  # -> Rectangle, Length
circle = Circle(Plane=PlaneXY(0, 0, 0), Radius=uv_point_count)
populate_2d = Populate2D(Region=rectangle_2.Rectangle, Count=Slider(75, range=0..100), Seed=1)
boundary_surfaces = BoundarySurfaces(Edges=circle)
project_point = ProjectPoint(Point=populate_2d, Direction=Vector(0, 0, -1), Geometry=boundary_surfaces)  # -> Point, Index
cull_pattern = CullPattern(List=project_point.Point, CullPattern=gene_pool)
clean_tree = CleanTree(RemoveNulls=True, RemoveInvalid=True, RemoveEmpty=False, Tree=cull_pattern)

expression = Expression(x=list_length, Expression="x-1")
panel = Panel(cull_pattern)

range = Range(Domain=construct_domain_2, Steps=expression)
unit_z = UnitZ(Factor=range)

jitter = Jitter(List=unit_z, Jitter=1, Seed=2)  # -> Values, Indices

point_deform = PointDeform(Geometry=surface_from_points, Points=dispatch.ListA, Motion=jitter.Values)
scale = Scale(Geometry=point_deform, Center=Point(0, 0, 0), Factor=Slider(1.25, range=0..2))  # -> Geometry, Transform

number_slider = Slider(8.51, range=0..10)
unit_z_2 = UnitZ(Factor=1)
project_point_2 = ProjectPoint(Point=clean_tree, Direction=unit_z_2, Geometry=scale.Geometry)  # -> Point, Index

construct_domain_3 = ConstructDomain(DomainStart=Slider(1.37, range=0..10), DomainEnd=number_slider)
construct_domain_4 = ConstructDomain(DomainStart=Slider(1, range=0..10), DomainEnd=Slider(2, range=0..10))
construct_domain_5 = ConstructDomain(DomainStart=0, DomainEnd=Slider(1.14, range=0..2))
list_length_2 = ListLength(List=project_point_2.Point)
list_length_3 = ListLength(List=project_point_2.Point)
expression_2 = Expression(x=list_length_2, Expression="x-1")
expression_3 = Expression(x=list_length_3, Expression="x-1")
range_2 = Range(Domain=construct_domain_4, Steps=expression_3)
range_3 = Range(Domain=construct_domain_3, Steps=expression_2)

multiplication = Multiplication(A=number_slider, B=range_2)
rectangle_3 = Rectangle(Plane=project_point_2.Point, XSize=range_3, YSize=range_3, Radius=0)  # -> Rectangle, Length
center_box = CenterBox(Base=project_point_2.Point, X=number_slider, Y=number_slider, Z=multiplication)  # disabled
box_rectangle = BoxRectangle(Rectangle=rectangle_3.Rectangle, Height=multiplication)
volume = Volume(Geometry=box_rectangle)  # -> Volume, Centroid

list_length_4 = ListLength(List=box_rectangle)
expression_4 = Expression(x=list_length_4, Expression="x-1")
range_4 = Range(Domain=construct_domain_5, Steps=expression_4)
pi = Pi(Factor=range_4)

rotate_3d = Rotate3D(Geometry=box_rectangle, Angle=pi, Center=volume.Centroid, Axis=Vector(0, 0, 1))  # -> Geometry, Transform
