# Grasshopper definition WorldOfDuchameAxiomCastle004.gh (Grasshopper 1.0.7)
# Copyright: Wickerson Studios
# plug-ins: Bifocals

# Wickerson Studio
# created by: Michael Wickerson
# Grasshopper for Rhino 3D Algorithmic Modeling
# www.wickersonstudios.com
# www.michaelwickerson.com
# https://www.youtube.com/channel/UC7J48Ppcsa6oncp6d29R0xw
# https://github.com/mwickerson
# https://www.facebook.com/michael.wickerson
# https://www.linkedin.com/in/michael-wickerson-696a80156/
# Place: Axiom
# Location 52-25
# Flag:
# Good/Ill: G
# Race/Class: Men/Any
# Leader: Smequel Vance
# Class/Rank: King
image_sampler = ImageSampler(
    FilePath="C:\Users\Sculpture\Documents\2020Grasshopper\ScreenShots2019\Screenshots2020\SurfaceEditAlgorithm.PNG",
    Filter="Value",
    Interpolate=False,
    Umax=1,
    Umin=0,
    Vmax=1,
    Vmin=0,
    Wrap=1)

construct_domain = ConstructDomain(DomainStart=0, DomainEnd=Slider(79, range=0..100))
polygon = Polygon(Plane=PlaneXY(0, 0, 0), Radius=Slider(12, range=0..100), Segments=Slider(5, range=2..12), FilletRadius=0)  # -> Polygon, Length
range = Range(Domain=construct_domain, Steps=10)
unit_x = UnitX(Factor=range)
move = Move(Geometry=polygon.Polygon, Motion=unit_x)  # -> Geometry, Transform
construct_domain_2 = ConstructDomain(DomainStart=0, DomainEnd=Slider(2, range=0..2))
list_length = ListLength(List=move.Geometry)
expression = Expression(x=list_length, Expression="x-1")
range_2 = Range(Domain=construct_domain_2, Steps=expression)
pi = Pi(Factor=range_2)
polar_array = PolarArray(Geometry=move.Geometry, Plane=PlaneXY(0, 0, 0), Count=10, Angle=pi)  # -> Geometry, Transform
polygon_2 = Polygon(Plane=PlaneXY(0, 0, 0), Radius=Slider(66, range=0..100), Segments=Slider(5, range=2..12), FilletRadius=0)  # -> Polygon, Length
region_intersection = RegionIntersection(CurvesA=polar_array.Geometry, CurvesB=polygon_2.Polygon)
region_difference = RegionDifference(CurvesA=polar_array.Geometry, CurvesB=polygon_2.Polygon)
region_union = RegionUnion(Curves=polar_array.Geometry)

curve = Curve(region_difference)

# ----
# Optional Gene Pool
# for Dispatch Pattern
gene_pool = GenePool(Decimals=0, Maximum=1, Minimum=0, Value=[0, 1, 0.3456139091, 0.2262482751, 1, 1, 0, 0, 1, 0])

# ----
# Bake me in to RHINO!
# Parameters to Play with!
uv_point_count = Slider(93, range=0..500)
negative = Negative(Value=uv_point_count)
number_slider = Slider(15.91, range=0..100)
height_map = Slider(1.69, range=0..2)
construct_domain_3 = ConstructDomain(DomainStart=negative, DomainEnd=uv_point_count)
rectangle = Rectangle(Plane=PlaneXY(0, 0, 0), XSize=construct_domain_3, YSize=construct_domain_3, Radius=0)  # -> Rectangle, Length
divide_surface = DivideSurface(Surface=rectangle.Rectangle, UCount=uv_point_count, VCount=uv_point_count)  # -> flatten(Points), Normals, Parameters
dispatch = Dispatch(List=divide_surface.Points, DispatchPattern=gene_pool)  # -> ListA, ListB
construct_domain_4 = ConstructDomain(DomainStart=height_map, DomainEnd=number_slider)
surface_from_points = SurfaceFromPoints(Points=divide_surface.Points, UCount=expr("x+1", uv_point_count), Interpolate=False)
list_length_2 = ListLength(List=dispatch.ListA)  # -> flatten(Length)

circle = Circle(Plane=PlaneXY(0, 0, 0), Radius=uv_point_count)
rectangle_2 = Rectangle(Plane=PlaneXY(0, 0, 0), XSize=uv_point_count, YSize=uv_point_count, Radius=0)  # -> Rectangle, Length
populate_2d = Populate2D(Region=rectangle_2.Rectangle, Count=Slider(75, range=0..100), Seed=1)
boundary_surfaces = BoundarySurfaces(Edges=curve)
project_point = ProjectPoint(Point=populate_2d, Direction=Vector(0, 0, -1), Geometry=boundary_surfaces)  # -> Point, Index
cull_pattern = CullPattern(List=project_point.Point, CullPattern=gene_pool)
clean_tree = CleanTree(RemoveNulls=True, RemoveInvalid=True, RemoveEmpty=False, Tree=cull_pattern)

expression_2 = Expression(x=list_length_2, Expression="x-1")

offset_curve = OffsetCurve(Curve=curve, Distance=number_slider, Plane=PlaneXY(0, 0, 0), Corners=1)
multiplication = Multiplication(A=Slider(12, range=0..100), B=Slider(2.52, range=0..10))
curve_2 = Curve(curve)
merge = Merge(Data1=curve_2, Data2=offset_curve)
unit_z = UnitZ(Factor=multiplication)
extrude = Extrude(Base=merge, Direction=unit_z)
cap_holes = CapHoles(Brep=extrude)  # -> flatten(Brep)
dispatch_2 = Dispatch(List=cap_holes, DispatchPattern=[True, False])  # -> ListA, ListB

solid_difference = SolidDifference(BrepsA=dispatch_2.ListA, BrepsB=dispatch_2.ListB)

range_3 = Range(Domain=construct_domain_4, Steps=expression_2)
unit_z_2 = UnitZ(Factor=range_3)

jitter = Jitter(List=unit_z_2, Jitter=1, Seed=2)  # -> Values, Indices

point_deform = PointDeform(Geometry=surface_from_points, Points=dispatch.ListA, Motion=jitter.Values)
scale = Scale(Geometry=point_deform, Center=Point(0, 0, 0), Factor=Slider(4, range=0..4))  # -> Geometry, Transform

number_slider_2 = Slider(10, range=0..10)
unit_z_3 = UnitZ(Factor=1)
project_point_2 = ProjectPoint(Point=clean_tree, Direction=unit_z_3, Geometry=scale.Geometry)  # -> Point, Index

construct_domain_5 = ConstructDomain(DomainStart=Slider(1.37, range=0..10), DomainEnd=number_slider_2)
construct_domain_6 = ConstructDomain(DomainStart=Slider(1, range=0..10), DomainEnd=Slider(9, range=0..10))
construct_domain_7 = ConstructDomain(DomainStart=0, DomainEnd=Slider(2, range=0..2))
list_length_3 = ListLength(List=project_point_2.Point)
list_length_4 = ListLength(List=project_point_2.Point)
expression_3 = Expression(x=list_length_3, Expression="x-1")
expression_4 = Expression(x=list_length_4, Expression="x-1")
range_4 = Range(Domain=construct_domain_6, Steps=expression_4)
range_5 = Range(Domain=construct_domain_5, Steps=expression_3)

multiplication_2 = Multiplication(A=number_slider_2, B=range_4)
rectangle_3 = Rectangle(Plane=project_point_2.Point, XSize=range_5, YSize=range_5, Radius=0)  # -> Rectangle, Length
center_box = CenterBox(Base=project_point_2.Point, X=number_slider_2, Y=number_slider_2, Z=multiplication_2)
box_rectangle = BoxRectangle(Rectangle=rectangle_3.Rectangle, Height=multiplication_2)
volume = Volume(Geometry=box_rectangle)  # -> Volume, Centroid

list_length_5 = ListLength(List=box_rectangle)
expression_5 = Expression(x=list_length_5, Expression="x-1")
range_6 = Range(Domain=construct_domain_7, Steps=expression_5)
pi_2 = Pi(Factor=range_6)

rotate_3d = Rotate3D(Geometry=box_rectangle, Angle=pi_2, Center=volume.Centroid, Axis=Vector(0, 0, 1))  # -> Geometry, Transform
