# Grasshopper definition WorldOfDuchameAxiomCastle007Flag.gh (Grasshopper 1.0.7)
# Copyright: Wickerson Studios
# plug-ins: Bifocals

number_slider = Slider(147, range=0..300)  # disabled
number_slider_2 = Slider(3, range=2..12)  # disabled
number_slider_3 = Slider(8, range=2..12)  # disabled
number_slider_4 = Slider(20, range=0..100)  # disabled
number_slider_5 = Slider(113, range=0..200)  # disabled
construct_domain = ConstructDomain(DomainStart=0, DomainEnd=number_slider)  # disabled
polygon = Polygon(Plane=PlaneXY(0, 0, 0), Radius=number_slider_4, Segments=number_slider_2, FilletRadius=0)  # -> Polygon, Length; disabled
range = Range(Domain=construct_domain, Steps=10)  # disabled
number_slider_6 = Slider(1.52, range=0..2)  # disabled
unit_x = UnitX(Factor=range)  # disabled
move = Move(Geometry=polygon.Polygon, Motion=unit_x)  # -> Geometry, Transform; disabled
construct_domain_2 = ConstructDomain(DomainStart=0, DomainEnd=number_slider_6)  # disabled
list_length = ListLength(List=move.Geometry)  # disabled
expression = Expression(x=list_length, Expression="x-1")  # disabled
range_2 = Range(Domain=construct_domain_2, Steps=expression)  # disabled
pi = Pi(Factor=range_2)  # disabled
polar_array = PolarArray(Geometry=move.Geometry, Plane=PlaneXY(0, 0, 0), Count=10, Angle=pi)  # -> Geometry, Transform; disabled
polygon_2 = Polygon(Plane=PlaneXY(0, 0, 0), Radius=number_slider_5, Segments=number_slider_3, FilletRadius=0)  # -> Polygon, Length; disabled
region_difference = RegionDifference(CurvesA=polar_array.Geometry, CurvesB=polygon_2.Polygon)  # disabled
region_intersection = RegionIntersection(CurvesA=polar_array.Geometry, CurvesB=polygon_2.Polygon)  # disabled
region_union = RegionUnion(Curves=polar_array.Geometry)  # disabled

# ----
# Wickerson Studio
# created by: Michael Wickerson
# Grasshopper for Rhino 3D Algorithmic Modeling
# www.wickersonstudios.com
# www.michaelwickerson.com
# https://www.youtube.com/channel/UC7J48Ppcsa6oncp6d29R0xw
# https://github.com/mwickerson
# https://www.facebook.com/michael.wickerson
# https://www.linkedin.com/in/michael-wickerson-696a80156/
# Place: Axiom
# Location 52-25
# Flag:
# Good/Ill: G
# Race/Class: Men/Any
# Leader: Smequel Vance
# Class/Rank: King
image_sampler = ImageSampler(
    FilePath="C:\Users\Sculpture\Documents\2020Grasshopper\ScreenShots2019\Screenshots2020\SurfaceEditAlgorithm.PNG",
    Filter="Value",
    Interpolate=False,
    Umax=1,
    Umin=0,
    Vmax=1,
    Vmin=0,
    Wrap=1)
curve = Curve(region_difference)  # disabled

# ----
# Optional Gene Pool
# for Dispatch Pattern
gene_pool = GenePool(Decimals=0, Maximum=1, Minimum=0, Value=[0, 1, 0.3456139091, 0.2262482751, 1, 1, 0, 0, 1, 0])  # disabled

# ----
# Bake me in to RHINO!
# Parameters to Play with!
uv_point_count = Slider(93, range=0..500)  # disabled
negative = Negative(Value=uv_point_count)  # disabled
number_slider_7 = Slider(10.31, range=0..100)  # disabled
height_map = Slider(1.69, range=0..2)  # disabled
construct_domain_3 = ConstructDomain(DomainStart=negative, DomainEnd=uv_point_count)  # disabled
rectangle = Rectangle(Plane=PlaneXY(0, 0, 0), XSize=construct_domain_3, YSize=construct_domain_3, Radius=0)  # -> Rectangle, Length; disabled
divide_surface = DivideSurface(Surface=rectangle.Rectangle, UCount=uv_point_count, VCount=uv_point_count)  # -> flatten(Points), Normals, Parameters; disabled
dispatch = Dispatch(List=divide_surface.Points, DispatchPattern=gene_pool)  # -> ListA, ListB; disabled
construct_domain_4 = ConstructDomain(DomainStart=height_map, DomainEnd=number_slider_7)  # disabled
surface_from_points = SurfaceFromPoints(Points=divide_surface.Points, UCount=expr("x+1", uv_point_count), Interpolate=False)  # disabled
list_length_2 = ListLength(List=dispatch.ListA)  # -> flatten(Length); disabled
expression_2 = Expression(x=list_length_2, Expression="x-1")  # disabled
range_3 = Range(Domain=construct_domain_4, Steps=expression_2)  # disabled
unit_z = UnitZ(Factor=range_3)  # disabled
number_slider_8 = Slider(4, range=0..4)  # disabled
jitter = Jitter(List=unit_z, Jitter=1, Seed=2)  # -> Values, Indices; disabled
point_deform = PointDeform(Geometry=surface_from_points, Points=dispatch.ListA, Motion=jitter.Values)  # disabled
scale = Scale(Geometry=point_deform, Center=Point(0, 0, 0), Factor=number_slider_8)  # -> Geometry, Transform; disabled

curve_2 = Curve(curve)  # disabled
number_slider_9 = Slider(5.69, range=0..10)  # disabled
number_slider_10 = Slider(12, range=0..100)  # disabled
offset_curve = OffsetCurve(Curve=curve, Distance=number_slider_7, Plane=PlaneXY(0, 0, 0), Corners=1)  # disabled
multiplication = Multiplication(A=number_slider_10, B=number_slider_9)  # disabled
merge = Merge(Data1=curve_2, Data2=offset_curve)  # disabled
unit_z_2 = UnitZ(Factor=multiplication)  # disabled
extrude = Extrude(Base=merge, Direction=unit_z_2)  # disabled
cap_holes = CapHoles(Brep=extrude)  # -> flatten(Brep); disabled
dispatch_2 = Dispatch(List=cap_holes, DispatchPattern=[True, False])  # -> ListA, ListB; disabled

solid_difference = SolidDifference(BrepsA=dispatch_2.ListA, BrepsB=dispatch_2.ListB)  # disabled

number_slider_11 = Slider(15, range=0..100)
construct_domain_5 = ConstructDomain(DomainStart=0, DomainEnd=expr("x/2", number_slider_11))
construct_domain_6 = ConstructDomain(DomainStart=0, DomainEnd=number_slider_11)
rectangle_2 = Rectangle(Plane=PlaneXY(0, 0, 0), XSize=construct_domain_6, YSize=construct_domain_5, Radius=0)  # -> Rectangle, Length
unit_y = UnitY(Factor=expr("x/5", number_slider_11))
area = Area(Geometry=rectangle_2.Rectangle)  # -> Area, Centroid
negative_2 = Negative(Value=unit_y)
move_2 = Move(Geometry=area.Centroid, Motion=[negative_2, unit_y])  # -> Geometry, Transform
dispatch_3 = Dispatch(List=move_2.Geometry, DispatchPattern=[True, False])  # -> ListA, ListB
line = Line(StartPoint=dispatch_3.ListA, EndPoint=dispatch_3.ListB)
unit_x_2 = UnitX(Factor=expr("x/10", number_slider_11))
scale_2 = Scale(Geometry=line, Center=area.Centroid, Factor=Slider(0.26, range=0..1))  # -> Geometry, Transform
negative_3 = Negative(Value=unit_x_2)
move_3 = Move(Geometry=scale_2.Geometry, Motion=[unit_x_2, negative_3])  # -> Geometry, Transform
number_slider_12 = Slider(0.2, range=0..1)

unit_y_2 = UnitY(Factor=expr("x/7", number_slider_11))
negative_4 = Negative(Value=unit_y_2)
move_4 = Move(Geometry=area.Centroid, Motion=[unit_y_2, negative_4])  # -> Geometry, Transform
dispatch_4 = Dispatch(List=move_4.Geometry, DispatchPattern=[True, False])  # -> ListA, ListB
unit_x_3 = UnitX(Factor=expr("x/2", dispatch_4.ListA))
unit_x_4 = UnitX(Factor=1)
negative_5 = Negative(Value=unit_x_3)
point = Point(dispatch_4.ListB)
move_5 = Move(Geometry=dispatch_4.ListB, Motion=negative_5)  # -> Geometry, Transform
move_6 = Move(Geometry=move_5.Geometry, Motion=expr("x/2", unit_x_4))  # -> Geometry, Transform
dispatch_5 = Dispatch(List=move_3.Geometry, DispatchPattern=[True, False])  # -> ListA, ListB
move_7 = Move(Geometry=dispatch_4.ListA, Motion=unit_x_3)  # -> Geometry, Transform
end_points = EndPoints(Curve=dispatch_5.ListB)  # -> Start, End
end_points_2 = EndPoints(Curve=dispatch_5.ListA)  # -> Start, End
line_2 = Line(StartPoint=move_6.Geometry, EndPoint=move_5.Geometry)
arc_3pt = Arc3Pt(PointA=end_points_2.End, PointB=end_points.End, PointC=move_6.Geometry)  # -> Arc, Plane, Radius
arc_3pt_2 = Arc3Pt(PointA=move_7.Geometry, PointB=end_points_2.End, PointC=point)  # -> Arc, Plane, Radius
arc_3pt_3 = Arc3Pt(PointA=move_5.Geometry, PointB=dispatch_4.ListA, PointC=move_7.Geometry)  # -> Arc, Plane, Radius
merge_2 = Merge(Data1=arc_3pt_3.Arc, Data2=arc_3pt_2.Arc, Data3=arc_3pt.Arc, Data4=line_2)
join_curves = JoinCurves(Curves=merge_2, Preserve=False)
unit_z_3 = UnitZ(Factor=number_slider_12)
boundary_surfaces = BoundarySurfaces(Edges=join_curves)
extrude_2 = Extrude(Base=boundary_surfaces, Direction=unit_z_3)

point_on_curve = PointOnCurve(arc_3pt.Arc, parameter=0.75)
point_on_curve_2 = PointOnCurve(arc_3pt_3.Arc, parameter=0.19)
number_slider_13 = Slider(3, range=0..10)
line_3 = Line(StartPoint=point_on_curve_2, EndPoint=point_on_curve)
scale_3 = Scale(Geometry=line_3, Center=[point_on_curve_2, point_on_curve], Factor=number_slider_13)  # -> graft(Geometry), Transform
unit_z_4 = UnitZ(Factor=1)
curve_middle = CurveMiddle(Curve=line)
join_curves_2 = JoinCurves(Curves=scale_3.Geometry, Preserve=False)  # -> flatten(Curves)
construct_plane = ConstructPlane(Origin=curve_middle, XAxis=unit_z_4, YAxis=Vector(0, 1, 0))
dispatch_6 = Dispatch(List=join_curves_2, DispatchPattern=[True, False])  # -> ListA, ListB
mirror = Mirror(Geometry=dispatch_6.ListA, Plane=construct_plane)  # -> Geometry, Transform
curve_middle_2 = CurveMiddle(Curve=mirror.Geometry)
scale_4 = Scale(Geometry=mirror.Geometry, Center=curve_middle_2, Factor=number_slider_13)  # -> Geometry, Transform
vector_2pt = Vector2Pt(PointA=curve_middle_2, PointB=end_points_2.End, Unitize=False)  # -> Vector, Length
amplitude = Amplitude(Vector=vector_2pt.Vector, Amplitude=Slider(0.435, range=0..1))
amplitude_2 = Amplitude(Vector=vector_2pt.Vector, Amplitude=Slider(0.942, range=0..1))
move_8 = Move(Geometry=curve_middle_2, Motion=amplitude_2)  # -> graft(Geometry), Transform
end_points_3 = EndPoints(Curve=scale_4.Geometry)  # -> Start, End
end_points_4 = EndPoints(Curve=scale_4.Geometry)  # -> Start, End
move_9 = Move(Geometry=curve_middle_2, Motion=amplitude)  # -> Geometry, Transform
arc_3pt_4 = Arc3Pt(PointA=end_points_3.Start, PointB=move_8.Geometry, PointC=end_points_3.End)  # -> Arc, Plane, Radius
arc_3pt_5 = Arc3Pt(PointA=end_points_4.Start, PointB=move_9.Geometry, PointC=end_points_4.End)  # -> Arc, Plane, Radius

merge_3 = Merge(
    Data1=line,
    Data2=rectangle_2.Rectangle,
    Data3=move_3.Geometry,
    Data4=join_curves_2,
    Data5=arc_3pt_5.Arc,
    Data6=arc_3pt_4.Arc)
pipe = Pipe(Curve=merge_3, Radius=number_slider_12, Caps=2)
