# Grasshopper definition WorldOfDuchameAxiomyCamp001.gh (Grasshopper 1.0.7)
# Copyright: Wickerson Studios
# plug-ins: Bifocals

# ----
# Finiale
# Orient Pt
number_slider = Slider(8, range=0..100)
# Place: Axiomy
# Location 42-62
# Flag:
# Good/Ill: I
# Race/Class: Men/Orcs
# Leader: Feymix Keyton/Sugeal
# Class/Rank: Lord/Cheif
construct_point = ConstructPoint(XCoordinate=0, YCoordinate=0, ZCoordinate=0)
polygon = Polygon(Plane=PlaneXY(0, 0, 0), Radius=number_slider, Segments=Slider(3, range=0..10), FilletRadius=0)  # -> Polygon, Length
point = Point(construct_point)
unit_z = UnitZ(Factor=Slider(18, range=0..100))
explode = Explode(Curve=polygon.Polygon, Recursive=True)  # -> Segments, flatten(Vertices)
move = Move(Geometry=point, Motion=unit_z)  # -> Geometry, Transform
cull_index = CullIndex(List=explode.Vertices, Indices="-1", Wrap=True)
line = Line(StartPoint=move.Geometry, EndPoint=cull_index)
panel = Panel(cull_index)
point_on_curve = PointOnCurve(line, parameter=0.726)
line_2 = Line(StartPoint=point_on_curve, EndPoint=point)
point_on_curve_2 = PointOnCurve(line_2, parameter=0.172)
arc_3pt = Arc3Pt(PointA=move.Geometry, PointB=point_on_curve_2, PointC=cull_index)  # -> flatten(Arc), Plane, Radius
loft_options = LoftOptions(Closed=Toggle(True), Adjust=False, Rebuild=0, Refit=0, Type=0)
shift_list = ShiftList(List=arc_3pt.Arc, Shift=1, Wrap=True)
loft = Loft(Curves=[arc_3pt.Arc, shift_list], Options=loft_options)
finiale = CapHoles(Brep=loft)
point_2 = Point(point)

# ----
# Wickerson Studio
# created by: Michael Wickerson
# Grasshopper for Rhino 3D Algorithmic Modeling
# www.wickersonstudios.com
# www.michaelwickerson.com
# https://www.youtube.com/channel/UC7J48Ppcsa6oncp6d29R0xw
# https://github.com/mwickerson
# https://www.facebook.com/michael.wickerson
# https://www.linkedin.com/in/michael-wickerson-696a80156/
image_sampler = ImageSampler(
    FilePath="C:\Users\Sculpture\Documents\2020Grasshopper\ScreenShots2019\Screenshots2020\SurfaceEditAlgorithm.PNG",
    Filter="Value",
    Interpolate=False,
    Umax=1,
    Umin=0,
    Vmax=1,
    Vmin=0,
    Wrap=1)

unit_z_2 = UnitZ(Factor=Slider(72, range=0..100))
point_3 = Point(point)
move_2 = Move(Geometry=point_3, Motion=unit_z_2)  # -> Geometry, Transform
mirror = Mirror(Geometry=finiale, Plane=point_2)  # -> Geometry, Transform
line_3 = Line(StartPoint=point_3, EndPoint=move_2.Geometry)

# ----
# Mirrorred Finial
brep_join = BrepJoin(Breps=[mirror.Geometry, finiale])  # -> flatten(Breps), Closed

list_item = ListItem(List=brep_join.Breps, Index=0, Wrap=True)  # -> Item, Item1, Item2, Item3
geometry = Geometry([list_item.Item1, list_item.Item])
panel_2 = Panel(brep_join.Breps)
solid_union = SolidUnion(Breps=geometry)

number_slider_2 = Slider(6, range=0..100)
perp_frames = PerpFrames(Curve=line_3, Count=Slider(3, range=0..10), Align=True)  # -> Frames, Parameters
multiplication = Multiplication(A=Slider(3, range=0..100), B=Slider(28, range=0..100))
xz_plane = XZPlane(Origin=Point(0, 0, 0))
orient = Orient(Geometry=solid_union, Source=PlaneXY(0, 0, 0), Target=perp_frames.Frames)  # -> Geometry, Transform
pipe = Pipe(Curve=line_3, Radius=Slider(1.458, range=0..10), Caps=0)
rectangular = Rectangular(Plane=xz_plane, SizeX=multiplication, SizeY=multiplication, ExtentX=number_slider_2, ExtentY=number_slider_2)  # -> Cells, Points
solid_union_2 = SolidUnion(Breps=[pipe, orient.Geometry])
construct_plane = ConstructPlane(Origin=rectangular.Points, XAxis=Vector(1, 0, 0), YAxis=Vector(0, 1, 0))
orient_2 = Orient(Geometry=solid_union_2, Source=PlaneXY(0, 0, 0), Target=construct_plane)  # -> Geometry, Transform
unit_y = UnitY(Factor=1)
volume = Volume(Geometry=orient_2.Geometry)  # -> Volume, Centroid
rotate_3d = Rotate3D(Geometry=orient_2.Geometry, Angle=1.570796327, Center=volume.Centroid, Axis=unit_y)  # -> Geometry, Transform

# ----
# Gate Section
solid_union_3 = SolidUnion(Breps=[orient_2.Geometry, rotate_3d.Geometry])
