# Grasshopper definition WorldOfDuchameAxiomyCamp002.gh (Grasshopper 1.0.7)
# Copyright: Wickerson Studios
# plug-ins: Bifocals

# ----
# Finiale
# Orient Pt
number_slider = Slider(8, range=0..100)  # disabled
number_slider_2 = Slider(3, range=0..10)  # disabled
number_slider_3 = Slider(18, range=0..100)  # disabled
# Place: Axiomy
# Location 42-62
# Flag:
# Good/Ill: I
# Race/Class: Men/Orcs
# Leader: Feymix Keyton/Sugeal
# Class/Rank: Lord/Cheif
construct_point = ConstructPoint(XCoordinate=0, YCoordinate=0, ZCoordinate=0)  # disabled
polygon = Polygon(Plane=PlaneXY(0, 0, 0), Radius=number_slider, Segments=number_slider_2, FilletRadius=0)  # -> Polygon, Length; disabled
point = Point(construct_point)  # disabled
unit_z = UnitZ(Factor=number_slider_3)  # disabled
explode = Explode(Curve=polygon.Polygon, Recursive=True)  # -> Segments, flatten(Vertices); disabled
move = Move(Geometry=point, Motion=unit_z)  # -> Geometry, Transform; disabled
panel = Panel("-1")  # disabled
cull_index = CullIndex(List=explode.Vertices, Indices=panel, Wrap=True)  # disabled
line = Line(StartPoint=move.Geometry, EndPoint=cull_index)  # disabled
panel_2 = Panel(cull_index)  # disabled
point_on_curve = PointOnCurve(line, parameter=0.726)  # disabled
line_2 = Line(StartPoint=point_on_curve, EndPoint=point)  # disabled
point_on_curve_2 = PointOnCurve(line_2, parameter=0.172)  # disabled
boolean_toggle = BooleanToggle(True)  # disabled
arc_3pt = Arc3Pt(PointA=move.Geometry, PointB=point_on_curve_2, PointC=cull_index)  # -> flatten(Arc), Plane, Radius; disabled
loft_options = LoftOptions(Closed=boolean_toggle, Adjust=False, Rebuild=0, Refit=0, Type=0)  # disabled
shift_list = ShiftList(List=arc_3pt.Arc, Shift=1, Wrap=True)  # disabled
loft = Loft(Curves=[arc_3pt.Arc, shift_list], Options=loft_options)  # disabled
finiale = CapHoles(Brep=loft)  # disabled
point_2 = Point(point)  # disabled

# ----
# Wickerson Studio
# created by: Michael Wickerson
# Grasshopper for Rhino 3D Algorithmic Modeling
# www.wickersonstudios.com
# www.michaelwickerson.com
# https://www.youtube.com/channel/UC7J48Ppcsa6oncp6d29R0xw
# https://github.com/mwickerson
# https://www.facebook.com/michael.wickerson
# https://www.linkedin.com/in/michael-wickerson-696a80156/
image_sampler = ImageSampler(
    FilePath="C:\Users\Sculpture\Documents\2020Grasshopper\ScreenShots2019\Screenshots2020\SurfaceEditAlgorithm.PNG",
    Filter="Value",
    Interpolate=False,
    Umax=1,
    Umin=0,
    Vmax=1,
    Vmin=0,
    Wrap=1)

number_slider_4 = Slider(-10, range=-10..10)
md_slider = MDSlider(
    SliderMode=0,
    slider_value=Point(0.1483628808, 0.7956557855, 0.5),
    x_domain=Domain(0, 1),
    y_domain=Domain(0, 1),
    z_domain=Domain(0, 1))
md_slider_2 = MDSlider(
    SliderMode=0,
    slider_value=Point(0.9403286445, 0.2734226134, 0.5),
    x_domain=Domain(0, 1),
    y_domain=Domain(0, 1),
    z_domain=Domain(0, 1))
md_slider_3 = MDSlider(
    SliderMode=0,
    slider_value=Point(0.5099117, 0.4628013053, 0.5),
    x_domain=Domain(0, 1),
    y_domain=Domain(0, 1),
    z_domain=Domain(0, 1))

number_slider_5 = Slider(50, range=0..50)
surface = Surface(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)
dimensions = Dimensions(Surface=surface)  # -> UDimension, VDimension
division = Division(A=dimensions.UDimension, B=dimensions.VDimension)
multiplication = Multiplication(A=division, B=number_slider_5)

area = Area(Geometry=surface)  # -> Area, Centroid
integer = Integer(multiplication)
scale = Scale(Geometry=surface, Center=area.Centroid, Factor=Slider(2.12, range=0..5))  # -> Geometry, Transform
expression = Expression(x=integer, Expression="x+1")
evaluate_surface = EvaluateSurface(Surface=reparameterize(scale.Geometry), Point=[md_slider, md_slider_3, md_slider_2])  # -> Point, Normal, UDirection, VDirection, Frame

divide_surface = DivideSurface(Surface=surface, UCount=integer, VCount=number_slider_5)  # -> flatten(Points), Normals, Parameters

distance = Distance(PointA=graft(evaluate_surface.Point), PointB=divide_surface.Points)
expression_2 = Expression(
    w=graft([Slider(1.363, range=0..2), Slider(0.051, range=0..2), Slider(0.11, range=0..2)]),
    t=distance,
    Expression="sin(w*t)^2")
multiplication_2 = Multiplication(A=Slider(3.62, range=0..20), B=expression_2)
unit_z_2 = UnitZ(Factor=multiplication_2)
move_2 = Move(Geometry=divide_surface.Points, Motion=unit_z_2)  # -> Geometry, Transform
surface_from_points = SurfaceFromPoints(Points=move_2.Geometry, UCount=expression, Interpolate=False)

flip_matrix = FlipMatrix(Data=expression_2)
mass_multiplication = MassMultiplication(Input=flip_matrix)  # -> flatten(Result), PartialResults
mass_addition = MassAddition(Input=flip_matrix)  # -> flatten(Result), PartialResults

number_slider_6 = Slider(72, range=0..100)  # disabled
unit_z_3 = UnitZ(Factor=number_slider_6)  # disabled
point_3 = Point(point)  # disabled
move_3 = Move(Geometry=point_3, Motion=unit_z_3)  # -> Geometry, Transform; disabled
mirror = Mirror(Geometry=finiale, Plane=point_2)  # -> Geometry, Transform; disabled
line_3 = Line(StartPoint=point_3, EndPoint=move_3.Geometry)  # disabled

# ----
# Mirrorred Finial
brep_join = BrepJoin(Breps=[mirror.Geometry, finiale])  # -> flatten(Breps), Closed; disabled

list_item = ListItem(List=brep_join.Breps, Index=0, Wrap=True)  # -> Item, Item1, Item2, Item3; disabled
geometry = Geometry([list_item.Item1, list_item.Item])  # disabled
panel_3 = Panel(brep_join.Breps)  # disabled
solid_union = SolidUnion(Breps=geometry)  # disabled

number_slider_7 = Slider(3, range=0..10)  # disabled
number_slider_8 = Slider(3, range=0..100)  # disabled
number_slider_9 = Slider(28, range=0..100)  # disabled
number_slider_10 = Slider(6, range=0..100)  # disabled
perp_frames = PerpFrames(Curve=line_3, Count=number_slider_7, Align=True)  # -> Frames, Parameters; disabled
number_slider_11 = Slider(1.458, range=0..10)  # disabled
multiplication_3 = Multiplication(A=number_slider_8, B=number_slider_9)  # disabled
xz_plane = XZPlane(Origin=Point(0, 0, 0))  # disabled
orient = Orient(Geometry=solid_union, Source=PlaneXY(0, 0, 0), Target=perp_frames.Frames)  # -> Geometry, Transform; disabled
pipe = Pipe(Curve=line_3, Radius=number_slider_11, Caps=0)  # disabled
rectangular = Rectangular(Plane=xz_plane, SizeX=multiplication_3, SizeY=multiplication_3, ExtentX=number_slider_10, ExtentY=number_slider_10)  # -> Cells, Points; disabled
solid_union_2 = SolidUnion(Breps=[pipe, orient.Geometry])  # disabled
construct_plane = ConstructPlane(Origin=rectangular.Points, XAxis=Vector(1, 0, 0), YAxis=Vector(0, 1, 0))  # disabled
orient_2 = Orient(Geometry=solid_union_2, Source=PlaneXY(0, 0, 0), Target=construct_plane)  # -> Geometry, Transform; disabled
unit_y = UnitY(Factor=1)  # disabled
volume = Volume(Geometry=orient_2.Geometry)  # -> Volume, Centroid; disabled
rotate_3d = Rotate3D(Geometry=orient_2.Geometry, Angle=1.570796327, Center=volume.Centroid, Axis=unit_y)  # -> Geometry, Transform; disabled

# ----
# Gate Section
solid_union_3 = SolidUnion(Breps=[orient_2.Geometry, rotate_3d.Geometry])  # disabled
