# Grasshopper definition WorldOfDuchameAxiomyCamp003BarthPortCity001.gh (Grasshopper 1.0.7)
# Copyright: Wickerson Studios
# plug-ins: Bifocals

# ----
# Finiale
# Orient Pt
number_slider = Slider(8, range=0..100)  # disabled
number_slider_2 = Slider(3, range=0..10)  # disabled
number_slider_3 = Slider(18, range=0..100)  # disabled
# Place: Axiomy
# Location 42-62
# Flag:
# Good/Ill: I
# Race/Class: Men/Orcs
# Leader: Feymix Keyton/Sugeal
# Class/Rank: Lord/Cheif
construct_point = ConstructPoint(XCoordinate=0, YCoordinate=0, ZCoordinate=0)  # disabled
polygon = Polygon(Plane=PlaneXY(0, 0, 0), Radius=number_slider, Segments=number_slider_2, FilletRadius=0)  # -> Polygon, Length; disabled
point = Point(construct_point)  # disabled
unit_z = UnitZ(Factor=number_slider_3)  # disabled
explode = Explode(Curve=polygon.Polygon, Recursive=True)  # -> Segments, flatten(Vertices); disabled
move = Move(Geometry=point, Motion=unit_z)  # -> Geometry, Transform; disabled
panel = Panel("-1")  # disabled
cull_index = CullIndex(List=explode.Vertices, Indices=panel, Wrap=True)  # disabled
line = Line(StartPoint=move.Geometry, EndPoint=cull_index)  # disabled
panel_2 = Panel(cull_index)  # disabled
point_on_curve = PointOnCurve(line, parameter=0.726)  # disabled
line_2 = Line(StartPoint=point_on_curve, EndPoint=point)  # disabled
point_on_curve_2 = PointOnCurve(line_2, parameter=0.172)  # disabled
boolean_toggle = BooleanToggle(True)  # disabled
arc_3pt = Arc3Pt(PointA=move.Geometry, PointB=point_on_curve_2, PointC=cull_index)  # -> flatten(Arc), Plane, Radius; disabled
loft_options = LoftOptions(Closed=boolean_toggle, Adjust=False, Rebuild=0, Refit=0, Type=0)  # disabled
shift_list = ShiftList(List=arc_3pt.Arc, Shift=1, Wrap=True)  # disabled
loft = Loft(Curves=[arc_3pt.Arc, shift_list], Options=loft_options)  # disabled
finiale = CapHoles(Brep=loft)  # disabled
point_2 = Point(point)  # disabled

# ---- group: WorldOfDuchameAkaWalls003
# Place: Aka
# Location 24-75
# Flag:
# Good/Ill: IG
# Race/Class: any
# Leader: none
# Class/Rank: rebel/bandit/monster
image_sampler = ImageSampler(
    FilePath="C:\Users\Sculpture\Documents\2020Grasshopper\ScreenShots2019\Screenshots2020\SurfaceEditAlgorithm.PNG",
    Filter="Value",
    Interpolate=False,
    Umax=1,
    Umin=0,
    Vmax=1,
    Vmin=0,
    Wrap=1)

number_slider_4 = Slider(8, range=0..10)
plane = Plane(PlaneXY(0, 0, 0))
construct_domain = ConstructDomain(DomainStart=Slider(15.3, range=3..24), DomainEnd=Slider(9, range=3..12))
construct_domain_2 = ConstructDomain(DomainStart=Slider(3, range=3..24), DomainEnd=Slider(74, range=3..74))
expression = Expression(x=number_slider_4, Expression="x-1")
polygon_2 = Polygon(Plane=plane, Radius=Slider(79.191, range=0..100), Segments=Slider(8, range=0..10), FilletRadius=0)  # -> Polygon, Length
range = Range(Domain=construct_domain, Steps=expression)
range_2 = Range(Domain=construct_domain_2, Steps=expression)
divide_curve = DivideCurve(Curve=polygon_2.Polygon, Count=number_slider_4, Kinks=False)  # -> Points, Tangents, Parameters
polygon_3 = Polygon(Plane=plane, Radius=range_2, Segments=range, FilletRadius=0)  # -> Polygon, Length
jitter = Jitter(List=divide_curve.Points, Jitter=1, Seed=2)  # -> Values, Indices
orient = Orient(Geometry=polygon_3.Polygon, Source=PlaneXY(0, 0, 0), Target=jitter.Values)  # -> Geometry, Transform
curve = Curve(polygon_2.Polygon)
curve_2 = Curve(orient.Geometry)
trim_with_regions = TrimWithRegions(Curve=curve_2, Regions=curve)  # -> Inside, Outside
curve_3 = Curve(trim_with_regions.Outside)
construct_point_2 = ConstructPoint(XCoordinate=0, YCoordinate=0, ZCoordinate=0)
explode_2 = Explode(Curve=curve_3, Recursive=True)  # -> graft(Segments), Vertices
vector_2pt = Vector2Pt(PointA=explode_2.Vertices, PointB=construct_point_2, Unitize=False)  # -> Vector, Length
number_slider_5 = Slider(51.01, range=0..100)
amplitude = Amplitude(Vector=vector_2pt.Vector, Amplitude=Slider(10.47, range=0..100))
move_2 = Move(Geometry=graft(explode_2.Segments), Motion=amplitude)  # -> Geometry, Transform
construct_domain_3 = ConstructDomain(DomainStart=Slider(3.5, range=0..100), DomainEnd=number_slider_5)
list_length = ListLength(List=move_2.Geometry)
range_3 = Range(Domain=construct_domain_3, Steps=expr("x-1", list_length))  # -> graft(Range)
loft_2 = Loft(
    Curves=[explode_2.Segments, move_2.Geometry],
    Options={Adjust=False, Closed=False, LoftEnds=0, LoftSimp=0, LoftType=0, Rebuild=10, Refit=0.01})
unit_z_2 = UnitZ(Factor=range_3)
extrude = Extrude(Base=loft_2, Direction=unit_z_2)

# ----
# Wickerson Studio
# created by: Michael Wickerson
# Grasshopper for Rhino 3D Algorithmic Modeling
# www.wickersonstudios.com
# www.michaelwickerson.com
# https://www.youtube.com/channel/UC7J48Ppcsa6oncp6d29R0xw
# https://github.com/mwickerson
# https://www.facebook.com/michael.wickerson
# https://www.linkedin.com/in/michael-wickerson-696a80156/
image_sampler_2 = ImageSampler(
    FilePath="C:\Users\Sculpture\Documents\2020Grasshopper\ScreenShots2019\Screenshots2020\SurfaceEditAlgorithm.PNG",
    Filter="Value",
    Interpolate=False,
    Umax=1,
    Umin=0,
    Vmax=1,
    Vmin=0,
    Wrap=1)

# ---- group: WorldOfDuchameAkaWalls003
number_slider_6 = Slider(12, range=0..100)  # disabled
construct_domain_4 = ConstructDomain(DomainStart=0, DomainEnd=expr("x/2", number_slider_6))  # disabled
construct_domain_5 = ConstructDomain(DomainStart=0, DomainEnd=number_slider_6)  # disabled
rectangle = Rectangle(Plane=PlaneXY(0, 0, 0), XSize=construct_domain_5, YSize=construct_domain_4, Radius=0)  # -> Rectangle, Length; disabled
area = Area(Geometry=rectangle.Rectangle)  # -> Area, Centroid; disabled
deconstruct_brep = DeconstructBrep(Brep=rectangle.Rectangle)  # -> Faces, Edges, Vertices; disabled
list_item = ListItem(List=deconstruct_brep.Vertices, Index=0, Wrap=True)  # -> Item, Item1, Item2, Item3; disabled
panel_3 = Panel(deconstruct_brep.Vertices)  # disabled
line_3 = Line(StartPoint=area.Centroid, EndPoint=[list_item.Item, list_item.Item1, list_item.Item3])  # disabled
number_slider_7 = Slider(0.302, range=0..1)  # disabled
merge = Merge(Data1=line_3, Data2=rectangle.Rectangle)  # disabled
pipe = Pipe(Curve=merge, Radius=number_slider_7, Caps=0)  # disabled

dispatch = Dispatch(List=polygon_3.Polygon, DispatchPattern=[True, False])  # -> ListA, ListB
curve_4 = Curve(dispatch.ListB)
number_slider_8 = Slider(6, range=0..100)
boundary_surfaces = BoundarySurfaces(Edges=curve_4)
md_slider = MDSlider(
    SliderMode=0,
    slider_value=Point(0.3450012207, 0.2796504323, 0.5),
    x_domain=Domain(0, 1),
    y_domain=Domain(0, 1),
    z_domain=Domain(0, 1))
divide_surface = DivideSurface(Surface=reparameterize(boundary_surfaces), UCount=number_slider_8, VCount=number_slider_8)  # -> flatten(Points), Normals, Parameters
deconstruct_brep_2 = DeconstructBrep(Brep=boundary_surfaces)  # -> Faces, Edges, Vertices
evaluate_surface = EvaluateSurface(Surface=reparameterize(boundary_surfaces), Point=md_slider)  # -> Point, Normal, UDirection, VDirection, Frame
list_item_2 = ListItem(List=deconstruct_brep_2.Vertices, Index=0, Wrap=True)  # -> Item, Item1, Item2, Item3
_4point_surface = _4PointSurface(CornerA=list_item_2.Item, CornerB=evaluate_surface.Point, CornerC=evaluate_surface.Point, CornerD=list_item_2.Item3)
area_2 = Area(Geometry=boundary_surfaces)  # -> Area, Centroid
scale = Scale(Geometry=_4point_surface, Center=area_2.Centroid, Factor=Slider(0.4, range=0..10))  # -> Geometry, Transform
project_point = ProjectPoint(Point=divide_surface.Points, Direction=evaluate_surface.Normal, Geometry=scale.Geometry)  # -> Point, Index
number_slider_9 = Slider(4, range=3..10)
mesh_sphere = MeshSphere(Base=project_point.Point, Radius=expr("x*2", Slider(5.37, range=0..10)), UCount=number_slider_9, VCount=number_slider_9)

curve_5 = Curve(trim_with_regions.Inside)
offset_curve = OffsetCurve(Curve=curve_5, Distance=Slider(2, range=0..2), Plane=PlaneXY(0, 0, 0), Corners=1)
end_points = EndPoints(Curve=offset_curve)  # -> Start, End
end_points_2 = EndPoints(Curve=curve_5)  # -> Start, End
number_slider_10 = Slider(10, range=0..10)
line_4 = Line(StartPoint=end_points.Start, EndPoint=end_points.End)
line_5 = Line(StartPoint=end_points_2.Start, EndPoint=end_points_2.End)
offset_curve_2 = OffsetCurve(Curve=line_5, Distance=number_slider_10, Plane=PlaneXY(0, 0, 0), Corners=1)  # -> graft(Curve)
offset_curve_3 = OffsetCurve(Curve=line_4, Distance=number_slider_10, Plane=PlaneXY(0, 0, 0), Corners=1)
loft_3 = Loft(
    Curves=[offset_curve_2, offset_curve_3],
    Options={Adjust=False, Closed=False, LoftEnds=0, LoftSimp=0, LoftType=0, Rebuild=10, Refit=0.01})
unit_z_3 = UnitZ(Factor=expr("x-x*.75", number_slider_5))
extrude_2 = Extrude(Base=loft_3, Direction=unit_z_3)

md_slider_2 = MDSlider(SliderMode=0, slider_value=Point(0, 0, 0.5), x_domain=Domain(0, 1), y_domain=Domain(0, 1), z_domain=Domain(0, 1))
evaluate_surface_2 = EvaluateSurface(Surface=reparameterize(boundary_surfaces), Point=md_slider_2)  # -> Point, Normal, UDirection, VDirection, Frame
_4point_surface_2 = _4PointSurface(CornerA=list_item_2.Item, CornerB=evaluate_surface_2.Point, CornerC=evaluate_surface_2.Point, CornerD=list_item_2.Item3)
area_3 = Area(Geometry=boundary_surfaces)  # -> Area, Centroid
scale_2 = Scale(Geometry=_4point_surface_2, Center=area_3.Centroid, Factor=Slider(2.6, range=0..10))  # -> Geometry, Transform
project_point_2 = ProjectPoint(Point=divide_surface.Points, Direction=evaluate_surface.Normal, Geometry=scale_2.Geometry)  # -> Point, Index
number_slider_11 = Slider(3, range=3..10)
mesh_sphere_2 = MeshSphere(
    Base=project_point_2.Point,
    Radius=expr("x*2", Slider(3.49, range=0..10)),
    UCount=number_slider_11,
    VCount=number_slider_11)

# ----
number_slider_12 = Slider(-10, range=-10..10)
md_slider_3 = MDSlider(
    SliderMode=0,
    slider_value=Point(0.1483628808, 0.7956557855, 0.5),
    x_domain=Domain(0, 1),
    y_domain=Domain(0, 1),
    z_domain=Domain(0, 1))
md_slider_4 = MDSlider(
    SliderMode=0,
    slider_value=Point(0.9403286445, 0.2734226134, 0.5),
    x_domain=Domain(0, 1),
    y_domain=Domain(0, 1),
    z_domain=Domain(0, 1))
md_slider_5 = MDSlider(
    SliderMode=0,
    slider_value=Point(0.5099117, 0.4628013053, 0.5),
    x_domain=Domain(0, 1),
    y_domain=Domain(0, 1),
    z_domain=Domain(0, 1))

number_slider_13 = Slider(50, range=0..50)
surface = Surface(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)
dimensions = Dimensions(Surface=surface)  # -> UDimension, VDimension
division = Division(A=dimensions.UDimension, B=dimensions.VDimension)
multiplication = Multiplication(A=division, B=number_slider_13)

area_4 = Area(Geometry=surface)  # -> Area, Centroid
integer = Integer(multiplication)
scale_3 = Scale(Geometry=surface, Center=area_4.Centroid, Factor=Slider(2.12, range=0..5))  # -> Geometry, Transform
expression_2 = Expression(x=integer, Expression="x+1")
evaluate_surface_3 = EvaluateSurface(Surface=reparameterize(scale_3.Geometry), Point=[md_slider_3, md_slider_5, md_slider_4])  # -> Point, Normal, UDirection, VDirection, Frame

divide_surface_2 = DivideSurface(Surface=surface, UCount=integer, VCount=number_slider_13)  # -> flatten(Points), Normals, Parameters

distance = Distance(PointA=graft(evaluate_surface_3.Point), PointB=divide_surface_2.Points)
expression_3 = Expression(
    w=graft([Slider(1.363, range=0..2), Slider(0.051, range=0..2), Slider(0.11, range=0..2)]),
    t=distance,
    Expression="sin(w*t)^2")
multiplication_2 = Multiplication(A=Slider(3.62, range=0..20), B=expression_3)
unit_z_4 = UnitZ(Factor=multiplication_2)
move_3 = Move(Geometry=divide_surface_2.Points, Motion=unit_z_4)  # -> Geometry, Transform
surface_from_points = SurfaceFromPoints(Points=move_3.Geometry, UCount=expression_2, Interpolate=False)

flip_matrix = FlipMatrix(Data=expression_3)
mass_multiplication = MassMultiplication(Input=flip_matrix)  # -> flatten(Result), PartialResults
mass_addition = MassAddition(Input=flip_matrix)  # -> flatten(Result), PartialResults

# ---- group: WorldOfDuchameAkaWalls003
number_slider_14 = Slider(-10, range=-10..10)
md_slider_6 = MDSlider(
    SliderMode=0,
    slider_value=Point(0.1483628808, 0.7956557855, 0.5),
    x_domain=Domain(0, 1),
    y_domain=Domain(0, 1),
    z_domain=Domain(0, 1))
md_slider_7 = MDSlider(
    SliderMode=0,
    slider_value=Point(0.9403286445, 0.2734226134, 0.5),
    x_domain=Domain(0, 1),
    y_domain=Domain(0, 1),
    z_domain=Domain(0, 1))
md_slider_8 = MDSlider(
    SliderMode=0,
    slider_value=Point(0, 0.02408506812, 0.5),
    x_domain=Domain(0, 1),
    y_domain=Domain(0, 1),
    z_domain=Domain(0, 1))

number_slider_15 = Slider(50, range=0..50)
surface_2 = Surface(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)
dimensions_2 = Dimensions(Surface=surface_2)  # -> UDimension, VDimension
division_2 = Division(A=dimensions_2.UDimension, B=dimensions_2.VDimension)
multiplication_3 = Multiplication(A=division_2, B=number_slider_15)

area_5 = Area(Geometry=surface_2)  # -> Area, Centroid
integer_2 = Integer(multiplication_3)
scale_4 = Scale(Geometry=surface_2, Center=area_5.Centroid, Factor=Slider(2.12, range=0..5))  # -> Geometry, Transform
expression_4 = Expression(x=integer_2, Expression="x+1")
evaluate_surface_4 = EvaluateSurface(Surface=reparameterize(scale_4.Geometry), Point=[md_slider_6, md_slider_8, md_slider_7])  # -> Point, Normal, UDirection, VDirection, Frame

divide_surface_3 = DivideSurface(Surface=surface_2, UCount=integer_2, VCount=number_slider_15)  # -> flatten(Points), Normals, Parameters

distance_2 = Distance(PointA=graft(evaluate_surface_4.Point), PointB=divide_surface_3.Points)
expression_5 = Expression(
    w=graft([Slider(1.363, range=0..2), Slider(0.051, range=0..2), Slider(0.11, range=0..2)]),
    t=distance_2,
    Expression="sin(w*t)^2")
multiplication_4 = Multiplication(A=Slider(3.62, range=0..20), B=expression_5)
unit_z_5 = UnitZ(Factor=multiplication_4)
move_4 = Move(Geometry=divide_surface_3.Points, Motion=unit_z_5)  # -> Geometry, Transform
surface_from_points_2 = SurfaceFromPoints(Points=move_4.Geometry, UCount=expression_4, Interpolate=False)

flip_matrix_2 = FlipMatrix(Data=expression_5)
mass_multiplication_2 = MassMultiplication(Input=flip_matrix_2)  # -> flatten(Result), PartialResults
mass_addition_2 = MassAddition(Input=flip_matrix_2)  # -> flatten(Result), PartialResults

# ----
number_slider_16 = Slider(72, range=0..100)  # disabled
unit_z_6 = UnitZ(Factor=number_slider_16)  # disabled
point_3 = Point(point)  # disabled
move_5 = Move(Geometry=point_3, Motion=unit_z_6)  # -> Geometry, Transform; disabled
mirror = Mirror(Geometry=finiale, Plane=point_2)  # -> Geometry, Transform; disabled
line_6 = Line(StartPoint=point_3, EndPoint=move_5.Geometry)  # disabled

# ----
# Mirrorred Finial
brep_join = BrepJoin(Breps=[mirror.Geometry, finiale])  # -> flatten(Breps), Closed; disabled

list_item_3 = ListItem(List=brep_join.Breps, Index=0, Wrap=True)  # -> Item, Item1, Item2, Item3; disabled
geometry = Geometry([list_item_3.Item1, list_item_3.Item])  # disabled
panel_4 = Panel(brep_join.Breps)  # disabled
solid_union = SolidUnion(Breps=geometry)  # disabled

number_slider_17 = Slider(3, range=0..10)  # disabled
number_slider_18 = Slider(3, range=0..100)  # disabled
number_slider_19 = Slider(28, range=0..100)  # disabled
number_slider_20 = Slider(6, range=0..100)  # disabled
perp_frames = PerpFrames(Curve=line_6, Count=number_slider_17, Align=True)  # -> Frames, Parameters; disabled
number_slider_21 = Slider(1.458, range=0..10)  # disabled
multiplication_5 = Multiplication(A=number_slider_18, B=number_slider_19)  # disabled
xz_plane = XZPlane(Origin=Point(0, 0, 0))  # disabled
orient_2 = Orient(Geometry=solid_union, Source=PlaneXY(0, 0, 0), Target=perp_frames.Frames)  # -> Geometry, Transform; disabled
pipe_2 = Pipe(Curve=line_6, Radius=number_slider_21, Caps=0)  # disabled
rectangular = Rectangular(Plane=xz_plane, SizeX=multiplication_5, SizeY=multiplication_5, ExtentX=number_slider_20, ExtentY=number_slider_20)  # -> Cells, Points; disabled
solid_union_2 = SolidUnion(Breps=[pipe_2, orient_2.Geometry])  # disabled
construct_plane = ConstructPlane(Origin=rectangular.Points, XAxis=Vector(1, 0, 0), YAxis=Vector(0, 1, 0))  # disabled
orient_3 = Orient(Geometry=solid_union_2, Source=PlaneXY(0, 0, 0), Target=construct_plane)  # -> Geometry, Transform; disabled
unit_y = UnitY(Factor=1)  # disabled
volume = Volume(Geometry=orient_3.Geometry)  # -> Volume, Centroid; disabled
rotate_3d = Rotate3D(Geometry=orient_3.Geometry, Angle=1.570796327, Center=volume.Centroid, Axis=unit_y)  # -> Geometry, Transform; disabled

# ----
# Gate Section
solid_union_3 = SolidUnion(Breps=[orient_3.Geometry, rotate_3d.Geometry])  # disabled
