# Grasshopper definition WorldOfDuchameBarthPortCity002.gh (Grasshopper 1.0.7)
# Copyright: Wickerson Studios
# plug-ins: Anemone, Bifocals

# Place: Barth
# Location 42-62-24
# Flag:
# Good/Ill: G
# Race/Class: Men/Any
# Leader: Feymix Keyton/Sugealurkstein
# Class/Rank: King
# Wickerson Studio
# created by: Michael Wickerson
# Grasshopper for Rhino 3D Algorithmic Modeling
# www.wickersonstudios.com
# www.michaelwickerson.com
# https://www.youtube.com/channel/UC7J48Ppcsa6oncp6d29R0xw
# https://github.com/mwickerson
# https://www.facebook.com/michael.wickerson
# https://www.linkedin.com/in/michael-wickerson-696a80156/
image_sampler = ImageSampler(
    FilePath="C:\Users\Sculpture\Documents\2020Grasshopper\ScreenShots2019\Screenshots2020\SurfaceEditAlgorithm.PNG",
    Filter="Value",
    Interpolate=False,
    Umax=1,
    Umin=0,
    Vmax=1,
    Vmin=0,
    Wrap=1)
number_slider = Slider(34.79, range=0..110)
unit_y = UnitY(Factor=1)
unit_z = UnitZ(Factor=1)
line_sdl = LineSDL(Start=Point(0, 0, 0), Direction=unit_z, Length=number_slider)
loop_start = LoopStart(
    Repeat=Slider(3, range=0..5),
    Trigger=Toggle(False),
    Branch=line_sdl,
    length=number_slider,
    angle=Slider(40.6, range=0..100),
    division=Slider(2, range=1..4),
    l=Slider(0.44, range=0..1),
    D5=Slider(0.17, range=0.01..1))  # -> port, Counter, Data, Data_2, Data_3, Data_4, Data_5, Data_6
number = Number(loop_start.Data_6)
number_2 = Number(loop_start.Data_3)
curve = Curve(graft(loop_start.Data))
multiplication = Multiplication(A=number, B=number_2)
point_on_curve = PointOnCurve(curve, parameter=1)
construct_plane = ConstructPlane(Origin=point_on_curve, XAxis=expr("-x", curve), YAxis=Vector(0, 1, 0))
radians = Radians(Degrees=multiplication)
radians_2 = Radians(Degrees=multiplication)
pi = Pi(Factor="1.5")
pi_2 = Pi(Factor=".5")
number_3 = Number(loop_start.Data_5)
number_4 = Number(loop_start.Data_2)
addition = Addition(A=pi_2, B=radians_2)
integer = Integer(loop_start.Data_4)
subtraction = Subtraction(A=pi, B=radians)
multiplication_2 = Multiplication(A=number_3, B=number_4)
construct_domain = ConstructDomain(DomainStart=addition, DomainEnd=subtraction)
arc = Arc(Plane=construct_plane, Radius=multiplication_2, Angle=construct_domain)  # -> Arc, Length
divide_curve = DivideCurve(Curve=arc.Arc, Count=integer, Kinks=False)  # -> Points, Tangents, Parameters
line = Line(StartPoint=construct_plane, EndPoint=divide_curve.Points)
loop_end = LoopEnd(
    port=loop_start.port,
    Exit=False,
    Branch=line,
    Data=multiplication_2,
    Data_2=multiplication,
    Data_3=integer,
    Data_4=number_3,
    Data_5=number,
    TimeOutVal=0,
    pausedState=False,
    state="Constant & Record")  # -> Data, D1, D2, D3, D4, D5
curve_2 = Curve(loop_end.Data)
merge = Merge(Data1=line_sdl, Data2=curve_2)

number_slider_2 = Slider(15, range=0..100)  # disabled
construct_domain_2 = ConstructDomain(DomainStart=0, DomainEnd=expr("x/2", number_slider_2))  # disabled
construct_domain_3 = ConstructDomain(DomainStart=0, DomainEnd=number_slider_2)  # disabled
rectangle = Rectangle(Plane=PlaneXY(0, 0, 0), XSize=construct_domain_3, YSize=construct_domain_2, Radius=0)  # -> Rectangle, Length; disabled
unit_y_2 = UnitY(Factor=expr("x/5", number_slider_2))  # disabled
area = Area(Geometry=rectangle.Rectangle)  # -> Area, Centroid; disabled
negative = Negative(Value=unit_y_2)  # disabled
move = Move(Geometry=area.Centroid, Motion=[negative, unit_y_2])  # -> Geometry, Transform; disabled
dispatch = Dispatch(List=move.Geometry, DispatchPattern=[True, False])  # -> ListA, ListB; disabled
number_slider_3 = Slider(0.26, range=0..1)  # disabled
line_2 = Line(StartPoint=dispatch.ListA, EndPoint=dispatch.ListB)  # disabled
unit_x = UnitX(Factor=expr("x/10", number_slider_2))  # disabled
scale = Scale(Geometry=line_2, Center=area.Centroid, Factor=number_slider_3)  # -> Geometry, Transform; disabled
negative_2 = Negative(Value=unit_x)  # disabled
move_2 = Move(Geometry=scale.Geometry, Motion=[unit_x, negative_2])  # -> Geometry, Transform; disabled
number_slider_4 = Slider(0.2, range=0..1)  # disabled

unit_y_3 = UnitY(Factor=expr("x/7", number_slider_2))  # disabled
negative_3 = Negative(Value=unit_y_3)  # disabled
move_3 = Move(Geometry=area.Centroid, Motion=[unit_y_3, negative_3])  # -> Geometry, Transform; disabled
dispatch_2 = Dispatch(List=move_3.Geometry, DispatchPattern=[True, False])  # -> ListA, ListB; disabled
unit_x_2 = UnitX(Factor=expr("x/2", dispatch_2.ListA))  # disabled
unit_x_3 = UnitX(Factor=1)  # disabled
negative_4 = Negative(Value=unit_x_2)  # disabled
point = Point(dispatch_2.ListB)  # disabled
move_4 = Move(Geometry=dispatch_2.ListB, Motion=negative_4)  # -> Geometry, Transform; disabled
move_5 = Move(Geometry=move_4.Geometry, Motion=expr("x/2", unit_x_3))  # -> Geometry, Transform; disabled
dispatch_3 = Dispatch(List=move_2.Geometry, DispatchPattern=[True, False])  # -> ListA, ListB; disabled
move_6 = Move(Geometry=dispatch_2.ListA, Motion=unit_x_2)  # -> Geometry, Transform; disabled
end_points = EndPoints(Curve=dispatch_3.ListB)  # -> Start, End; disabled
end_points_2 = EndPoints(Curve=dispatch_3.ListA)  # -> Start, End; disabled
line_3 = Line(StartPoint=move_5.Geometry, EndPoint=move_4.Geometry)  # disabled
arc_3pt = Arc3Pt(PointA=end_points_2.End, PointB=end_points.End, PointC=move_5.Geometry)  # -> Arc, Plane, Radius; disabled
arc_3pt_2 = Arc3Pt(PointA=move_6.Geometry, PointB=end_points_2.End, PointC=point)  # -> Arc, Plane, Radius; disabled
arc_3pt_3 = Arc3Pt(PointA=move_4.Geometry, PointB=dispatch_2.ListA, PointC=move_6.Geometry)  # -> Arc, Plane, Radius; disabled
merge_2 = Merge(Data1=arc_3pt_3.Arc, Data2=arc_3pt_2.Arc, Data3=arc_3pt.Arc, Data4=line_3)  # disabled
join_curves = JoinCurves(Curves=merge_2, Preserve=False)  # disabled
unit_z_2 = UnitZ(Factor=number_slider_4)  # disabled
boundary_surfaces = BoundarySurfaces(Edges=join_curves)  # disabled
extrude = Extrude(Base=boundary_surfaces, Direction=unit_z_2)  # disabled

point_on_curve_2 = PointOnCurve(arc_3pt.Arc, parameter=0.75)  # disabled
point_on_curve_3 = PointOnCurve(arc_3pt_3.Arc, parameter=0.19)  # disabled
number_slider_5 = Slider(3, range=0..10)  # disabled
line_4 = Line(StartPoint=point_on_curve_3, EndPoint=point_on_curve_2)  # disabled
scale_2 = Scale(Geometry=line_4, Center=[point_on_curve_3, point_on_curve_2], Factor=number_slider_5)  # -> graft(Geometry), Transform; disabled
unit_z_3 = UnitZ(Factor=1)  # disabled
curve_middle = CurveMiddle(Curve=line_2)  # disabled
join_curves_2 = JoinCurves(Curves=scale_2.Geometry, Preserve=False)  # -> flatten(Curves); disabled
construct_plane_2 = ConstructPlane(Origin=curve_middle, XAxis=unit_z_3, YAxis=Vector(0, 1, 0))  # disabled
dispatch_4 = Dispatch(List=join_curves_2, DispatchPattern=[True, False])  # -> ListA, ListB; disabled
mirror = Mirror(Geometry=dispatch_4.ListA, Plane=construct_plane_2)  # -> Geometry, Transform; disabled
curve_middle_2 = CurveMiddle(Curve=mirror.Geometry)  # disabled
number_slider_6 = Slider(0.435, range=0..1)  # disabled
number_slider_7 = Slider(0.942, range=0..1)  # disabled
scale_3 = Scale(Geometry=mirror.Geometry, Center=curve_middle_2, Factor=number_slider_5)  # -> Geometry, Transform; disabled
vector_2pt = Vector2Pt(PointA=curve_middle_2, PointB=end_points_2.End, Unitize=False)  # -> Vector, Length; disabled
amplitude = Amplitude(Vector=vector_2pt.Vector, Amplitude=number_slider_6)  # disabled
amplitude_2 = Amplitude(Vector=vector_2pt.Vector, Amplitude=number_slider_7)  # disabled
move_7 = Move(Geometry=curve_middle_2, Motion=amplitude_2)  # -> graft(Geometry), Transform; disabled
end_points_3 = EndPoints(Curve=scale_3.Geometry)  # -> Start, End; disabled
end_points_4 = EndPoints(Curve=scale_3.Geometry)  # -> Start, End; disabled
move_8 = Move(Geometry=curve_middle_2, Motion=amplitude)  # -> Geometry, Transform; disabled
arc_3pt_4 = Arc3Pt(PointA=end_points_3.Start, PointB=move_7.Geometry, PointC=end_points_3.End)  # -> Arc, Plane, Radius; disabled
arc_3pt_5 = Arc3Pt(PointA=end_points_4.Start, PointB=curve_middle_2, PointC=end_points_4.End)  # -> Arc, Plane, Radius; disabled

merge_3 = Merge(
    Data1=line_2,
    Data2=rectangle.Rectangle,
    Data3=move_2.Geometry,
    Data4=join_curves_2,
    Data5=arc_3pt_5.Arc,
    Data6=arc_3pt_4.Arc)  # disabled
pipe = Pipe(Curve=merge_3, Radius=number_slider_4, Caps=2)  # disabled
