# Grasshopper definition WorldOfDuchameDigitalAssestsBjornIsleForest001.gh (Grasshopper 1.0.7)
# Copyright: Wickerson Studios
# plug-ins: Bifocals

unit_z = UnitZ(Factor=Slider(100, range=0..100))
construct_point = ConstructPoint(XCoordinate=0, YCoordinate=0, ZCoordinate=0)
move = Move(Geometry=construct_point, Motion=unit_z)  # -> Geometry, Transform
line = Line(StartPoint=construct_point, EndPoint=move.Geometry)
perp_frames = PerpFrames(Curve=line, Count=10, Align=True)  # -> Frames, Parameters
number_slider = Slider(0.75, range=0..1)
list_item = ListItem(List=perp_frames.Frames, Index=0, Wrap=True)  # -> Item, Item1, Item2, Item3, Item4, Item5, Item6, Item7, Item8, Item9
number_slider_2 = Slider(18.28, range=0..20)
number_slider_3 = Slider(3.17, range=0..10)
number_slider_4 = Slider(1, range=0..100)
multiplication = Multiplication(A=number_slider_3, B=number_slider)
multiplication_2 = Multiplication(A=number_slider_2, B=number_slider)
ellipse = Ellipse(Plane=list_item.Item3, Radius1=expr("x/2", multiplication), Radius2=expr("x/2", multiplication_2))  # -> Ellipse, Focus1, Focus2
ellipse_2 = Ellipse(Plane=list_item.Item3, Radius1=number_slider_3, Radius2=number_slider_2)  # -> Ellipse, Focus1, Focus2
ellipse_3 = Ellipse(Plane=list_item.Item1, Radius1=Slider(2.24, range=0..10), Radius2=Slider(3.4, range=0..10))  # -> Ellipse, Focus1, Focus2
circle = Circle(Plane=list_item.Item, Radius=number_slider_4)
circle_2 = Circle(Plane=list_item.Item3, Radius=number_slider_4)
unit_y = UnitY(Factor=1)
merge = Merge(Data1=circle, Data2=ellipse_3.Ellipse, Data3=circle_2)
point_on_curve = PointOnCurve(ellipse.Ellipse, parameter=0.5)
mirror = Mirror(Geometry=point_on_curve, Plane=PlaneYZ(0, 0, 0))  # -> Geometry, Transform
point = Point(ellipse.Focus2)
point_2 = Point(mirror.Geometry)
point_3 = Point(ellipse.Focus1)
loft = Loft(Curves=merge, Options={Adjust=False, Closed=False, LoftEnds=0, LoftSimp=0, LoftType=0, Rebuild=10, Refit=0.01})
line_sdl = LineSDL(Start=list_item.Item3, Direction=unit_y, Length=1)
arc_3pt = Arc3Pt(PointA=point_3, PointB=point_on_curve, PointC=point)  # -> Arc, Plane, Radius
arc_3pt_2 = Arc3Pt(PointA=point_3, PointB=point_2, PointC=point)  # -> Arc, Plane, Radius
boundary_surfaces = BoundarySurfaces(Edges=[arc_3pt.Arc, arc_3pt_2.Arc])
unit_z_2 = UnitZ(Factor=Slider(100, range=0..100))
extrude = Extrude(Base=boundary_surfaces, Direction=unit_z_2)
deconstruct_brep = DeconstructBrep(Brep=extrude)  # -> Faces, Edges, Vertices
unit_z_3 = UnitZ(Factor=Slider(20, range=0..20))
list_item_2 = ListItem(List=deconstruct_brep.Faces, Index=Slider(3, range=0..10), Wrap=True)
area = Area(Geometry=list_item_2)  # -> Area, Centroid
move_2 = Move(Geometry=area.Centroid, Motion=unit_z_3)  # -> Geometry, Transform
sphere = Sphere(Base=list_item.Item, Radius=Slider(3.49, range=0..10))
revolution = Revolution(Curve=ellipse_2.Ellipse, Axis=line_sdl, Domain=Domain(0, 6.283185307))
cap_holes = CapHoles(Brep=loft)
extrude_point = ExtrudePoint(Base=list_item_2, Point=move_2.Geometry)
geometry = Geometry(extrude)
solid_union = SolidUnion(Breps=[sphere, cap_holes])
merge_2 = Merge(Data1=solid_union, Data2=revolution, Data3=geometry, Data4=extrude_point)  # -> flatten(Result)
brep_join = BrepJoin(Breps=merge_2)  # -> Breps, Closed
