# Grasshopper definition WorldOfDuchameDigitalAssestsBridge001mesh.gh (Grasshopper 1.0.7)
# Copyright: Wickerson Studios
# plug-ins: Bifocals

number_slider = Slider(72, range=0..100)
xz_plane = XZPlane(Origin=Point(0, 0, 0))
unit_z = UnitZ(Factor=expr("x/4", number_slider))
pi = Pi(Factor=Slider(1, range=0..2))
cylinder = Cylinder(Base=xz_plane, Radius=number_slider, Length=expr("x*3", number_slider))
multiplication = Multiplication(A=unit_z, B=pi)
negative = Negative(Value=multiplication)
cap_holes = CapHoles(Brep=cylinder)
addition = Addition(A=number_slider, B=Slider(12, range=0..100))
unit_y = UnitY(Factor=addition)
move = Move(Geometry=cap_holes, Motion=negative)  # -> Geometry, Transform
center_box = CenterBox(Base=PlaneXY(0, 0, 0), X=expr("x*2", number_slider), Y=number_slider, Z=number_slider)
populate_3d = Populate3D(Region=center_box, Count=Slider(5, range=0..100), Seed=1)
voronoi_3d = Voronoi3D(Points=populate_3d, Box=center_box)  # -> Cells, Boundary
deconstruct_brep = DeconstructBrep(Brep=voronoi_3d.Cells)  # -> Faces, Edges, Vertices
geometry = Geometry(voronoi_3d.Cells)
pipe = Pipe(Curve=deconstruct_brep.Edges, Radius=Slider(10, range=0..10), Caps=2)  # -> graft(Pipe)
solid_union = SolidUnion(Breps=pipe)  # -> flatten(Result)
move_2 = Move(Geometry=move.Geometry, Motion=unit_y)  # -> Geometry, Transform
solid_difference = SolidDifference(BrepsA=geometry, BrepsB=solid_union)  # -> flatten(Result)
solid_difference_2 = SolidDifference(BrepsA=solid_difference)
