# Grasshopper definition WorldOfDuchameDigitalAssestsBridge002.gh (Grasshopper 1.0.7)
# Copyright: Wickerson Studios
# plug-ins: Bifocals

number_slider = Slider(72, range=0..100)  # disabled
number_slider_2 = Slider(1, range=0..2)  # disabled
xz_plane = XZPlane(Origin=Point(0, 0, 0))  # disabled
unit_z = UnitZ(Factor=expr("x/4", number_slider))  # disabled
pi = Pi(Factor=number_slider_2)  # disabled
cylinder = Cylinder(Base=xz_plane, Radius=number_slider, Length=expr("x*3", number_slider))  # disabled
number_slider_3 = Slider(12, range=0..100)  # disabled
multiplication = Multiplication(A=unit_z, B=pi)  # disabled
negative = Negative(Value=multiplication)  # disabled
cap_holes = CapHoles(Brep=cylinder)  # disabled
addition = Addition(A=number_slider, B=number_slider_3)  # disabled
unit_y = UnitY(Factor=addition)  # disabled
move = Move(Geometry=cap_holes, Motion=negative)  # -> Geometry, Transform; disabled
center_box = CenterBox(Base=PlaneXY(0, 0, 0), X=expr("x*2", number_slider), Y=number_slider, Z=number_slider)  # disabled
number_slider_4 = Slider(144, range=0..200)
number_slider_5 = Slider(5, range=0..100)  # disabled
unit_z_2 = UnitZ(Factor=expr("x/4", number_slider_4))
xz_plane_2 = XZPlane(Origin=Point(0, 0, 0))
pi_2 = Pi(Factor=Slider(1, range=0..2))
cylinder_2 = Cylinder(Base=xz_plane_2, Radius=number_slider_4, Length=expr("x*3", number_slider_4))
multiplication_2 = Multiplication(A=unit_z_2, B=pi_2)
populate_3d = Populate3D(Region=center_box, Count=number_slider_5, Seed=1)  # disabled
negative_2 = Negative(Value=multiplication_2)
cap_holes_2 = CapHoles(Brep=cylinder_2)
addition_2 = Addition(A=number_slider_4, B=12)
center_box_2 = CenterBox(Base=PlaneXY(0, 0, 0), X=expr("x*2", number_slider_4), Y=number_slider_4, Z=number_slider_4)
move_2 = Move(Geometry=cap_holes_2, Motion=negative_2)  # -> Geometry, Transform
number_slider_6 = Slider(10, range=0..10)  # disabled
unit_y_2 = UnitY(Factor=addition_2)
voronoi_3d = Voronoi3D(Points=populate_3d, Box=center_box)  # -> Cells, Boundary; disabled
populate_3d_2 = Populate3D(Region=center_box_2, Count=Slider(5, range=0..100), Seed=1)
deconstruct_brep = DeconstructBrep(Brep=voronoi_3d.Cells)  # -> Faces, Edges, Vertices; disabled
voronoi_3d_2 = Voronoi3D(Points=populate_3d_2, Box=center_box_2)  # -> Cells, Boundary
geometry = Geometry(voronoi_3d.Cells)  # disabled
pipe = Pipe(Curve=deconstruct_brep.Edges, Radius=number_slider_6, Caps=2)  # -> graft(Pipe); disabled
deconstruct_brep_2 = DeconstructBrep(Brep=voronoi_3d_2.Cells)  # -> Faces, Edges, Vertices
pipe_2 = Pipe(Curve=deconstruct_brep_2.Edges, Radius=Slider(20, range=0..20), Caps=2)  # -> graft(Pipe)
solid_union = SolidUnion(Breps=pipe)  # -> flatten(Result); disabled
solid_union_2 = SolidUnion(Breps=pipe_2)  # -> flatten(Result)
move_3 = Move(Geometry=move.Geometry, Motion=unit_y)  # -> Geometry, Transform; disabled
geometry_2 = Geometry(voronoi_3d_2.Cells)
solid_difference = SolidDifference(BrepsA=geometry, BrepsB=solid_union)  # -> flatten(Result); disabled
move_4 = Move(Geometry=move_2.Geometry, Motion=unit_y_2)  # -> Geometry, Transform
solid_difference_2 = SolidDifference(BrepsA=geometry_2, BrepsB=solid_union_2)  # -> flatten(Result)
solid_difference_3 = SolidDifference(BrepsA=solid_difference, BrepsB=move_3.Geometry)  # disabled
solid_difference_4 = SolidDifference(BrepsA=solid_difference_2, BrepsB=move_4.Geometry)
