# Grasshopper definition WorldOfDuchameDigitalAssestsBridge004.gh (Grasshopper 1.0.7)
# Copyright: Wickerson Studios
# plug-ins: Fologram For Grasshopper Utilities, Bifocals

number_slider = Slider(149, range=0..200)
number_slider_2 = Slider(72, range=0..100)  # disabled

number_slider_3 = Slider(144, range=0..200)  # disabled
number_slider_4 = Slider(1, range=0..2)  # disabled
number_slider_5 = Slider(32, range=0..100)  # disabled
unit_z = UnitZ(Factor=expr("x/4", number_slider_3))  # disabled
xz_plane = XZPlane(Origin=Point(0, 0, 0))  # disabled
pi = Pi(Factor=number_slider_4)  # disabled
cylinder = Cylinder(Base=xz_plane, Radius=number_slider_3, Length=expr("x*3", number_slider_3))  # disabled
multiplication = Multiplication(A=unit_z, B=pi)  # disabled
negative = Negative(Value=multiplication)  # disabled
cap_holes = CapHoles(Brep=cylinder)  # disabled
addition = Addition(A=number_slider_3, B=12)  # disabled
center_box = CenterBox(Base=PlaneXY(0, 0, 0), X=expr("x*2", number_slider_3), Y=number_slider_3, Z=number_slider_3)  # disabled
move = Move(Geometry=cap_holes, Motion=negative)  # -> Geometry, Transform; disabled
unit_y = UnitY(Factor=addition)  # disabled
populate_3d = Populate3D(Region=center_box, Count=number_slider_5, Seed=1)  # disabled
number_slider_6 = Slider(20, range=0..20)  # disabled
boolean_toggle = BooleanToggle(True)  # disabled
voronoi_3d = Voronoi3D(Points=populate_3d, Box=center_box)  # -> Cells, Boundary; disabled
deconstruct_brep = DeconstructBrep(Brep=voronoi_3d.Cells)  # -> Faces, Edges, Vertices; disabled
mesh_pipe = MeshPipe(
    Polylines=deconstruct_brep.Edges,
    NumberOfSides=4,
    Tolerance=0.1,
    Radius=number_slider_6,
    Cap=boolean_toggle,
    Join=boolean_toggle)  # -> flatten(Meshes); disabled
geometry = Geometry(voronoi_3d.Cells)  # disabled
pipe = Pipe(Curve=deconstruct_brep.Edges, Radius=number_slider_6, Caps=2)  # -> graft(Pipe); disabled
move_2 = Move(Geometry=move.Geometry, Motion=unit_y)  # -> Geometry, Transform; disabled
mesh_brep = MeshBrep(
    Brep=geometry,
    Settings={GridMaxCount=0, GridMinCount=16, JaggedSeams=False, MaxEdgeLength=0, MinEdgeLength=0.0001, MinTolerance=0, Refine=True, RefineAngle=0, RelativeTolerance=0.65, SimplePlanes=True, Tolerance=0})  # disabled
solid_union = SolidUnion(Breps=pipe)  # -> flatten(Result); disabled
mesh_union = MeshUnion(Meshes=mesh_pipe)  # disabled
mesh_brep_2 = MeshBrep(
    Brep=move_2.Geometry,
    Settings={GridMaxCount=0, GridMinCount=16, JaggedSeams=False, MaxEdgeLength=0, MinEdgeLength=0.0001, MinTolerance=0, Refine=True, RefineAngle=0, RelativeTolerance=0.65, SimplePlanes=True, Tolerance=0})  # disabled
mesh_difference = MeshDifference(MeshesA=mesh_brep, MeshesB=mesh_union)  # -> flatten(Result); disabled
solid_difference = SolidDifference(BrepsA=geometry, BrepsB=solid_union)  # -> flatten(Result); disabled
solid_difference_2 = SolidDifference(BrepsA=solid_difference, BrepsB=move_2.Geometry)  # disabled
mesh_difference_2 = MeshDifference(MeshesA=mesh_difference, MeshesB=mesh_brep_2)  # disabled
mesh = Mesh(mesh_difference_2)  # disabled

number_slider_7 = Slider(1, range=0..2)  # disabled
xz_plane_2 = XZPlane(Origin=Point(0, 0, 0))  # disabled
unit_y_2 = UnitY(Factor=number_slider)
unit_z_2 = UnitZ(Factor=expr("x/4", number_slider_2))  # disabled
unit_x = UnitX(Factor=number_slider)
pi_2 = Pi(Factor=number_slider_7)  # disabled
cylinder_2 = Cylinder(Base=xz_plane_2, Radius=number_slider_2, Length=expr("x*3", number_slider_2))  # disabled
number_slider_8 = Slider(12, range=0..100)  # disabled
multiplication_2 = Multiplication(A=unit_z_2, B=pi_2)  # disabled
negative_2 = Negative(Value=unit_y_2)
negative_3 = Negative(Value=unit_x)
unit_z_3 = UnitZ(Factor=Slider(87, range=0..200))
negative_4 = Negative(Value=multiplication_2)  # disabled
cap_holes_2 = CapHoles(Brep=cylinder_2)  # disabled
addition_2 = Addition(A=number_slider_2, B=number_slider_8)  # disabled
negative_5 = Negative(Value=unit_z_3)
unit_y_3 = UnitY(Factor=addition_2)  # disabled
move_3 = Move(Geometry=cap_holes_2, Motion=negative_4)  # -> Geometry, Transform; disabled
center_box_2 = CenterBox(Base=PlaneXY(0, 0, 0), X=expr("x*2", number_slider_2), Y=number_slider_2, Z=number_slider_2)  # disabled
number_slider_9 = Slider(5, range=0..100)  # disabled
populate_3d_2 = Populate3D(Region=center_box_2, Count=number_slider_9, Seed=1)  # disabled
number_slider_10 = Slider(10, range=0..10)  # disabled
voronoi_3d_2 = Voronoi3D(Points=populate_3d_2, Box=center_box_2)  # -> Cells, Boundary; disabled
deconstruct_brep_2 = DeconstructBrep(Brep=voronoi_3d_2.Cells)  # -> Faces, Edges, Vertices; disabled
geometry_2 = Geometry(voronoi_3d_2.Cells)  # disabled
pipe_2 = Pipe(Curve=deconstruct_brep_2.Edges, Radius=number_slider_10, Caps=2)  # -> graft(Pipe); disabled
solid_union_2 = SolidUnion(Breps=pipe_2)  # -> flatten(Result); disabled
move_4 = Move(Geometry=move_3.Geometry, Motion=unit_y_3)  # -> Geometry, Transform; disabled
solid_difference_3 = SolidDifference(BrepsA=geometry_2, BrepsB=solid_union_2)  # -> flatten(Result); disabled
solid_difference_4 = SolidDifference(BrepsA=solid_difference_3, BrepsB=move_4.Geometry)  # disabled

xz_plane_3 = XZPlane(Origin=Point(0, 0, 0))
number_slider_11 = Slider(102, range=0..200)
center_box_3 = CenterBox(Base=PlaneXY(0, 0, 0), X=expr("x*2", number_slider_11), Y=expr("x/2", number_slider_11), Z=number_slider_11)
populate_3d_3 = Populate3D(Region=center_box_3, Count=Slider(6, range=0..100), Seed=Slider(114, range=0..1000))
number_slider_12 = Slider(10, range=0..10)
boolean_toggle_2 = BooleanToggle(True)
voronoi_3d_3 = Voronoi3D(Points=populate_3d_3, Box=center_box_3)  # -> Cells, Boundary
deconstruct_brep_3 = DeconstructBrep(Brep=voronoi_3d_3.Cells)  # -> Faces, Edges, Vertices
mesh_pipe_2 = MeshPipe(
    Polylines=deconstruct_brep_3.Edges,
    NumberOfSides=4,
    Tolerance=0.1,
    Radius=number_slider_12,
    Cap=boolean_toggle_2,
    Join=boolean_toggle_2)  # -> flatten(Meshes)
geometry_3 = Geometry(voronoi_3d_3.Cells)
pipe_3 = Pipe(Curve=deconstruct_brep_3.Edges, Radius=number_slider_12, Caps=2)  # -> graft(Pipe)
solid_union_3 = SolidUnion(Breps=pipe_3)  # -> flatten(Result); disabled
mesh_brep_3 = MeshBrep(
    Brep=geometry_3,
    Settings={GridMaxCount=0, GridMinCount=16, JaggedSeams=False, MaxEdgeLength=0, MinEdgeLength=0.0001, MinTolerance=0, Refine=True, RefineAngle=0, RelativeTolerance=0.65, SimplePlanes=True, Tolerance=0})
mesh_union_2 = MeshUnion(Meshes=mesh_pipe_2)
mesh_difference_3 = MeshDifference(MeshesA=mesh_brep_3, MeshesB=mesh_union_2)  # -> flatten(Result)
solid_difference_5 = SolidDifference(BrepsA=geometry_3, BrepsB=solid_union_3)  # -> flatten(Result)

ellipse = Ellipse(Plane=xz_plane_3, Radius1=Slider(73, range=0..100), Radius2=number_slider)  # -> Ellipse, Focus1, Focus2
scale = Scale(Geometry=ellipse.Ellipse, Center=Point(0, 0, 0), Factor=0.5)  # -> Geometry, Transform
move_5 = Move(Geometry=scale.Geometry, Motion=[negative_3, unit_x])  # -> Geometry, Transform
move_6 = Move(Geometry=[ellipse.Ellipse, move_5.Geometry], Motion=negative_5)  # -> Geometry, Transform
boundary_surfaces = BoundarySurfaces(Edges=move_6.Geometry)  # -> graft(Surfaces)
extrude = Extrude(Base=boundary_surfaces, Direction=[unit_y_2, negative_2])  # -> flatten(Extrusion)

cap_holes_3 = CapHoles(Brep=extrude)
move_7 = Move(Geometry=cap_holes_3, Motion=Vector(0, 0, 10))  # -> Geometry, Transform
mesh_brep_4 = MeshBrep(
    Brep=move_7.Geometry,
    Settings={GridMaxCount=0, GridMinCount=16, JaggedSeams=False, MaxEdgeLength=0, MinEdgeLength=0.0001, MinTolerance=0, Refine=True, RefineAngle=0, RelativeTolerance=0.65, SimplePlanes=True, Tolerance=0})  # -> flatten(Mesh)
solid_difference_6 = SolidDifference(BrepsA=solid_difference_5, BrepsB=move_7.Geometry)
mesh_difference_4 = MeshDifference(MeshesA=mesh_difference_3, MeshesB=mesh_brep_4)
mesh_2 = Mesh(mesh_difference_4)
