# Grasshopper definition WorldOfDuchameDigitalAssestsChain002.gh (Grasshopper 1.0.7)
# Copyright: Wickerson Studios
# plug-ins: Bifocals

number_slider = Slider(4, range=4..10)
rectangle = Rectangle(Plane=PlaneXY(0, 0, 0), XSize=number_slider, YSize=number_slider, Radius=0)  # -> Rectangle, Length
explode = Explode(Curve=rectangle.Rectangle, Recursive=True)  # -> Segments, Vertices
unit_x = UnitX(Factor=1)
list_item = ListItem(List=explode.Segments, Index=0, Wrap=True)  # -> Item, Item1, Item2, Item3
cull_index = CullIndex(List=explode.Vertices, Indices="-1", Wrap=True)
dispatch = Dispatch(List=cull_index, DispatchPattern=[True, False])  # -> ListA, ListB
negative = Negative(Value=unit_x)
dispatch_2 = Dispatch(List=dispatch.ListB, DispatchPattern=[True, False])  # -> ListA, ListB
dispatch_3 = Dispatch(List=dispatch.ListA, DispatchPattern=[True, False])  # -> ListA, ListB
arc_sed = ArcSED(Start=dispatch_3.ListA, End=dispatch_2.ListB, Direction=negative)  # -> Arc, Plane, Radius
arc_sed_2 = ArcSED(Start=dispatch_3.ListB, End=dispatch_2.ListA, Direction=unit_x)  # -> Arc, Plane, Radius
point = Point(dispatch_2.ListA)
curve = Curve([list_item.Item2, list_item.Item])
merge = Merge(Data1=arc_sed.Arc, Data2=arc_sed_2.Arc, Data3=curve)  # -> flatten(Result)
yz_plane = YZPlane(Origin=Point(0, 0, 0))
unit_x_2 = UnitX(Factor=Slider(2, range=0..10))
join_curves = JoinCurves(Curves=merge, Preserve=False)
mirror = Mirror(Geometry=join_curves, Plane=yz_plane)  # -> Geometry, Transform
negative_2 = Negative(Value=unit_x_2)
area = Area(Geometry=mirror.Geometry)  # -> Area, Centroid
construct_plane = ConstructPlane(Origin=area.Centroid, XAxis=Vector(1, 0, 0), YAxis=Vector(0, 1, 0))
yz_plane_2 = YZPlane(Origin=construct_plane)
rotate = Rotate(Geometry=mirror.Geometry, Angle=1.570796327, Plane=yz_plane_2)  # -> Geometry, Transform
move = Move(Geometry=rotate.Geometry, Motion=negative_2)  # -> Geometry, Transform
unit_x_3 = UnitX(Factor=expr("x*3", number_slider))
merge_2 = Merge(Data1=join_curves, Data2=move.Geometry)
linear_array = LinearArray(Geometry=merge_2, Direction=unit_x_3, Count=10)  # -> Geometry, Transform
pipe = Pipe(Curve=linear_array.Geometry, Radius=Slider(0.84, range=0..1), Caps=0)
