# Grasshopper definition WorldOfDuchameDigitalAssestsChain005.gh (Grasshopper 1.0.7)
# Copyright: Wickerson Studios
# plug-ins: Bifocals

multiplication = Multiplication(A=Slider(2, range=0..10), B=12)
construct_domain = ConstructDomain(DomainStart=0, DomainEnd=multiplication)
number_slider = Slider(18, range=0..100)
range = Range(Domain=construct_domain, Steps=360)
sine = Sine(Value=range)
cosine = Cosine(Value=range)
multiplication_2 = Multiplication(A=cosine, B=number_slider)
multiplication_3 = Multiplication(A=range, B=Slider(6, range=0..100))
multiplication_4 = Multiplication(A=sine, B=number_slider)
construct_point = ConstructPoint(XCoordinate=multiplication_2, YCoordinate=multiplication_4, ZCoordinate=multiplication_3)
interpolate = Interpolate(Vertices=construct_point, Degree=3, Periodic=False, KnotStyle=1)  # -> Curve, Length, Domain

construct_point_2 = ConstructPoint(XCoordinate=0, YCoordinate=0, ZCoordinate=0)
unit_z = UnitZ(Factor=Slider(200, range=0..200))
move = Move(Geometry=construct_point_2, Motion=unit_z)  # -> Geometry, Transform
line = Line(StartPoint=construct_point_2, EndPoint=move.Geometry)
base = Base(<base referenced from the Rhino model>)
base_2 = Base(<base referenced from the Rhino model>)
pipe = Pipe(Curve=line, Radius=Slider(12, range=0..100), Caps=2)

number_slider_2 = Slider(8.12, range=4..10)
rectangle = Rectangle(Plane=PlaneXY(0, 0, 0), XSize=number_slider_2, YSize=number_slider_2, Radius=0)  # -> Rectangle, Length
explode = Explode(Curve=rectangle.Rectangle, Recursive=True)  # -> Segments, Vertices
unit_x = UnitX(Factor=1)
list_item = ListItem(List=explode.Segments, Index=0, Wrap=True)  # -> Item, Item1, Item2, Item3
cull_index = CullIndex(List=explode.Vertices, Indices="-1", Wrap=True)
dispatch = Dispatch(List=cull_index, DispatchPattern=[True, False])  # -> ListA, ListB
negative = Negative(Value=unit_x)
dispatch_2 = Dispatch(List=dispatch.ListB, DispatchPattern=[True, False])  # -> ListA, ListB
dispatch_3 = Dispatch(List=dispatch.ListA, DispatchPattern=[True, False])  # -> ListA, ListB
arc_sed = ArcSED(Start=dispatch_3.ListA, End=dispatch_2.ListB, Direction=negative)  # -> Arc, Plane, Radius
arc_sed_2 = ArcSED(Start=dispatch_3.ListB, End=dispatch_2.ListA, Direction=unit_x)  # -> Arc, Plane, Radius
point = Point(dispatch_2.ListA)
curve = Curve([list_item.Item2, list_item.Item])
merge = Merge(Data1=arc_sed.Arc, Data2=arc_sed_2.Arc, Data3=curve)  # -> flatten(Result)
yz_plane = YZPlane(Origin=Point(0, 0, 0))
unit_x_2 = UnitX(Factor=Slider(2, range=0..10))
join_curves = JoinCurves(Curves=merge, Preserve=False)
mirror = Mirror(Geometry=join_curves, Plane=yz_plane)  # -> Geometry, Transform
negative_2 = Negative(Value=unit_x_2)
area = Area(Geometry=mirror.Geometry)  # -> Area, Centroid
construct_plane = ConstructPlane(Origin=area.Centroid, XAxis=Vector(1, 0, 0), YAxis=Vector(0, 1, 0))
yz_plane_2 = YZPlane(Origin=construct_plane)
rotate = Rotate(Geometry=mirror.Geometry, Angle=1.570796327, Plane=yz_plane_2)  # -> Geometry, Transform
move_2 = Move(Geometry=rotate.Geometry, Motion=negative_2)  # -> Geometry, Transform
unit_x_3 = UnitX(Factor=expr("x*3", number_slider_2))
merge_2 = Merge(Data1=join_curves, Data2=move_2.Geometry)
linear_array = LinearArray(Geometry=merge_2, Direction=unit_x_3, Count=Slider(23, range=0..100))  # -> graft(Geometry), Transform
catenary = Catenary(
    PointA=<geometry referenced from the Rhino model>,
    PointB=<geometry referenced from the Rhino model>,
    Length=Slider(612, range=0..1100),
    Gravity=Vector(0, 0, -1))
flow = Flow(
    Geometry=linear_array.Geometry,
    Base=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,
    Target=interpolate.Curve,
    ReverseBase=False,
    ReverseTarget=False,
    Stretch=Toggle(True),
    Rigid=Toggle(False))

rebuild_curve = RebuildCurve(Curve=flow, Count=10, Tangents=False)

pipe_2 = Pipe(Curve=rebuild_curve, Radius=Slider(2, range=0..2), Caps=2)  # -> flatten(Pipe)

solid_difference = SolidDifference(BrepsA=pipe, BrepsB=pipe_2)
