# Grasshopper definition WorldOfDuchameDigitalAssestsFigure001.gh (Grasshopper 1.0.7)
# Copyright: Wickerson Studios
# plug-ins: Bifocals

number_slider = Slider(3.95, range=0.01..20)
negative = Negative(Value=number_slider)
construct_domain = ConstructDomain(DomainStart=number_slider, DomainEnd=negative)
range = Range(Domain=construct_domain, Steps=100)
expression = Expression(w=Slider(0.03, range=0.01..0.15), x=range, Expression="w*(x^2)")
construct_point = ConstructPoint(XCoordinate=range, YCoordinate=0, ZCoordinate=expression)
unit_z = UnitZ(Factor=Slider(60, range=50..100))
construct_point_2 = ConstructPoint(XCoordinate=0, YCoordinate=0, ZCoordinate=0)
point = Point(construct_point)
index = Index(-1)
index_2 = Index(0)
move = Move(Geometry=construct_point_2, Motion=unit_z)  # -> Geometry, Transform
list_item = ListItem(List=point, Index=index_2, Wrap=True)  # -> Item, Item1
list_item_2 = ListItem(List=point, Index=index, Wrap=True)  # -> Item, Item1
interpolate = Interpolate(Vertices=point, Degree=3, Periodic=False, KnotStyle=1)  # -> Curve, Length, Domain
arc_3pt = Arc3Pt(PointA=list_item.Item, PointB=move.Geometry, PointC=list_item_2.Item)  # -> Arc, Plane, Radius
join_curves = JoinCurves(Curves=[arc_3pt.Arc, interpolate.Curve], Preserve=False)
area = Area(Geometry=join_curves)  # -> Area, Centroid
unit_y = UnitY(Factor=1)
rotate_3d = Rotate3D(Geometry=join_curves, Angle=1.570796327, Center=area.Centroid, Axis=unit_y)  # -> Geometry, Transform
unit_x = UnitX(Factor=1)
rotate_3d_2 = Rotate3D(Geometry=rotate_3d.Geometry, Angle=1.570796327, Center=area.Centroid, Axis=unit_x)  # -> Geometry, Transform
polar_array = PolarArray(Geometry=join_curves, Plane=PlaneXY(0, 0, 0), Count=3, Angle=6.283185307)  # -> Geometry, Transform
scale = Scale(Geometry=rotate_3d_2.Geometry, Center=Point(0, 0, 0), Factor=Slider(0.07, range=0.01..1))  # -> Geometry, Transform
unit_z_2 = UnitZ(Factor=Slider(4.33, range=0.01..10))
negative_2 = Negative(Value=unit_z_2)
move_2 = Move(Geometry=scale.Geometry, Motion=[unit_z_2, negative_2])  # -> Geometry, Transform
network_surface = NetworkSurface(CurvesU=[rotate_3d_2.Geometry, move_2.Geometry], CurvesV=polar_array.Geometry, Continuity=Slider(3, range=0..3))
