# Grasshopper definition WorldOfDuchameDigitalAssestsPhallus002.gh (Grasshopper 1.0.7)
# Copyright: Wickerson Studios
# plug-ins: Bifocals

construct_point = ConstructPoint(XCoordinate=0, YCoordinate=0, ZCoordinate=0)
bending_arc = BendingArc({Angle=0, Angle=1.175547192, Plane=Plane(origin=(0, -45, -21), x=(0, 0.90618314, 0.4228854653), y=(0, 0.4228854653, -0.90618314)), Radius=49.65883607})
unit_z = UnitZ(Factor=Slider(68, range=0..100))
negative = Negative(Value=unit_z)
move = Move(Geometry=construct_point, Motion=negative)  # -> Geometry, Transform
line = Line(StartPoint=construct_point, EndPoint=move.Geometry)
unit_x = UnitX(Factor=Slider(9, range=0..100))
pi = Pi(Factor=Slider(0.55, range=0..2))
construct_domain = ConstructDomain(DomainStart=Slider(1.16, range=0..2), DomainEnd=Slider(1.18, range=0..2))
loft_options = LoftOptions(Closed=False, Adjust=False, Rebuild=0, Refit=Toggle(False), Type=Slider(5, range=0..5))
unit_z_2 = UnitZ(Factor=Slider(15, range=0..100))
unit_z_3 = UnitZ(Factor=Slider(10, range=0..100))
negative_2 = Negative(Value=unit_z_2)
negative_3 = Negative(Value=unit_z_3)

point_on_curve = PointOnCurve(line, parameter=0.543)

move_2 = Move(Geometry=point_on_curve, Motion=unit_x)  # -> Geometry, Transform
arc_3pt = Arc3Pt(PointA=construct_point, PointB=move_2.Geometry, PointC=move.Geometry)  # -> Arc, Plane, Radius
curve_frames = CurveFrames(Curve=arc_3pt.Arc, Count=10)  # -> Frames, Parameters
horizontal_frames = HorizontalFrames(Curve=arc_3pt.Arc, Count=Slider(3, range=0..10))  # -> Frames, Parameters
rotate_3d = Rotate3D(Geometry=curve_frames.Frames, Angle=1.570796327, Center=horizontal_frames.Frames, Axis=Vector(0, 0, 1))  # -> Geometry, Transform
circle = Circle(Plane=rotate_3d.Geometry, Radius=Slider(5.13, range=0..20))
area = Area(Geometry=circle)  # -> Area, Centroid
rotate_3d_2 = Rotate3D(Geometry=circle, Angle=pi, Center=area.Centroid, Axis=curve_frames.Frames)  # -> Geometry, Transform
list_length = ListLength(List=rotate_3d_2.Geometry)
range = Range(Domain=construct_domain, Steps=expr("x-1", list_length))
scale = Scale(Geometry=rotate_3d_2.Geometry, Center=area.Centroid, Factor=range)  # -> flatten(Geometry), Transform
loft = Loft(Curves=scale.Geometry, Options=loft_options)
deconstruct_brep = DeconstructBrep(Brep=loft)  # -> Faces, Edges, Vertices
list_item = ListItem(List=deconstruct_brep.Edges, Index=Slider(1, range=0..1), Wrap=True)

point_on_curve_2 = PointOnCurve(list_item, parameter=1)

area_2 = Area(Geometry=list_item)  # -> Area, Centroid
move_3 = Move(Geometry=area_2.Centroid, Motion=negative_2)  # -> Geometry, Transform
move_4 = Move(Geometry=point_on_curve_2, Motion=negative_3)  # -> Geometry, Transform
curve = Curve(list_item)
line_2 = Line(StartPoint=area_2.Centroid, EndPoint=move_3.Geometry)
arc_3pt_2 = Arc3Pt(PointA=point_on_curve_2, PointB=move_4.Geometry, PointC=move_3.Geometry)  # -> Arc, Plane, Radius
revolution = Revolution(Curve=arc_3pt_2.Arc, Axis=line_2, Domain=Domain(0, 6.283185307))
cap_holes = CapHoles(Brep=loft)
cap_holes_2 = CapHoles(Brep=revolution)
solid_union = SolidUnion(Breps=[cap_holes, cap_holes_2])
bend_deform = BendDeform(Geometry=solid_union, BendingArc=bending_arc)
