# Grasshopper definition WorldOfDuchameDigitalAssestsRope001.gh (Grasshopper 1.0.7)
# Copyright: Wickerson Studios
# plug-ins: Bifocals

multiplication = Multiplication(A=Slider(3, range=0..10), B=Slider(72, range=0..100))
construct_domain = ConstructDomain(DomainStart=0, DomainEnd=multiplication)
number_slider = Slider(0.5, range=0..2)
range = Range(Domain=construct_domain, Steps=Slider(315, range=0..1000))
sine = Sine(Value=range)
cosine = Cosine(Value=range)
multiplication_2 = Multiplication(A=sine, B=number_slider)
multiplication_3 = Multiplication(A=cosine, B=number_slider)
construct_point = ConstructPoint(XCoordinate=range, YCoordinate=multiplication_2, ZCoordinate=multiplication_3)
interpolate = Interpolate(Vertices=construct_point, Degree=3, Periodic=False, KnotStyle=1)  # -> Curve, Length, Domain
unit_x = UnitX(Factor=1)
pi = Pi(Factor=Slider(2, range=0..2))
yz_plane = YZPlane(Origin=Point(0, 0, 0))
polar_array = PolarArray(Geometry=interpolate.Curve, Plane=yz_plane, Count=Slider(3, range=0..10), Angle=pi)  # -> Geometry, Transform
curve = Curve(<curve referenced from the Rhino model>)
curve_2 = Curve(<curve referenced from the Rhino model>)
merge = Merge(Data1=polar_array.Geometry)
flow = Flow(Geometry=merge, Base=curve_2, Target=curve, ReverseBase=False, ReverseTarget=False, Stretch=True, Rigid=False)
pipe = Pipe(Curve=flow, Radius=number_slider, Caps=1)
