# Grasshopper definition WorldOfDuchameDigitalAssestsRope002Cluster.gh (Grasshopper 1.0.7)
# Copyright: Wickerson Studios
# plug-ins: Bifocals

multiplication = Multiplication(A=Slider(2, range=0..10), B=12)
target_curve = Curve(<curve referenced from the Rhino model>)
construct_domain = ConstructDomain(DomainStart=0, DomainEnd=multiplication)
multiplication_2 = Multiplication(A=Slider(2, range=0..10), B=12)
cluster = Cluster_2(
    ropecount=Slider(2, range=0..10),
    feet=Slider(10, range=0..10),
    thickness=Slider(0.5, range=0..2),
    target_curve=target_curve)
number_slider = Slider(18, range=0..100)
range = Range(Domain=construct_domain, Steps=360)
unit_x = UnitX(Factor=multiplication_2)
construct_point = ConstructPoint(XCoordinate=0, YCoordinate=0, ZCoordinate=0)
sine = Sine(Value=range)
cosine = Cosine(Value=range)
negative = Negative(Value=unit_x)
multiplication_3 = Multiplication(A=cosine, B=number_slider)
multiplication_4 = Multiplication(A=range, B=Slider(6, range=0..100))
multiplication_5 = Multiplication(A=sine, B=number_slider)
multiplication_6 = Multiplication(A=Slider(14, range=0..20), B=12)
move = Move(Geometry=construct_point, Motion=unit_x)  # -> Geometry, Transform
move_2 = Move(Geometry=construct_point, Motion=negative)  # -> Geometry, Transform
construct_point_2 = ConstructPoint(XCoordinate=multiplication_3, YCoordinate=multiplication_5, ZCoordinate=multiplication_4)
catenary = Catenary(PointA=move.Geometry, PointB=move_2.Geometry, Length=multiplication_6, Gravity=Vector(0, 0, -1))
interpolate = Interpolate(Vertices=construct_point_2, Degree=3, Periodic=False, KnotStyle=1)  # -> Curve, Length, Domain
curve = Curve(<curve referenced from the Rhino model>)
curve_2 = Curve(<curve referenced from the Rhino model>)
curve_3 = Curve(<curve referenced from the Rhino model>)
curve_4 = Curve(catenary)
curve_5 = Curve(<curve referenced from the Rhino model>)
curve_6 = Curve(interpolate.Curve)
cluster_2 = Cluster(
    integer=Slider(2, range=0..5),
    feet=Slider(20, range=0..100),
    thickness=Slider(0.5, range=0..2),
    base_curve=curve_6,
    target_curve=curve_5)
cluster_3 = Cluster(
    integer=Slider(2, range=0..5),
    feet=Slider(17, range=0..100),
    thickness=Slider(0.5, range=0..2),
    base_curve=curve_4,
    target_curve=curve_3)
cluster_4 = Cluster(
    integer=Slider(2, range=0..5),
    feet=Slider(20, range=0..100),
    thickness=Slider(0.5, range=0..2),
    base_curve=curve_2,
    target_curve=curve)
ropetrick = Cluster(base_curve=<geometry referenced from the Rhino model>, target_curve=<geometry referenced from the Rhino model>)
wstransformations = WSTransformations(domain_end=1)
wstransformation = WSTransformation(domain_end=1)

# ==== cluster Cluster

# ---- group: Cluster Input
feet = ClusterInput()

thickness = ClusterInput()

# ----
feet_2 = Number(feet)
multiplication = Multiplication(A=feet_2, B=12)
thickness_2 = Number(thickness)
construct_domain = ConstructDomain(DomainStart=0, DomainEnd=multiplication)
range = Range(Domain=construct_domain, Steps=360)
sine = Sine(Value=range)
cosine = Cosine(Value=range)
multiplication_2 = Multiplication(A=sine, B=thickness_2)
multiplication_3 = Multiplication(A=cosine, B=thickness_2)
construct_point = ConstructPoint(XCoordinate=range, YCoordinate=multiplication_2, ZCoordinate=multiplication_3)
interpolate = Interpolate(Vertices=construct_point, Degree=3, Periodic=False, KnotStyle=1)  # -> Curve, Length, Domain
integer = ClusterInput()
integer_2 = Integer(integer)
yz_plane = YZPlane(Origin=Point(0, 0, 0))

# ---- group: Cluster Input
base_curve = ClusterInput()

target_curve = ClusterInput()

# ----
polar_array = PolarArray(Geometry=interpolate.Curve, Plane=yz_plane, Count=integer_2, Angle=6.283185307)  # -> Geometry, Transform
base_curve_2 = Curve(base_curve)
target_curve_2 = Curve(target_curve)
flow = Flow(
    Geometry=polar_array.Geometry,
    Base=base_curve_2,
    Target=target_curve_2,
    ReverseBase=False,
    ReverseTarget=False,
    Stretch=True,
    Rigid=False)
pipe = Pipe(Curve=flow, Radius=thickness_2, Caps=1)
geometry = Geometry(pipe)

# ---- group: Cluster Output
geometry_2 = ClusterOutput(geometry)

# ==== cluster WSTransformations: Rotate a range of geometries in the y axis

# ---- group: Cluster Input
geometry = ClusterInput()

domain_end = ClusterInput()

# ----
geometry_2 = Geometry(flatten(geometry))
construct_domain = ConstructDomain(DomainStart=0, DomainEnd=domain_end)
list_length = ListLength(List=geometry_2)
volume = Volume(Geometry=geometry_2)  # -> Volume, Centroid
expression = Expression(x=list_length, Expression="x-1")
unit_y = UnitY(Factor=1)
range = Range(Domain=construct_domain, Steps=expression)
pi = Pi(Factor=range)
rotate_3d = Rotate3D(Geometry=geometry_2, Angle=pi, Center=volume.Centroid, Axis=unit_y)  # -> Geometry, Transform

# ---- group: Cluster Output
geometry_3 = ClusterOutput(rotate_3d.Geometry)

# ==== cluster WSTransformation: Rotates range of geometries around z axis
geometry = ClusterInput()
geometry_2 = Geometry(flatten(geometry))
list_length = ListLength(List=geometry_2)
domain_end = ClusterInput()
volume = Volume(Geometry=geometry_2)  # -> Volume, Centroid
construct_domain = ConstructDomain(DomainStart=0, DomainEnd=domain_end)
expression = Expression(x=list_length, Expression="x-1")
range = Range(Domain=construct_domain, Steps=expression)
unit_z = UnitZ(Factor=1)
pi = Pi(Factor=range)
rotate_3d = Rotate3D(Geometry=geometry_2, Angle=pi, Center=volume.Centroid, Axis=unit_z)  # -> Geometry, Transform

# ---- group: Cluster Output / Unresolved Proxy
geometry_3 = ClusterOutput(rotate_3d.Geometry)

# ==== cluster Cluster_2

# ---- group: Cluster Input
feet = ClusterInput()

thickness = ClusterInput()

# ----
feet_2 = Number(feet)
multiplication = Multiplication(A=feet_2, B=12)
thickness_2 = Number(thickness)
construct_domain = ConstructDomain(DomainStart=0, DomainEnd=multiplication)
range = Range(Domain=construct_domain, Steps=360)
sine = Sine(Value=range)
cosine = Cosine(Value=range)
multiplication_2 = Multiplication(A=sine, B=thickness_2)
multiplication_3 = Multiplication(A=cosine, B=thickness_2)
construct_point = ConstructPoint(XCoordinate=range, YCoordinate=multiplication_2, ZCoordinate=multiplication_3)
interpolate = Interpolate(Vertices=construct_point, Degree=3, Periodic=False, KnotStyle=1)  # -> Curve, Length, Domain
ropecount = ClusterInput()
ropecount_2 = Integer(ropecount)

# ---- group: Cluster Input
target_curve = ClusterInput()

# ----
yz_plane = YZPlane(Origin=Point(0, 0, 0))
polar_array = PolarArray(Geometry=interpolate.Curve, Plane=yz_plane, Count=ropecount_2, Angle=6.283185307)  # -> Geometry, Transform
target_curve_2 = Curve(target_curve)
flow = Flow(
    Geometry=polar_array.Geometry,
    Base=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,
    Target=target_curve_2,
    ReverseBase=False,
    ReverseTarget=False,
    Stretch=True,
    Rigid=False)
pipe = Pipe(Curve=flow, Radius=thickness_2, Caps=1)
geometry = Geometry(pipe)

# ---- group: Cluster Output
geometry_2 = ClusterOutput(geometry)
