# Grasshopper definition WorldOfDuchameDigitalAssestsRope004Cluster.gh (Grasshopper 1.0.7)
# Copyright: Wickerson Studios
# plug-ins: Bifocals

multiplication = Multiplication(A=Slider(2, range=0..10), B=12)
dom = ConstructDomain(DomainStart=0, DomainEnd=multiplication)
multiplication_2 = Multiplication(A=Slider(2, range=0..10), B=12)
number_slider = Slider(18, range=0..100)
range = Range(Domain=dom, Steps=360)
X = UnitX(Factor=multiplication_2)
pt = ConstructPoint(XCoordinate=0, YCoordinate=0, ZCoordinate=0)
sin = Sine(Value=range)
cos = Cosine(Value=range)
neg = Negative(Value=X)
multiplication_3 = Multiplication(A=cos, B=number_slider)
multiplication_4 = Multiplication(A=range, B=Slider(6, range=0..100))
multiplication_5 = Multiplication(A=sin, B=number_slider)
multiplication_6 = Multiplication(A=Slider(14, range=0..20), B=12)
move = Move(Geometry=pt, Motion=X)  # -> Geometry, Transform
move_2 = Move(Geometry=pt, Motion=neg)  # -> Geometry, Transform
pt_2 = ConstructPoint(XCoordinate=multiplication_3, YCoordinate=multiplication_5, ZCoordinate=multiplication_4)
cat = Catenary(PointA=move.Geometry, PointB=move_2.Geometry, Length=multiplication_6, Gravity=Vector(0, 0, -1))
intcrv = Interpolate(Vertices=pt_2, Degree=3, Periodic=False, KnotStyle=1)  # -> Curve, Length, Domain
crv = Curve(<curve referenced from the Rhino model>)
crv_2 = Curve(intcrv.Curve)
crv_3 = Curve(cat)
crv_4 = Curve(<curve referenced from the Rhino model>)
target_curve = Curve(crv_3)
crv_5 = Curve(reparameterize(<curve referenced from the Rhino model>))
target_curve_2 = Curve(crv_2)
target_curve_3 = Curve(crv)
rope = Rope(
    ropecount=Slider(5, range=0..10),
    feet=Slider(21.81, range=0..120),
    thickness=Slider(0.25, range=0..2),
    target_curve=crv_5)
rope_2 = Rope(
    ropecount=Slider(2, range=0..10),
    feet=Slider(10, range=0..10),
    thickness=Slider(0.5, range=0..2),
    target_curve=target_curve_2)
rope_3 = Rope(
    ropecount=Slider(4, range=0..10),
    feet=Slider(20, range=0..20),
    thickness=Slider(1.47, range=0..2),
    target_curve=target_curve_3)
rope_4 = Rope(
    ropecount=Slider(2, range=0..10),
    feet=Slider(20, range=0..20),
    thickness=Slider(0.5, range=0..2),
    target_curve=target_curve)
rope_5 = Rope(ropecount=Slider(2, range=0..10), feet=Slider(20, range=0..20), thickness=Slider(0.5, range=0..2), target_curve=crv_4)

# ==== cluster Rope: Rope

# ---- group: Cluster Input
feet = ClusterInput()

thickness = ClusterInput()

# ----
feet_2 = Number(feet)
multiplication = Multiplication(A=feet_2, B=12)
thickness_2 = Number(thickness)
construct_domain = ConstructDomain(DomainStart=0, DomainEnd=multiplication)
range = Range(Domain=construct_domain, Steps=360)
sine = Sine(Value=range)
cosine = Cosine(Value=range)
multiplication_2 = Multiplication(A=sine, B=thickness_2)
multiplication_3 = Multiplication(A=cosine, B=thickness_2)
construct_point = ConstructPoint(XCoordinate=range, YCoordinate=multiplication_2, ZCoordinate=multiplication_3)
interpolate = Interpolate(Vertices=construct_point, Degree=3, Periodic=False, KnotStyle=1)  # -> Curve, Length, Domain
ropecount = ClusterInput()
ropecount_2 = Integer(ropecount)

# ---- group: Cluster Input
target_curve = ClusterInput()

# ----
yz_plane = YZPlane(Origin=Point(0, 0, 0))
polar_array = PolarArray(Geometry=interpolate.Curve, Plane=yz_plane, Count=ropecount_2, Angle=6.283185307)  # -> Geometry, Transform
target_curve_2 = Curve(target_curve)
flow = Flow(
    Geometry=polar_array.Geometry,
    Base=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,
    Target=target_curve_2,
    ReverseBase=False,
    ReverseTarget=False,
    Stretch=True,
    Rigid=False)
pipe = Pipe(Curve=flow, Radius=thickness_2, Caps=1)
geometry = Geometry(pipe)

# ---- group: Cluster Output
geometry_2 = ClusterOutput(geometry)
