# Grasshopper definition WorldOfDuchameDigitalAssestsSkeleton001.gh (Grasshopper 1.0.7)
# Copyright: Wickerson Studios
# plug-ins: Bifocals

mesh = Mesh(<mesh referenced from the Rhino model>)
mesh_2 = Mesh(<mesh referenced from the Rhino model>)
deconstruct_mesh = DeconstructMesh(Mesh=mesh_2)  # -> flatten(Vertices), Faces, Colours, Normals
dispatch = Dispatch(List=deconstruct_mesh.Vertices, DispatchPattern=[True, False])  # -> ListA, ListB
deconstruct_mesh_2 = DeconstructMesh(Mesh=mesh)  # -> flatten(Vertices), Faces, Colours, Normals
dispatch_2 = Dispatch(List=dispatch.ListA, DispatchPattern=[True, False])  # -> ListA, ListB
dispatch_3 = Dispatch(List=dispatch_2.ListA, DispatchPattern=[True, False])  # -> ListA, ListB
dispatch_4 = Dispatch(List=dispatch_3.ListA, DispatchPattern=[True, False])  # -> ListA, ListB
dispatch_5 = Dispatch(List=deconstruct_mesh_2.Vertices, DispatchPattern=[True, False])  # -> ListA, ListB
surface_from_points = SurfaceFromPoints(Points=dispatch.ListB, UCount=Slider(23, range=0..100), Interpolate=False)
dispatch_6 = Dispatch(List=dispatch_5.ListA, DispatchPattern=[True, False])  # -> ListA, ListB
surface_from_points_2 = SurfaceFromPoints(Points=dispatch_2.ListA, UCount=Slider(7, range=0..100), Interpolate=False)
dispatch_7 = Dispatch(List=dispatch_6.ListA, DispatchPattern=[True, False])  # -> ListA, ListB
dispatch_8 = Dispatch(List=dispatch_7.ListA, DispatchPattern=[True, False])  # -> ListA, ListB
dispatch_9 = Dispatch(List=dispatch_4.ListA, DispatchPattern=[True, False])  # -> ListA, ListB
surface_from_points_3 = SurfaceFromPoints(Points=dispatch_3.ListA, UCount=Slider(3, range=0..100), Interpolate=False)
surface_from_points_4 = SurfaceFromPoints(Points=dispatch_5.ListB, UCount=Slider(15, range=0..100), Interpolate=False)
surface_from_points_5 = SurfaceFromPoints(Points=dispatch_6.ListA, UCount=Slider(15, range=0..100), Interpolate=False)
surface_from_points_6 = SurfaceFromPoints(Points=dispatch_9.ListA, UCount=Slider(3, range=0..10), Interpolate=False)
dispatch_10 = Dispatch(List=dispatch_8.ListA, DispatchPattern=[True, False])  # -> ListA, ListB
dispatch_11 = Dispatch(List=dispatch_9.ListA, DispatchPattern=[True, False])  # -> ListA, ListB
surface_from_points_7 = SurfaceFromPoints(Points=dispatch_7.ListA, UCount=Slider(2, range=0..100), Interpolate=False)
surface_from_points_8 = SurfaceFromPoints(Points=dispatch_10.ListA, UCount=Slider(2, range=0..10), Interpolate=False)
surface_from_points_9 = SurfaceFromPoints(Points=dispatch_11.ListA, UCount=Slider(2, range=0..10), Interpolate=False)
dispatch_12 = Dispatch(List=dispatch_10.ListA, DispatchPattern=[True, False])  # -> ListA, ListB
dispatch_13 = Dispatch(List=dispatch_11.ListA, DispatchPattern=[True, False])  # -> ListA, ListB
dispatch_14 = Dispatch(List=dispatch_13.ListA, DispatchPattern=[True, False])  # -> ListA, ListB
dispatch_15 = Dispatch(List=dispatch_12.ListA, DispatchPattern=[True, False])  # -> ListA, ListB
surface_from_points_10 = SurfaceFromPoints(Points=dispatch_13.ListA, UCount=Slider(2, range=0..10), Interpolate=False)
dispatch_16 = Dispatch(List=dispatch_14.ListA, DispatchPattern=[True, False])  # -> ListA, ListB
dispatch_17 = Dispatch(List=dispatch_15.ListA, DispatchPattern=[True, False])  # -> ListA, ListB
surface_from_points_11 = SurfaceFromPoints(Points=dispatch_15.ListA, UCount=Slider(2, range=0..10), Interpolate=False)
surface_from_points_12 = SurfaceFromPoints(Points=dispatch_16.ListA, UCount=Slider(3, range=0..10), Interpolate=False)
