# Grasshopper definition WorldOfDuchameDigitalAssestsSkullCapsHeadGear001.gh (Grasshopper 1.0.7)
# Copyright: Wickerson Studios
# plug-ins: Bifocals

curve = Curve(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)
curve_2 = Curve(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)
curve_3 = Curve(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)
curve_4 = Curve(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)
curve_5 = Curve(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)
curve_6 = Curve(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)
curve_7 = Curve(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)
merge = Merge(Data1=curve_3, Data2=curve, Data3=curve_4, Data4=curve_5)
network_surface = NetworkSurface(CurvesU=merge, CurvesV=[curve_6, curve_2, curve_7], Continuity=Slider(3, range=0..10))
xz_plane = XZPlane(Origin=Point(0, 0, 0))
mirror = Mirror(Geometry=network_surface, Plane=xz_plane)  # -> Geometry, Transform
number_slider = Slider(11, range=0..100)
divide_surface = DivideSurface(Surface=network_surface, UCount=10, VCount=10)  # -> Points, Normals, Parameters
divide_surface_2 = DivideSurface(Surface=mirror.Geometry, UCount=10, VCount=10)  # -> Points, Normals, Parameters
point = Point(flatten(divide_surface.Points))
point_2 = Point(flatten(divide_surface_2.Points))
surface_from_points = SurfaceFromPoints(Points=point, UCount=number_slider, Interpolate=False)
surface_from_points_2 = SurfaceFromPoints(Points=point_2, UCount=number_slider, Interpolate=False)

number_slider_2 = Slider(8, range=0..100)

md_slider = MDSlider(
    SliderMode=0,
    slider_value=Point(0.4987942765, 0.5047592535, 0.5),
    x_domain=Domain(0, 1),
    y_domain=Domain(0, 1),
    z_domain=Domain(0, 1))
construct_domain = ConstructDomain(DomainU=md_slider, DomainV=md_slider)
isotrim = Isotrim(Surface=reparameterize(surface_from_points_2), Domain=construct_domain)
deconstruct_brep = DeconstructBrep(Brep=isotrim)  # -> Faces, Edges, Vertices
list_item = ListItem(List=deconstruct_brep.Vertices, Index="2", Wrap=True)
surface_closest_point = SurfaceClosestPoint(Point=list_item, Surface=surface_from_points_2)  # -> Point, UVPoint, Distance
evaluate_surface = EvaluateSurface(Surface=surface_from_points_2, Point=surface_closest_point.UVPoint)  # -> Point, expr("-x", Normal), UDirection, VDirection, Frame
amplitude = Amplitude(Vector=evaluate_surface.Normal, Amplitude=number_slider_2)
multiplication = Multiplication(A=evaluate_surface.Normal, B=number_slider_2)
vector_display = VectorDisplay(Anchor=evaluate_surface.Point, Vector=amplitude)
extrude = Extrude(Base=surface_from_points_2, Direction=multiplication)

md_slider_2 = MDSlider(
    SliderMode=0,
    slider_value=Point(0.5048583426, 0.5011406875, 0.5),
    x_domain=Domain(0, 1),
    y_domain=Domain(0, 1),
    z_domain=Domain(0, 1))
construct_domain_2 = ConstructDomain(DomainU=md_slider_2, DomainV=md_slider_2)

isotrim_2 = Isotrim(Surface=reparameterize(surface_from_points), Domain=construct_domain_2)

deconstruct_brep_2 = DeconstructBrep(Brep=isotrim_2)  # -> Faces, Edges, Vertices
list_item_2 = ListItem(List=deconstruct_brep_2.Vertices, Index="2", Wrap=True)
surface_closest_point_2 = SurfaceClosestPoint(Point=list_item_2, Surface=surface_from_points)  # -> Point, UVPoint, Distance
evaluate_surface_2 = EvaluateSurface(Surface=surface_from_points, Point=surface_closest_point_2.UVPoint)  # -> Point, Normal, UDirection, VDirection, Frame
amplitude_2 = Amplitude(Vector=evaluate_surface_2.Normal, Amplitude=number_slider_2)
multiplication_2 = Multiplication(A=evaluate_surface_2.Normal, B=number_slider_2)
vector_display_2 = VectorDisplay(Anchor=evaluate_surface_2.Point, Vector=amplitude_2)
extrude_2 = Extrude(Base=surface_from_points, Direction=multiplication_2)
