# Grasshopper definition WorldOfDuchameDigitalAssestsSword003MaxSword.gh (Grasshopper 1.0.7)
# Copyright: Wickerson Studios
# plug-ins: Bifocals

radius_2 = Radius2(Slider(1.09, range=0..2))
radius_2_2 = Radius2(Slider(0.92, range=0..4))
multiplication = Multiplication(A=Slider(8, range=0..100), B=radius_2)
ellipse = Ellipse(Plane=PlaneXY(0, 0, 0), Radius1=multiplication, Radius2=radius_2_2)  # -> Ellipse, Focus1, Focus2
unit_z = UnitZ(Factor=Slider(2.77, range=0..10))
scale = Scale(Geometry=ellipse.Ellipse, Center=Point(0, 0, 0), Factor=Slider(0.92, range=0..1))  # -> Geometry, Transform
negative = Negative(Value=unit_z)
move = Move(Geometry=scale.Geometry, Motion=[negative, unit_z])  # -> Geometry, Transform
dispatch = Dispatch(List=move.Geometry, DispatchPattern=[True, False])  # -> ListA, ListB
merge = Merge(Data1=dispatch.ListA, Data2=ellipse.Ellipse, Data3=dispatch.ListB)
divide_curve = DivideCurve(Curve=merge, Count=10, Kinks=False)  # -> Points, Tangents, Parameters
boolean_toggle = BooleanToggle(True)
flip_matrix = FlipMatrix(Data=divide_curve.Points)
construct_domain = ConstructDomain(DomainStart=Slider(-2, range=-2..3), DomainEnd=Slider(18, range=0..100))
interpolate = Interpolate(Vertices=flip_matrix, Degree=3, Periodic=boolean_toggle, KnotStyle=1)  # -> flatten(Curve), Length, Domain
point_on_curve = PointOnCurve(interpolate.Curve, parameter=1)
range = Range(Domain=construct_domain, Steps=Slider(7.369, range=0..10))
yz_plane = YZPlane(Origin=Point(0, 0, 0))
network_surface = NetworkSurface(CurvesU=merge, CurvesV=interpolate.Curve, Continuity=2)
unit_z_2 = UnitZ(Factor=range)
rotate_3d = Rotate3D(Geometry=network_surface, Angle=1.570796327, Center=Point(0, 0, 0), Axis=yz_plane)  # -> Geometry, Transform
interpolate_2 = Interpolate(Vertices=point_on_curve, Degree=3, Periodic=boolean_toggle, KnotStyle=1)  # -> Curve, Length, Domain
negative_2 = Negative(Value=unit_z_2)
construct_domain_2 = ConstructDomain(DomainStart=Slider(1.26, range=0..2), DomainEnd=Slider(0.99, range=0..2))
move_2 = Move(Geometry=interpolate_2.Curve, Motion=negative_2)  # -> flatten(Geometry), Transform
range_2 = Range(Domain=construct_domain_2, Steps=10)
area = Area(Geometry=move_2.Geometry)  # -> Area, Centroid
expression = Expression(x=range_2, y=Slider(0.16, range=0..1), Expression="y*(x^2)")
scale_2 = Scale(Geometry=move_2.Geometry, Center=area.Centroid, Factor=expression)  # -> Geometry, Transform
scale_nu = ScaleNU(Geometry=scale_2.Geometry, Plane=PlaneXY(0, 0, 0), ScaleX=1, ScaleY=expr("x*2", Slider(5, range=2..5)), ScaleZ=1)  # -> Geometry, Transform
loft = Loft(
    Curves=scale_nu.Geometry,
    Options={Adjust=False, Closed=False, LoftEnds=0, LoftSimp=0, LoftType=0, Rebuild=10, Refit=0.01})
cap_holes = CapHoles(Brep=loft)
deconstruct_brep = DeconstructBrep(Brep=cap_holes)  # -> Faces, Edges, Vertices
list_item = ListItem(List=deconstruct_brep.Faces, Index=1, Wrap=True)
scale_nu_2 = ScaleNU(Geometry=list_item, Plane=PlaneXY(0, 0, 0), ScaleX=1, ScaleY=Slider(0.28, range=0..1), ScaleZ=1)  # -> Geometry, Transform
unit_x = UnitX(Factor=Slider(1.14, range=0..20))
deconstruct_brep_2 = DeconstructBrep(Brep=scale_nu_2.Geometry)  # -> Faces, Edges, Vertices
unit_z_3 = UnitZ(Factor=Slider(46, range=0..220))
area_2 = Area(Geometry=scale_nu_2.Geometry)  # -> Area, Centroid
curve = Curve(deconstruct_brep_2.Edges)
point_on_curve_2 = PointOnCurve(curve, parameter=0.794)
move_3 = Move(Geometry=area_2.Centroid, Motion=unit_z_3)  # -> Geometry, Transform
move_4 = Move(Geometry=deconstruct_brep_2.Vertices, Motion=unit_x)  # -> Geometry, Transform
line = Line(StartPoint=area_2.Centroid, EndPoint=move_3.Geometry)
point_on_curve_3 = PointOnCurve(line, parameter=0.504)
unit_x_2 = UnitX(Factor=Slider(2.33, range=-20..20.01))
line_2 = Line(StartPoint=move_4.Geometry, EndPoint=point_on_curve_2)
xz_plane = XZPlane(Origin=Point(0, 0, 0))
mirror = Mirror(Geometry=line_2, Plane=xz_plane)  # -> Geometry, Transform
move_5 = Move(Geometry=point_on_curve_3, Motion=unit_x_2)  # -> Geometry, Transform
end_points = EndPoints(Curve=mirror.Geometry)  # -> Start, End
end_points_2 = EndPoints(Curve=[line_2, mirror.Geometry])  # -> Start, End
line_3 = Line(StartPoint=end_points_2.Start, EndPoint=end_points_2.End)
line_4 = Line(StartPoint=end_points.End, EndPoint=end_points_2.End)
arc_3pt = Arc3Pt(PointA=area_2.Centroid, PointB=move_5.Geometry, PointC=move_3.Geometry)  # -> Arc, Plane, Radius
join_curves = JoinCurves(Curves=[line_3, line_4], Preserve=False)
sweep1 = Sweep1(Rail=arc_3pt.Arc, Sections=join_curves, Miter=1)
sweep1_2 = Sweep1(Rail=arc_3pt.Arc, Sections=scale_nu_2.Geometry, Miter=1)
cap_holes_2 = CapHoles(Brep=sweep1)
cap_holes_3 = CapHoles(Brep=sweep1_2)
deconstruct_brep_3 = DeconstructBrep(Brep=cap_holes_3)  # -> Faces, Edges, Vertices
deconstruct_brep_4 = DeconstructBrep(Brep=cap_holes_2)  # -> Faces, Edges, Vertices
list_item_2 = ListItem(List=deconstruct_brep_3.Faces, Index=0, Wrap=True)
surface = Surface(list_item_2)
area_3 = Area(Geometry=surface)  # -> Area, Centroid
motion = Motion(Vector(-2, 0, 4))
list_item_3 = ListItem(List=deconstruct_brep_4.Faces, Index=0, Wrap=True)
move_6 = Move(Geometry=area_3.Centroid, Motion=motion)  # -> Geometry, Transform
surface_2 = Surface(list_item_3)
extrude_point = ExtrudePoint(Base=[surface, surface_2], Point=move_6.Geometry)
geometry = Geometry(extrude_point)
geometry_2 = Geometry(cap_holes_2)
geometry_3 = Geometry(cap_holes_3)
geometry_4 = Geometry(loft)
geometry_5 = Geometry(rotate_3d.Geometry)
solid_union = SolidUnion(Breps=[geometry, geometry_2, geometry_3, geometry_4, geometry_5])
geometry_6 = Geometry(solid_union)
