# Grasshopper definition WorldOfDuchameDigitalAssestsTentWithRopeCluster001.gh (Grasshopper 1.0.7)
# Copyright: Wickerson Studios
# plug-ins: Bifocals

number_slider = Slider(72, range=0..100)
negative = Negative(Value=number_slider)
negative_2 = Negative(Value=number_slider)
construct_domain = ConstructDomain(DomainStart=expr("x/2", negative_2), DomainEnd=expr("x/2", number_slider))
construct_domain_2 = ConstructDomain(DomainStart=negative, DomainEnd=number_slider)
construct_point = ConstructPoint(XCoordinate=0, YCoordinate=0, ZCoordinate=0)
rectangle = Rectangle(Plane=PlaneXY(0, 0, 0), XSize=construct_domain_2, YSize=construct_domain, Radius=0)  # -> Rectangle, Length
scale = Scale(Geometry=rectangle.Rectangle, Center=Point(0, 0, 0), Factor=0.5)  # -> Geometry, Transform
unit_z = UnitZ(Factor=number_slider)
unit_z_2 = UnitZ(Factor=expr("x/2", number_slider))
explode = Explode(Curve=scale.Geometry, Recursive=True)  # -> graft(Segments), Vertices
explode_2 = Explode(Curve=rectangle.Rectangle, Recursive=True)  # -> Segments, Vertices
move = Move(Geometry=explode_2.Vertices, Motion=unit_z_2)  # -> Geometry, Transform
move_2 = Move(Geometry=construct_point, Motion=unit_z)  # -> Geometry, Transform
move_3 = Move(Geometry=explode.Vertices, Motion=unit_z_2)  # -> Geometry, Transform
move_4 = Move(Geometry=explode.Segments, Motion=unit_z_2)  # -> Geometry, Transform
cull_index = CullIndex(List=move_3.Geometry, Indices="-1", Wrap=True)
multiplication = Multiplication(A=number_slider, B=Slider(0.8, range=0..2))
catenary = Catenary(PointA=move_2.Geometry, PointB=cull_index, Length=multiplication, Gravity=Vector(0, 0, -1))
loft_options = LoftOptions(Closed=False, Adjust=Toggle(True), Rebuild=0, Refit=0, Type=0)
loft = Loft(
    Curves=[explode.Segments, move_4.Geometry],
    Options={Adjust=False, Closed=False, LoftEnds=0, LoftSimp=0, LoftType=0, Rebuild=10, Refit=0.01})
list_item = ListItem(List=catenary, Index=0, Wrap=True)  # -> Item, Item1, Item2, Item3
loft_2 = Loft(Curves=[list_item.Item1, list_item.Item2], Options=loft_options)
loft_3 = Loft(Curves=[list_item.Item2, list_item.Item3], Options=loft_options)
loft_4 = Loft(Curves=[list_item.Item3, list_item.Item], Options=loft_options)
loft_5 = Loft(Curves=[list_item.Item, list_item.Item1], Options=loft_options)

curve = Curve(<curve referenced from the Rhino model>)
target_curve = Curve(curve)
rope = Rope(
    ropecount=Slider(4, range=0..10),
    feet=Slider(20, range=0..20),
    thickness=Slider(1.47, range=0..2),
    target_curve=target_curve)

# ==== cluster Rope: Rope

# ---- group: Cluster Input
feet = ClusterInput()

thickness = ClusterInput()

# ----
feet_2 = Number(feet)
multiplication = Multiplication(A=feet_2, B=12)
thickness_2 = Number(thickness)
construct_domain = ConstructDomain(DomainStart=0, DomainEnd=multiplication)
range = Range(Domain=construct_domain, Steps=360)
sine = Sine(Value=range)
cosine = Cosine(Value=range)
multiplication_2 = Multiplication(A=sine, B=thickness_2)
multiplication_3 = Multiplication(A=cosine, B=thickness_2)
construct_point = ConstructPoint(XCoordinate=range, YCoordinate=multiplication_2, ZCoordinate=multiplication_3)
interpolate = Interpolate(Vertices=construct_point, Degree=3, Periodic=False, KnotStyle=1)  # -> Curve, Length, Domain
ropecount = ClusterInput()
ropecount_2 = Integer(ropecount)

# ---- group: Cluster Input
target_curve = ClusterInput()

# ----
yz_plane = YZPlane(Origin=Point(0, 0, 0))
polar_array = PolarArray(Geometry=interpolate.Curve, Plane=yz_plane, Count=ropecount_2, Angle=6.283185307)  # -> Geometry, Transform
target_curve_2 = Curve(target_curve)
flow = Flow(
    Geometry=polar_array.Geometry,
    Base=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,
    Target=target_curve_2,
    ReverseBase=False,
    ReverseTarget=False,
    Stretch=True,
    Rigid=False)
pipe = Pipe(Curve=flow, Radius=thickness_2, Caps=1)
geometry = Geometry(pipe)

# ---- group: Cluster Output
geometry_2 = ClusterOutput(geometry)
