# Grasshopper definition WorldOfDuchameDigitalAssestsTentWithRopeCluster004.gh (Grasshopper 1.0.7)
# Copyright: Wickerson Studios
# plug-ins: Bifocals

number_slider = Slider(72, range=0..100)
negative = Negative(Value=number_slider)
negative_2 = Negative(Value=number_slider)
construct_domain = ConstructDomain(DomainStart=expr("x/2", negative_2), DomainEnd=expr("x/2", number_slider))
construct_domain_2 = ConstructDomain(DomainStart=negative, DomainEnd=number_slider)
construct_point = ConstructPoint(XCoordinate=0, YCoordinate=0, ZCoordinate=0)
rectangle = Rectangle(Plane=PlaneXY(0, 0, 0), XSize=construct_domain_2, YSize=construct_domain, Radius=0)  # -> Rectangle, Length
scale = Scale(Geometry=rectangle.Rectangle, Center=Point(0, 0, 0), Factor=0.5)  # -> Geometry, Transform
unit_z = UnitZ(Factor=number_slider)
explode = Explode(Curve=rectangle.Rectangle, Recursive=True)  # -> Segments, Vertices
unit_z_2 = UnitZ(Factor=expr("x/2", number_slider))
explode_2 = Explode(Curve=scale.Geometry, Recursive=True)  # -> graft(Segments), Vertices
move = Move(Geometry=explode.Vertices, Motion=unit_z_2)  # -> Geometry, Transform
move_2 = Move(Geometry=explode_2.Vertices, Motion=unit_z_2)  # -> Geometry, Transform
line = Line(StartPoint=move_2.Geometry, EndPoint=explode_2.Vertices)
move_3 = Move(Geometry=explode_2.Segments, Motion=unit_z_2)  # -> Geometry, Transform
cull_index = CullIndex(List=move_2.Geometry, Indices="-1", Wrap=True)
multiplication = Multiplication(A=number_slider, B=Slider(0.78, range=0..2))
point = Point(explode.Vertices)
point_2 = Point(move_2.Geometry)
catenary = Catenary(PointA=point_2, PointB=point, Length=multiplication, Gravity=Vector(0, 0, -1))
loft_options = LoftOptions(Closed=Toggle(False), Adjust=Toggle(True), Rebuild=0, Refit=0, Type=Slider(5, range=0..5))
list_item = ListItem(List=catenary, Index=0, Wrap=True)  # -> Item, Item1, Item2, Item3
merge = Merge(Data1=list_item.Item, Data2=list_item.Item1, Data3=list_item.Item2, Data4=list_item.Item3)
xz_plane = XZPlane(Origin=Point(0, 0, 0))
curve = Curve(line)
loft = Loft(
    Curves=[explode_2.Segments, move_3.Geometry],
    Options={Adjust=False, Closed=False, LoftEnds=0, LoftSimp=0, LoftType=0, Rebuild=10, Refit=0.01})

multiplication_2 = Multiplication(A=unit_z, B=Slider(1, range=0..1))

move_4 = Move(Geometry=construct_point, Motion=multiplication_2)  # -> Geometry, Transform
catenary_2 = Catenary(PointA=move_4.Geometry, PointB=cull_index, Length=multiplication, Gravity=Vector(0, 0, -1))
list_item_2 = ListItem(List=catenary_2, Index=0, Wrap=True)  # -> Item, Item1, Item2, Item3
loft_2 = Loft(Curves=[list_item_2.Item3, list_item_2.Item], Options=loft_options)
loft_3 = Loft(Curves=[list_item_2.Item1, list_item_2.Item2], Options=loft_options)
loft_4 = Loft(Curves=[list_item_2.Item2, list_item_2.Item3], Options=loft_options)
geometry = Geometry(list_item_2.Item3)
mirror = Mirror(Geometry=loft_4, Plane=xz_plane)  # -> Geometry, Transform

target_curve = Curve(merge)
list_item_3 = ListItem(List=target_curve, Index=0, Wrap=True)  # -> Item, Item1, Item2, Item3
rope = Rope(
    ropecount=Slider(4, range=0..10),
    feet=Slider(16.98, range=0..20),
    thickness=Slider(0.25, range=0..2),
    target_curve=[list_item_3.Item, list_item_3.Item1, list_item_3.Item2, list_item_3.Item3])

merge_2 = Merge(Data1=mirror.Geometry, Data2=loft_3, Data3=loft_4, Data4=loft_2, Data5=loft)
geometry_2 = Geometry(rope)

surface = Surface(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)
dimensions = Dimensions(Surface=surface)  # -> UDimension, VDimension
number_slider_2 = Slider(35, range=0..100)
division = Division(A=dimensions.UDimension, B=dimensions.VDimension)
multiplication_3 = Multiplication(A=division, B=number_slider_2)

area = Area(Geometry=surface)  # -> Area, Centroid
scale_2 = Scale(Geometry=surface, Center=area.Centroid, Factor=Slider(2.66, range=0..5))  # -> Geometry, Transform
integer = Integer(multiplication_3)
md_slider = MDSlider(
    SliderMode=0,
    slider_value=Point(0.3761499917, 0.5818377239, 0.5),
    x_domain=Domain(0, 1),
    y_domain=Domain(0, 1),
    z_domain=Domain(0, 1))
expression = Expression(x=integer, Expression="x+1")
evaluate_surface = EvaluateSurface(Surface=reparameterize(scale_2.Geometry), Point=md_slider)  # -> Point, Normal, UDirection, VDirection, Frame
number_slider_3 = Slider(1, range=0..2)
number_slider_4 = Slider(1.414, range=0..2)
number_slider_5 = Slider(0.278, range=0..2)

divide_surface = DivideSurface(Surface=surface, UCount=integer, VCount=number_slider_2)  # -> flatten(Points), Normals, Parameters

distance = Distance(PointA=evaluate_surface.Point, PointB=divide_surface.Points)
expression_2 = Expression(
    w=graft([number_slider_5, number_slider_4, number_slider_3]),
    t=distance,
    k=Slider(-3, range=-10..10),
    Expression="sin(w*t + k*sin(w*t))")
expression_3 = Expression(w=graft([number_slider_5, number_slider_4, number_slider_3]), t=distance, Expression="sin(w*t)^2")
expression_4 = Expression(w=graft([number_slider_5, number_slider_4, number_slider_3]), t=distance, Expression="sin(w*t)^2")
expression_5 = Expression(w=graft(number_slider_5), t=distance, Expression="sin(w*t)")
multiplication_4 = Multiplication(A=Slider(8.72, range=0..10), B=expression_2)
unit_z_3 = UnitZ(Factor=multiplication_4)
move_5 = Move(Geometry=divide_surface.Points, Motion=unit_z_3)  # -> Geometry, Transform
surface_from_points = SurfaceFromPoints(Points=move_5.Geometry, UCount=expression, Interpolate=False)

# ==== cluster Rope: Rope

# ---- group: Cluster Input
feet = ClusterInput()

thickness = ClusterInput()

# ----
feet_2 = Number(feet)
multiplication = Multiplication(A=feet_2, B=12)
thickness_2 = Number(thickness)
construct_domain = ConstructDomain(DomainStart=0, DomainEnd=multiplication)
range = Range(Domain=construct_domain, Steps=360)
sine = Sine(Value=range)
cosine = Cosine(Value=range)
multiplication_2 = Multiplication(A=sine, B=thickness_2)
multiplication_3 = Multiplication(A=cosine, B=thickness_2)
construct_point = ConstructPoint(XCoordinate=range, YCoordinate=multiplication_2, ZCoordinate=multiplication_3)
interpolate = Interpolate(Vertices=construct_point, Degree=3, Periodic=False, KnotStyle=1)  # -> Curve, Length, Domain
ropecount = ClusterInput()
ropecount_2 = Integer(ropecount)

# ---- group: Cluster Input
target_curve = ClusterInput()

# ----
yz_plane = YZPlane(Origin=Point(0, 0, 0))
polar_array = PolarArray(Geometry=interpolate.Curve, Plane=yz_plane, Count=ropecount_2, Angle=6.283185307)  # -> graft(Geometry), Transform
target_curve_2 = Curve(target_curve)
base = Base(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)
flow = Flow(
    Geometry=polar_array.Geometry,
    Base=base,
    Target=target_curve_2,
    ReverseBase=False,
    ReverseTarget=False,
    Stretch=True,
    Rigid=False)
mesh_pipe = MeshPipe(Polylines=flow, NumberOfSides=Slider(6, range=0..10), Tolerance=0.1, Radius=thickness_2, Cap=False, Join=False)
geometry = Geometry(mesh_pipe)

# ---- group: Cluster Output
geometry_2 = ClusterOutput(geometry)
